# Grasshopper definition Cross_pattern_1.gh (Grasshopper 1.0.7)

number_of_pattern_repetitions = GetInteger(Slider(2, range=2..20), AtLeast=1, AtMost=1, Maximum=2147483647, Minimum=-2147483648, TreeAccess=False)
base_surface_height = GetNumber(Slider(20, range=5..80), AtLeast=1, AtMost=1, Maximum=1.797693135e+308, Minimum=-1.797693135e+308, TreeAccess=False)
base_surface_width = GetNumber(Slider(20, range=5..80), AtLeast=1, AtMost=1, Maximum=1.797693135e+308, Minimum=-1.797693135e+308, TreeAccess=False)
extrusion = GetNumber(Slider(2, range=1..20), AtLeast=1, AtMost=1, Maximum=1.797693135e+308, Minimum=-1.797693135e+308, TreeAccess=False)
unit_z = UnitZ(Factor=1)
range = Range(Domain=Domain(0, 1), Steps=number_of_pattern_repetitions)
line_sdl = LineSDL(Start="0,0,0", Direction=unit_z, Length=base_surface_height)
graph_mapper = GraphMapper(range, x0=0, x1=1, y0=0, y1=1, container_name="Bezier", cpx=[0, 0.2571769357, 0.7449168563, 1], cpy=[0, 0, 1, 1])
evaluate_curve = EvaluateCurve(Curve=reparameterize(line_sdl), Parameter=graph_mapper)  # -> Point, Tangent, Angle
unit_x = UnitX(Factor=1)
line_sdl_2 = LineSDL(Start=evaluate_curve.Point, Direction=unit_x, Length=base_surface_width)
divide_curve = DivideCurve(Curve=line_sdl_2, Count=10, Kinks=False)  # -> simplify(Points), Tangents, Parameters
relative_item = RelativeItem(Tree=divide_curve.Points, Offset="{+1} (-1)", WrapPaths=False, WrapItems=False)  # -> ItemA, ItemB
relative_item_2 = RelativeItem(Tree=divide_curve.Points, Offset="{+1} (+1)", WrapPaths=False, WrapItems=False)  # -> ItemA, ItemB
unit_y = UnitY(Factor=expr("-x", extrusion))
line = Line(StartPoint=relative_item_2.ItemA, EndPoint=relative_item_2.ItemB)
line_2 = Line(StartPoint=relative_item.ItemA, EndPoint=relative_item.ItemB)
extrude = Extrude(Base=[line, line_2], Direction=unit_y)  # -> flatten(Extrusion)
face_normals = FaceNormals(Mesh=extrude)  # -> Centers, Normals
list_item = ListItem(List=face_normals.Normals, Index=0, Wrap=True)
multiplication = Multiplication(A=list_item, B=0.2)
extrude_2 = Extrude(Base=graft(extrude), Direction=multiplication)
brep_join = BrepJoin(Breps=flatten(extrude_2))  # -> Breps, Closed
bounding_box = BoundingBox(Content=brep_join.Breps, Plane=PlaneXY(0, 0, 0), UnionBox=True)  # -> Box, Box_2
volume = Volume(Geometry=bounding_box.Box)  # -> Volume, Centroid
orient = Orient(Geometry=brep_join.Breps, Source=volume.Centroid, Target=PlaneXY(0, 0, 0))  # -> Geometry, Transform
mesh = Mesh(orient.Geometry)
mesh_join = MeshJoin(Meshes=mesh)
mesh_2 = Mesh(mesh_join)
context_bake = ContextBake(Geometry=mesh_2)
