# Grasshopper definition Cross_pattern_2.gh (Grasshopper 1.0.7)

number_of_pattern_repetitions = GetInteger(Slider(2, range=2..20), AtLeast=1, AtMost=1, Maximum=2147483647, Minimum=-2147483648, TreeAccess=False)
base_surface_height = GetNumber(Slider(20, range=5..80), AtLeast=1, AtMost=1, Maximum=1.797693135e+308, Minimum=-1.797693135e+308, TreeAccess=False)
base_surface_width = GetNumber(Slider(20, range=5..80), AtLeast=1, AtMost=1, Maximum=1.797693135e+308, Minimum=-1.797693135e+308, TreeAccess=False)
extrusion = GetNumber(Slider(2, range=1..20), AtLeast=1, AtMost=1, Maximum=1.797693135e+308, Minimum=-1.797693135e+308, TreeAccess=False)
unit_z = UnitZ(Factor=1)
range = Range(Domain=Domain(0, 1), Steps=number_of_pattern_repetitions)
line_sdl = LineSDL(Start="0,0,0", Direction=unit_z, Length=base_surface_height)
graph_mapper = GraphMapper(range, x0=0, x1=1, y0=0, y1=1, container_name="Bezier", cpx=[0, 0.2571769357, 0.7449168563, 1], cpy=[0, 0, 1, 1])
evaluate_curve = EvaluateCurve(Curve=reparameterize(line_sdl), Parameter=graph_mapper)  # -> Point, Tangent, Angle
unit_x = UnitX(Factor=1)
line_sdl_2 = LineSDL(Start=evaluate_curve.Point, Direction=unit_x, Length=base_surface_width)
divide_curve = DivideCurve(Curve=line_sdl_2, Count=10, Kinks=False)  # -> simplify(Points), Tangents, Parameters
relative_item = RelativeItem(Tree=divide_curve.Points, Offset="{+1} (-1)", WrapPaths=False, WrapItems=False)  # -> ItemA, ItemB
relative_item_2 = RelativeItem(Tree=divide_curve.Points, Offset="{+1} (+1)", WrapPaths=False, WrapItems=False)  # -> ItemA, ItemB
unit_y = UnitY(Factor=expr("-x", extrusion))
line = Line(StartPoint=relative_item_2.ItemA, EndPoint=relative_item_2.ItemB)
line_2 = Line(StartPoint=relative_item.ItemA, EndPoint=relative_item.ItemB)
extrude = Extrude(Base=[line, line_2], Direction=unit_y)  # -> flatten(Extrusion)
area = Area(Geometry=extrude)  # -> Area, Centroid
face_normals = FaceNormals(Mesh=extrude)  # -> Centers, Normals
scale = Scale(Geometry=extrude, Center=area.Centroid, Factor=0.5)  # -> Geometry, Transform
list_item = ListItem(List=face_normals.Normals, Index=0, Wrap=True)
opening = GetBoolean(Toggle(False), AtLeast=1, AtMost=1, FalseValue="False", TreeAccess=False, TrueValue="True")
multiplication = Multiplication(A=list_item, B=0.2)
solid_difference = SolidDifference(BrepsA=extrude, BrepsB=scale.Geometry)
boolean = Boolean(opening)
stream_filter = StreamFilter(Gate=boolean, Stream0=extrude, Stream1=solid_difference)
extrude_2 = Extrude(Base=graft(stream_filter), Direction=multiplication)
brep_join = BrepJoin(Breps=flatten(extrude_2))  # -> Breps, Closed
bounding_box = BoundingBox(Content=brep_join.Breps, Plane=PlaneXY(0, 0, 0), UnionBox=True)  # -> Box, Box_2
volume = Volume(Geometry=bounding_box.Box)  # -> Volume, Centroid
orient = Orient(Geometry=brep_join.Breps, Source=volume.Centroid, Target=PlaneXY(0, 0, 0))  # -> Geometry, Transform
mesh = Mesh(orient.Geometry)
mesh_join = MeshJoin(Meshes=mesh)
mesh_2 = Mesh(mesh_join)
bounding_box_2 = BoundingBox(Content=mesh_2, Plane=PlaneXY(0, 0, 0))  # -> Box, Box_2
deconstruct_brep = DeconstructBrep(Brep=bounding_box_2.Box)  # -> Faces, Edges, Vertices
list_item_2 = ListItem(List=deconstruct_brep.Faces, Index=0, Wrap=True)  # -> Item, Item1, Item2, Item3, Item4, Item5
surface = Surface(list_item_2.Item4)
surface_2 = Surface(list_item_2.Item5)
surface_3 = Surface([list_item_2.Item1, list_item_2.Item3])
face_normals_2 = FaceNormals(Mesh=surface_3)  # -> Centers, Normals
face_normals_3 = FaceNormals(Mesh=surface)  # -> Centers, Normals
face_normals_4 = FaceNormals(Mesh=surface_2)  # -> Centers, Normals
list_item_3 = ListItem(List=face_normals_2.Normals, Index=0, Wrap=True)
list_item_4 = ListItem(List=face_normals_3.Normals, Index=0, Wrap=True)
list_item_5 = ListItem(List=face_normals_4.Normals, Index=0, Wrap=True)
multiplication_2 = Multiplication(A=list_item_3, B=0.5)
multiplication_3 = Multiplication(A=list_item_4, B=0.5)
multiplication_4 = Multiplication(A=list_item_5, B=0.5)
extrude_3 = Extrude(Base=graft(surface_3), Direction=multiplication_2)  # -> flatten(Extrusion)
value_list = ValueList({"No frame": 0, "Side": 1, "Bottom": 2, "Top": 3}, selected="No frame")
extrude_4 = Extrude(Base=graft(surface), Direction=multiplication_3)
extrude_5 = Extrude(Base=graft(surface_2), Direction=multiplication_4)
frame_type = GetInteger(value_list, AtLeast=1, AtMost=1, Maximum=2147483647, Minimum=-2147483648, TreeAccess=False)
brep = Brep(extrude_3)
brep_2 = Brep(extrude_4)
brep_3 = Brep(extrude_5)
stream_filter_2 = StreamFilter(Gate=frame_type, Stream1=brep, Stream2=brep_2, Stream3=brep_3)
mesh_3 = Mesh(stream_filter_2)
mesh_join_2 = MeshJoin(Meshes=flatten([mesh_2, mesh_3]))
context_bake = ContextBake(Geometry=mesh_join_2)
