# Grasshopper definition Dawid_app_prototype_2.gh (Grasshopper 1.0.7)
# plug-ins: Urbano

download_dem_and_build_terrain_mesh = DownloadDEMAndBuildTerrainMesh(LeftBound="18.650", RightBound="18.680", TopBound="50.305", BottomBound="50.285", XCount=100, YCount=100)  # -> TerrainMesh, UTMZone, TranslationVector; disabled
download_openstreetmap_osm = DownloadOpenStreetMapOSM(LeftBound="18.650", RightBound="18.680", TopBound="50.305", BottomBound="50.285", RunToggle=True)  # -> OSMQueryURL, OSMFilePath; disabled
text_join = TextJoin(Text=["18.650", "50.285", "18.680", "50.305"], Join=",")
data = Data(text_join)
bbox_left_bottom_right_top = Panel(data)

download_dem_and_build_terrain_mesh_2 = DownloadDEMAndBuildTerrainMesh(LeftBound="17.025", RightBound="17.045", TopBound="51.120", BottomBound="51.105", XCount=100, YCount=100)  # -> TerrainMesh, UTMZone, TranslationVector; disabled
download_openstreetmap_osm_2 = DownloadOpenStreetMapOSM(LeftBound="17.025", RightBound="17.045", TopBound="51.120", BottomBound="51.105", RunToggle=True)  # -> OSMQueryURL, OSMFilePath; disabled
text_join_2 = TextJoin(Text=["17.025", "51.105", "17.045", "51.120"], Join=",")
data_2 = Data(text_join_2)
bbox_left_bottom_right_top_2 = Panel(data_2)

# ----
# Topic: App for citizens not familiar with OSM data to find nearest desired feature and evaluate their location in regards to 15-minute cities (parks,﻿ playgrounds, shops etc.)
location = ValueList({"Gliwice": 0, "Wroclaw": 1}, selected="Gliwice")
location_2 = GetInteger(location, AtLeast=1, AtMost=1, Maximum=2147483647, Minimum=-2147483648, TreeAccess=False)

stream_filter = StreamFilter(Gate=location_2, Stream0=bbox_left_bottom_right_top, Stream1=bbox_left_bottom_right_top_2)
data_3 = Data(stream_filter)

# ----
# OSM info: https://wiki.openstreetmap.org/wiki/Map_features
# Cluester info: Clusters can manage a larger area than native gh components
amenity = ValueList({"Park": 0, "Playground": 1}, selected="Park")
amenity_2 = GetInteger(amenity, AtLeast=1, AtMost=1, Maximum=2147483647, Minimum=-2147483648, TreeAccess=False)

get_data_from_osm = GetDataFromOSM(T=data_3, txt="highway")  # -> out_2, in_2, feat_2
get_data_from_osm_2 = GetDataFromOSM(T=data_3, txt="building")  # -> out_2, in_2, feat_2

get_data_from_osm_3 = GetDataFromOSM(T=data_3, txt="leisure", txt_2="playground")  # -> out_2, in_2, feat_2
get_data_from_osm_4 = GetDataFromOSM(T=data_3, txt="leisure", txt_2="park")  # -> out_2, in_2, feat_2

import_osm_features = ImportOSMFeatures(OSMPathOrURL=get_data_from_osm.in_2, OSMFeatureType="street", Format="xml", ImportAltitude=False)  # -> Points, Metadata, UTMZone, TranslationVector
stream_filter_2 = StreamFilter(Gate=amenity_2, Stream0=get_data_from_osm_4.in_2, Stream1=get_data_from_osm_3.in_2)
stream_filter_3 = StreamFilter(Gate=amenity_2, Stream0=get_data_from_osm_4.feat_2, Stream1=get_data_from_osm_3.feat_2)
import_osm_features_2 = ImportOSMFeatures(OSMPathOrURL=get_data_from_osm_2.in_2, OSMFeatureType=get_data_from_osm_2.feat_2, Format="xml", ImportAltitude=False)  # -> Points, Metadata, UTMZone, TranslationVector
import_osm_features_3 = ImportOSMFeatures(OSMPathOrURL=stream_filter_2, OSMFeatureType=stream_filter_3, Format="xml", ImportAltitude=False)  # -> Points, Metadata, UTMZone, TranslationVector
point = Point(import_osm_features_2.Points)
point_2 = Point(import_osm_features.Points)
polyline = PolyLine(Vertices=point_2, Closed=False)
polyline_2 = PolyLine(Vertices=point, Closed=False)
point_3 = Point(import_osm_features_3.Points)
create_building = CreateBuilding(BuildingCurve=polyline_2, Metadata=import_osm_features_2.Metadata)
create_street_network = CreateStreetNetwork(
    StreetCurves=flatten(polyline),
    Metadata=flatten(import_osm_features.Metadata),
    SplitStreetCurves=False,
    UTMZone=import_osm_features.UTMZone,
    TranslationVector=import_osm_features.TranslationVector)  # -> StreetNetwork, StreetSegmentCurves, UTMZone, TranslationVector
polyline_3 = PolyLine(Vertices=point_3, Closed=False)

curve = Curve(flatten(polyline_3))
context_bake = ContextBake(AllAmenities=curve)

curve_2 = Curve(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)
curve_3 = Curve(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)
start_location_1 = GetGeometry(curve_2, AtLeast=1, AtMost=1, DeleteInput=False, Filter=1074004029, TreeAccess=False)
start_location_2 = GetGeometry(curve_3, AtLeast=1, AtMost=1, DeleteInput=False, Filter=1074004029, TreeAccess=False)
stream_filter_4 = StreamFilter(Gate=location_2, Stream0=start_location_1, Stream1=start_location_2)

build_urbano_model = BuildUrbanoModel(Buildings=flatten(create_building), StreetNetwork=create_street_network.StreetNetwork, BuildToggle=False)  # -> UrbanoModel, BuildingCurves, Activities; disabled

bounding_box = BoundingBox(Content=flatten(polyline_3), Plane=PlaneXY(0, 0, 0), UnionBox=True)  # -> Box, Box_2
bounding_box_2 = BoundingBox(Content=flatten(create_building), Plane=PlaneXY(0, 0, 0), UnionBox=True)  # -> Box, Box_2
bounding_box_3 = BoundingBox(Content=flatten([bounding_box_2.Box, bounding_box.Box]), Plane=PlaneXY(0, 0, 0), UnionBox=True)  # -> Box, Box_2
deconstruct_brep = DeconstructBrep(Brep=bounding_box_3.Box)  # -> Faces, Edges, Vertices
surface = Surface(deconstruct_brep.Faces)
area = Area(Geometry=surface)  # -> Area, Centroid
scale = Scale(Geometry=surface, Center=area.Centroid, Factor="1.1")  # -> Geometry, Transform
unit_z = UnitZ(Factor="20")
negative = Negative(Value=unit_z)
extrude = Extrude(Base=scale.Geometry, Direction=negative)
brep = Brep(extrude)
curve_4 = Curve(flatten(polyline))
trim_with_breps = TrimWithBreps(Curve=curve_4, Brep=brep)  # -> Inside, Outside

inspect_building = InspectBuilding(Building=create_building, DefaultHeight=1)  # -> Geometry, Metadata, Amenity, BuildingMesh; disabled

curve_5 = Curve(flatten(create_building))
context_bake_2 = ContextBake(Buildings=curve_5)

curve_6 = Curve(stream_filter_4)
context_bake_3 = ContextBake(StartGeometry=curve_6)

walking_time_min = GetInteger(Slider(8, range=0..30), AtLeast=1, AtMost=1, Maximum=2147483647, Minimum=-2147483648, TreeAccess=False)

area_2 = Area(Geometry=stream_filter_4)  # -> Area, Centroid
pull_point = PullPoint(Point=area_2.Centroid, Geometry=polyline_3, ClosestOnly=True)  # -> flatten(ClosestPoint), Distance
router = Router(
    RouterUrbanoModelOrStreetNetwork=create_street_network.StreetNetwork,
    Origin=stream_filter_4,
    Destination=pull_point.ClosestPoint,
    TravelMode="pedestrian",
    TimeLimit=-1)  # -> Trip, Route, Time, Distance
panel = Panel(router.Time)
smaller_than = SmallerThan(FirstNumber=router.Time, SecondNumber=walking_time_min)  # -> SmallerThan, OrEqualTo

dispatch = Dispatch(List=polyline_3, DispatchPattern=smaller_than.SmallerThan)  # -> ListA, ListB
dispatch_2 = Dispatch(List=router.Trip, DispatchPattern=smaller_than.SmallerThan)  # -> ListA, ListB
dispatch_3 = Dispatch(List=router.Route, DispatchPattern=smaller_than.SmallerThan)  # -> ListA, ListB
intrip = InspectTrip(Trip=dispatch_2.ListA)  # -> Origin, Destination, Time, Distance, Route, Mode, People, Activity, Amenity
point_4 = Point(intrip.Destination)

simple_mesh = SimpleMesh(Brep=brep)
context_bake_4 = ContextBake(FlatTerrain=simple_mesh)

curve_7 = Curve(flatten(trim_with_breps.Inside))
context_bake_5 = ContextBake(Geometry=curve_7)

curve_8 = Curve(dispatch.ListA)
curve_9 = Curve(dispatch_3.ListA)
context_bake_6 = ContextBake(AvailableAmenities=curve_8)
context_bake_7 = ContextBake(Geometry=curve_9)

# ==== cluster GetDataFromOSM
T = ClusterInput()
txt = ClusterInput()
txt_2 = ClusterInput()
txt_3 = ClusterInput()
txt_4 = Text(txt_2)
txt_5 = Text(txt_3)
txt_6 = Text(txt)
lng = ListLength(List=txt_6)
equals = Equality(FirstNumber=lng, SecondNumber="1")  # -> Equality, Inequality
concat = Concatenate(FragmentD=" modv=\"not\"", FragmentA=" v=\"", FragmentB=txt_5, FragmentC="\"")
concat_2 = Concatenate(FragmentA=" v=\"", FragmentB=txt_4, FragmentC="\"")
null = NullItem(Item=txt_4)  # -> NullFlags, InvalidFlags, Description
null_2 = NullItem(Item=txt_5)  # -> NullFlags, InvalidFlags, Description
split = TextSplit(Text=T, Separators=",")
filter = StreamFilter(Gate=null.NullFlags, Stream0=concat_2)
filter_2 = StreamFilter(Gate=null_2.NullFlags, Stream0=concat)
item = ListItem(List=split, Index=0, Wrap=True)  # -> Item, Item1, Item2, Item3
panel = Panel("""node
way
relation""")
merge = Merge(Data1=item.Item1, Data2=item.Item, Data3=item.Item3, Data4=item.Item2)  # -> flatten(Result)
merge_2 = Merge(Data1=filter, Data2=filter_2)  # -> flatten(Result)
concat_3 = Concatenate(
    FragmentA="<query type=\"",
    FragmentB=panel,
    FragmentC="\"><has-kv k=\"",
    FragmentD=txt_6,
    FragmentE="\"",
    FragmentF=graft(merge_2),
    FragmentG="/></query>")
join = TextJoin(Text=merge, Join=",")
lng_2 = ListLength(List=merge)
equals_2 = Equality(FirstNumber="4", SecondNumber=lng_2)  # -> Equality, Inequality
join_2 = TextJoin(Text=concat_3)  # -> flatten(Result)
join_3 = TextJoin(Text=join_2)
panel_2 = Panel("""<union>
<item/>
<recurse type="down"/>
</union>
<print mode="body"/>
</osm-script>""")
concat_4 = Concatenate(FragmentA="<union>", FragmentB=join_3, FragmentC="</union>")
concat_5 = Concatenate(FragmentA="<osm-script output=\"xml\" timeout=\"100\" bbox=\"", FragmentB=join, FragmentC="\">")
concat_6 = Concatenate(FragmentA=concat_5, FragmentD=concat_4, FragmentC=panel_2)
p_n_c = PickNChoose(Pattern=equals.Equality, Stream0="insert one and only key", Stream1=concat_6)
filter_3 = StreamFilter(Gate=equals_2.Equality, Stream1=p_n_c)
concat_7 = Concatenate(FragmentA="http://overpass-api.de/api/interpreter?data=", FragmentB=filter_3)
key = Text(txt)
out = Text(filter_3)
feat = Text(key)
in = Text(concat_7)
in_2 = ClusterOutput(in)
out_2 = ClusterOutput(out)
feat_2 = ClusterOutput(feat)
