# Grasshopper definition Dawid_app_prototype_MVP_2.gh (Grasshopper 1.0.7)
# plug-ins: ShapeDiverForGrasshopper, Urbano

sddp = ShapeDiverDocumentPayload({AbsoluteTolerance=0, AngleTolerance=0, DistanceDisplayPrecision=0, GltfVersion="Gltf2", GrasshopperVersion="1.0.0007", InputGroups="{}", OutputGroups="{}", RelativeTolerance=0, RhinoVersion="7.36.23346.16351", UnitSystem=0, VersionCreated="1.17.0.0", VersionSaved="1.17.0.0"})
box_size = Panel("0.010")
centerpoint_w_e = Panel("17.03434")
centerpoint_n_s = Panel("51.10765")
division = Division(A=box_size, B=2)
coordiantes_w_e = GetNumber(centerpoint_w_e, AtLeast=1, AtMost=1, Maximum=1.797693135e+308, Minimum=-1.797693135e+308, TreeAccess=False)
coordinates_n_s = GetNumber(centerpoint_n_s, AtLeast=1, AtMost=1, Maximum=1.797693135e+308, Minimum=-1.797693135e+308, TreeAccess=False)
division_2 = Division(A=division, B=1.5)
addition = Addition(A=coordinates_n_s, B=division_2)
subtraction = Subtraction(A=coordinates_n_s, B=division_2)
addition_2 = Addition(A=coordiantes_w_e, B=division)
subtraction_2 = Subtraction(A=coordiantes_w_e, B=division)
download_openstreetmap_osm = DownloadOpenStreetMapOSM(LeftBound=subtraction_2, RightBound=addition_2, TopBound=addition, BottomBound=subtraction, RunToggle=True)  # -> OSMQueryURL, OSMFilePath
import_osm_features = ImportOSMFeatures(OSMPathOrURL=download_openstreetmap_osm.OSMQueryURL, OSMFeatureType="street", Format="xml", ImportAltitude=False)  # -> Points, Metadata, UTMZone, TranslationVector
point = Point(import_osm_features.Points)
polyline = PolyLine(Vertices=point, Closed=False)  # -> flatten(Polyline)
context_bake = ContextBake(AllRoads=polyline)
