# Grasshopper definition Dawid_app_prototype_MVP_3.gh (Grasshopper 1.0.7)
# plug-ins: Urbano, ShapeDiverForGrasshopper

sddp = ShapeDiverDocumentPayload({AbsoluteTolerance=0, AngleTolerance=0, DistanceDisplayPrecision=0, GltfVersion="Gltf2", GrasshopperVersion="1.0.0007", InputGroups="{}", OutputGroups="{}", RelativeTolerance=0, RhinoVersion="7.36.23346.16351", UnitSystem=0, VersionCreated="1.17.0.0", VersionSaved="1.17.0.0"})
box_size = Panel("0.010")
centerpoint_w_e = Panel("17.03434")
centerpoint_n_s = Panel("51.10765")
division = Division(A=box_size, B=2)
coordiantes_w_e = GetNumber(centerpoint_w_e, AtLeast=1, AtMost=1, Maximum=1.797693135e+308, Minimum=-1.797693135e+308, TreeAccess=False)
coordinates_n_s = GetNumber(centerpoint_n_s, AtLeast=1, AtMost=1, Maximum=1.797693135e+308, Minimum=-1.797693135e+308, TreeAccess=False)
division_2 = Division(A=division, B=1.5)
addition = Addition(A=coordinates_n_s, B=division_2)
subtraction = Subtraction(A=coordinates_n_s, B=division_2)
addition_2 = Addition(A=coordiantes_w_e, B=division)
subtraction_2 = Subtraction(A=coordiantes_w_e, B=division)
text_join = TextJoin(Text=[subtraction_2, subtraction, addition_2, addition], Join=",")
data = Data(text_join)
bbox_left_bottom_right_top = Panel(data)
data_2 = Data(bbox_left_bottom_right_top)
panel = Panel("""service
residential""")
panel_2 = Panel("""footway
bridleway
steps
corridor
path
sidewalk
crossing
pedestrian
living street""")
get_data_from_osm = GetDataFromOSM(T=data_2, txt="highway", txt_2=[panel_2, panel])  # -> out_2, in_2, feat_2
import_osm_features = ImportOSMFeatures(OSMPathOrURL=get_data_from_osm.in_2, OSMFeatureType="street", Format="xml", ImportAltitude=False)  # -> Points, Metadata, UTMZone, TranslationVector
point = Point(import_osm_features.Points)
polyline = PolyLine(Vertices=point, Closed=False)
context_bake = ContextBake(AllRoads=polyline)

# ==== cluster GetDataFromOSM
T = ClusterInput()
txt = ClusterInput()
txt_2 = ClusterInput()
txt_3 = ClusterInput()
txt_4 = Text(txt_2)
txt_5 = Text(txt_3)
txt_6 = Text(txt)
lng = ListLength(List=txt_6)
equals = Equality(FirstNumber=lng, SecondNumber="1")  # -> Equality, Inequality
concat = Concatenate(FragmentD=" modv=\"not\"", FragmentA=" v=\"", FragmentB=txt_5, FragmentC="\"")
concat_2 = Concatenate(FragmentA=" v=\"", FragmentB=txt_4, FragmentC="\"")
null = NullItem(Item=txt_4)  # -> NullFlags, InvalidFlags, Description
null_2 = NullItem(Item=txt_5)  # -> NullFlags, InvalidFlags, Description
split = TextSplit(Text=T, Separators=",")
filter = StreamFilter(Gate=null.NullFlags, Stream0=concat_2)
filter_2 = StreamFilter(Gate=null_2.NullFlags, Stream0=concat)
item = ListItem(List=split, Index=0, Wrap=True)  # -> Item, Item1, Item2, Item3
panel = Panel("""node
way
relation""")
merge = Merge(Data1=item.Item1, Data2=item.Item, Data3=item.Item3, Data4=item.Item2)  # -> flatten(Result)
merge_2 = Merge(Data1=filter, Data2=filter_2)  # -> flatten(Result)
concat_3 = Concatenate(
    FragmentA="<query type=\"",
    FragmentB=panel,
    FragmentC="\"><has-kv k=\"",
    FragmentD=txt_6,
    FragmentE="\"",
    FragmentF=graft(merge_2),
    FragmentG="/></query>")
join = TextJoin(Text=merge, Join=",")
lng_2 = ListLength(List=merge)
equals_2 = Equality(FirstNumber="4", SecondNumber=lng_2)  # -> Equality, Inequality
join_2 = TextJoin(Text=concat_3)  # -> flatten(Result)
join_3 = TextJoin(Text=join_2)
panel_2 = Panel("""<union>
<item/>
<recurse type="down"/>
</union>
<print mode="body"/>
</osm-script>""")
concat_4 = Concatenate(FragmentA="<union>", FragmentB=join_3, FragmentC="</union>")
concat_5 = Concatenate(FragmentA="<osm-script output=\"xml\" timeout=\"100\" bbox=\"", FragmentB=join, FragmentC="\">")
concat_6 = Concatenate(FragmentA=concat_5, FragmentD=concat_4, FragmentC=panel_2)
p_n_c = PickNChoose(Pattern=equals.Equality, Stream0="insert one and only key", Stream1=concat_6)
filter_3 = StreamFilter(Gate=equals_2.Equality, Stream1=p_n_c)
concat_7 = Concatenate(FragmentA="http://overpass-api.de/api/interpreter?data=", FragmentB=filter_3)
key = Text(txt)
out = Text(filter_3)
feat = Text(key)
in = Text(concat_7)
in_2 = ClusterOutput(in)
out_2 = ClusterOutput(out)
feat_2 = ClusterOutput(feat)
