# Grasshopper definition Dawid_app_prototype_MVP_4.gh (Grasshopper 1.0.7)
# plug-ins: Urbano, ShapeDiverForGrasshopper

sddp = ShapeDiverDocumentPayload({AbsoluteTolerance=0, AngleTolerance=0, DistanceDisplayPrecision=0, GltfVersion="Gltf2", GrasshopperVersion="1.0.0007", InputGroups="{}", OutputGroups="{}", RelativeTolerance=0, RhinoVersion="7.36.23346.16351", UnitSystem=0, VersionCreated="1.17.0.0", VersionSaved="1.17.0.0"})
box_size = Panel("0.010")
centerpoint_w_e = Panel("17.03434")
centerpoint_n_s = Panel("51.10765")
division = Division(A=box_size, B=2)
coordiantes_w_e = GetNumber(centerpoint_w_e, AtLeast=1, AtMost=1, Maximum=1.797693135e+308, Minimum=-1.797693135e+308, TreeAccess=False)
coordinates_n_s = GetNumber(centerpoint_n_s, AtLeast=1, AtMost=1, Maximum=1.797693135e+308, Minimum=-1.797693135e+308, TreeAccess=False)
division_2 = Division(A=division, B=1.5)
addition = Addition(A=coordinates_n_s, B=division_2)
subtraction = Subtraction(A=coordinates_n_s, B=division_2)
addition_2 = Addition(A=coordiantes_w_e, B=division)
subtraction_2 = Subtraction(A=coordiantes_w_e, B=division)
text_join = TextJoin(Text=[subtraction_2, subtraction, addition_2, addition], Join=",")
data = Data(text_join)
bbox_left_bottom_right_top = Panel(data)
panel = Panel("""service
residential""")
data_2 = Data(bbox_left_bottom_right_top)
# OSM info: https://wiki.openstreetmap.org/wiki/Map_features
amenity = ValueList({"Park": 0, "Playground": 1}, selected="Playground")
panel_2 = Panel("""motorway
trunk
primary
secondary
tertiary
unclassified""")
panel_3 = Panel("""footway
bridleway
steps
corridor
path
sidewalk
crossing
pedestrian
living street""")
amenity_2 = GetInteger(amenity, AtLeast=1, AtMost=1, Maximum=2147483647, Minimum=-2147483648, TreeAccess=False)
get_data_from_osm = GetDataFromOSM(T=data_2, txt="highway", txt_2=[panel_2, panel])  # -> out_2, in_2, feat_2
get_data_from_osm_2 = GetDataFromOSM(T=data_2, txt="leisure", txt_2="playground")  # -> out_2, in_2, feat_2
get_data_from_osm_3 = GetDataFromOSM(T=data_2, txt="leisure", txt_2="park")  # -> out_2, in_2, feat_2
get_data_from_osm_4 = GetDataFromOSM(T=data_2, txt="highway", txt_2=[panel_3, panel])  # -> out_2, in_2, feat_2
get_data_from_osm_5 = GetDataFromOSM(T=data_2, txt="building")  # -> out_2, in_2, feat_2
stream_filter = StreamFilter(Gate=amenity_2, Stream0=get_data_from_osm_3.in_2, Stream1=get_data_from_osm_2.in_2)
stream_filter_2 = StreamFilter(Gate=amenity_2, Stream0=get_data_from_osm_3.feat_2, Stream1=get_data_from_osm_2.feat_2)
import_osm_features = ImportOSMFeatures(OSMPathOrURL=get_data_from_osm.in_2, OSMFeatureType="street", Format="xml", ImportAltitude=False)  # -> Points, Metadata, UTMZone, TranslationVector
import_osm_features_2 = ImportOSMFeatures(OSMPathOrURL=get_data_from_osm_4.in_2, OSMFeatureType="street", Format="xml", ImportAltitude=False)  # -> Points, Metadata, UTMZone, TranslationVector
import_osm_features_3 = ImportOSMFeatures(OSMPathOrURL=get_data_from_osm_5.in_2, OSMFeatureType=get_data_from_osm_5.feat_2, Format="xml", ImportAltitude=False)  # -> Points, Metadata, UTMZone, TranslationVector
import_osm_features_4 = ImportOSMFeatures(OSMPathOrURL=stream_filter, OSMFeatureType=stream_filter_2, Format="xml", ImportAltitude=False)  # -> Points, Metadata, UTMZone, TranslationVector
point = Point(import_osm_features.Points)
point_2 = Point(import_osm_features_2.Points)
point_3 = Point(import_osm_features_3.Points)
polyline = PolyLine(Vertices=point, Closed=False)
polyline_2 = PolyLine(Vertices=point_2, Closed=False)
polyline_3 = PolyLine(Vertices=point_3, Closed=False)
point_4 = Point(import_osm_features_4.Points)
create_building = CreateBuilding(BuildingCurve=polyline_3, Metadata=import_osm_features_3.Metadata)
create_street_network = CreateStreetNetwork(
    StreetCurves=flatten(polyline),
    Metadata=flatten(import_osm_features.Metadata),
    SplitStreetCurves=True,
    UTMZone=import_osm_features.UTMZone,
    TranslationVector=import_osm_features.TranslationVector)  # -> StreetNetwork, StreetSegmentCurves, UTMZone, TranslationVector
create_street_network_2 = CreateStreetNetwork(
    StreetCurves=flatten(polyline_2),
    Metadata=flatten(import_osm_features_2.Metadata),
    SplitStreetCurves=True,
    UTMZone=import_osm_features_2.UTMZone,
    TranslationVector=import_osm_features_2.TranslationVector)  # -> StreetNetwork, StreetSegmentCurves, UTMZone, TranslationVector
polyline_4 = PolyLine(Vertices=point_4, Closed=False)
curve = Curve(flatten(polyline_4))
unit_z = UnitZ(Factor=0.1)
bounding_box = BoundingBox(Content=flatten(polyline_4), Plane=PlaneXY(0, 0, 0), UnionBox=True)  # -> Box, Box_2
bounding_box_2 = BoundingBox(Content=flatten(create_building), Plane=PlaneXY(0, 0, 0), UnionBox=True)  # -> Box, Box_2
bounding_box_3 = BoundingBox(Content=flatten(polyline_2), Plane=PlaneXY(0, 0, 0), UnionBox=True)  # -> Box, Box_2
inspect_building = InspectBuilding(Building=create_building, DefaultHeight="5")  # -> Geometry, Metadata, Amenity, BuildingMesh
extrude = Extrude(Base=curve, Direction=unit_z)
bounding_box_4 = BoundingBox(Content=flatten([bounding_box_2.Box, bounding_box.Box]), Plane=PlaneXY(0, 0, 0), UnionBox=True)  # -> Box, Box_2
curve_2 = Curve(flatten(inspect_building.Geometry))
mesh = Mesh(flatten(inspect_building.BuildingMesh))
clean_tree = CleanTree(RemoveNulls=True, RemoveInvalid=True, RemoveEmpty=invert(False), Tree=extrude)
deconstruct_brep = DeconstructBrep(Brep=bounding_box_4.Box)  # -> Faces, Edges, Vertices
clean_tree_2 = CleanTree(RemoveNulls=True, RemoveInvalid=True, RemoveEmpty=invert(False), Tree=curve_2)
cap_holes = CapHoles(Brep=clean_tree)
surface = Surface(deconstruct_brep.Faces)
area = Area(Geometry=surface)  # -> Area, Centroid
mesh_brep = MeshBrep(
    Brep=cap_holes,
    Settings={GridMaxCount=0, GridMinCount=16, JaggedSeams=False, MaxEdgeLength=0, MinEdgeLength=0.0001, MinTolerance=0, Refine=True, RefineAngle=0, RelativeTolerance=0.65, SimplePlanes=True, Tolerance=0})
curve_3 = Curve(flatten(clean_tree_2))
context_bake = ContextBake(AllAmenities=mesh_brep)
context_bake_2 = ContextBake(AllBuildingFootprints=curve_3)
scale = Scale(Geometry=surface, Center=area.Centroid, Factor="1.1")  # -> Geometry, Transform
unit_z_2 = UnitZ(Factor="50")
negative = Negative(Value=unit_z_2)
extrude_2 = Extrude(Base=scale.Geometry, Direction=negative)
brep = Brep(extrude_2)
curve_4 = Curve(flatten(polyline))
curve_5 = Curve(flatten(polyline_2))
area_2 = Area(Geometry=brep)  # -> Area, Centroid
simple_mesh = SimpleMesh(Brep=brep)
trim_with_breps = TrimWithBreps(Curve=curve_5, Brep=brep)  # -> Inside, Outside
trim_with_breps_2 = TrimWithBreps(Curve=curve_4, Brep=brep)  # -> Inside, Outside
area_3 = Area(Geometry=clean_tree_2)  # -> Area, Centroid
point_5 = Point(area_2.Centroid)
context_bake_3 = ContextBake(FlatTerrainGeometry=simple_mesh)
closest_point = ClosestPoint(Point=point_5, Cloud=area_3.Centroid)  # -> ClosestPoint, CPIndex, Distance
curve_6 = Curve(flatten(trim_with_breps.Inside))
curve_7 = Curve(flatten(trim_with_breps_2.Inside))
cull_index = CullIndex(List=mesh, Indices=closest_point.CPIndex, Wrap=True)
context_bake_4 = ContextBake(AllSidewalks=curve_6)
context_bake_5 = ContextBake(AllRoads=curve_7)
clean_tree_3 = CleanTree(RemoveNulls=True, RemoveInvalid=True, RemoveEmpty=invert(False), Tree=cull_index)
list_item = ListItem(List=flatten(mesh), Index=closest_point.CPIndex, Wrap=True)
context_bake_6 = ContextBake(StartBuildingGeometry=list_item)
context_bake_7 = ContextBake(AllBuildingGeometry=clean_tree_3)

# ==== cluster GetDataFromOSM
T = ClusterInput()
txt = ClusterInput()
txt_2 = ClusterInput()
txt_3 = ClusterInput()
txt_4 = Text(txt_2)
txt_5 = Text(txt_3)
txt_6 = Text(txt)
lng = ListLength(List=txt_6)
equals = Equality(FirstNumber=lng, SecondNumber="1")  # -> Equality, Inequality
concat = Concatenate(FragmentD=" modv=\"not\"", FragmentA=" v=\"", FragmentB=txt_5, FragmentC="\"")
concat_2 = Concatenate(FragmentA=" v=\"", FragmentB=txt_4, FragmentC="\"")
null = NullItem(Item=txt_4)  # -> NullFlags, InvalidFlags, Description
null_2 = NullItem(Item=txt_5)  # -> NullFlags, InvalidFlags, Description
split = TextSplit(Text=T, Separators=",")
filter = StreamFilter(Gate=null.NullFlags, Stream0=concat_2)
filter_2 = StreamFilter(Gate=null_2.NullFlags, Stream0=concat)
item = ListItem(List=split, Index=0, Wrap=True)  # -> Item, Item1, Item2, Item3
panel = Panel("""node
way
relation""")
merge = Merge(Data1=item.Item1, Data2=item.Item, Data3=item.Item3, Data4=item.Item2)  # -> flatten(Result)
merge_2 = Merge(Data1=filter, Data2=filter_2)  # -> flatten(Result)
concat_3 = Concatenate(
    FragmentA="<query type=\"",
    FragmentB=panel,
    FragmentC="\"><has-kv k=\"",
    FragmentD=txt_6,
    FragmentE="\"",
    FragmentF=graft(merge_2),
    FragmentG="/></query>")
join = TextJoin(Text=merge, Join=",")
lng_2 = ListLength(List=merge)
equals_2 = Equality(FirstNumber="4", SecondNumber=lng_2)  # -> Equality, Inequality
join_2 = TextJoin(Text=concat_3)  # -> flatten(Result)
join_3 = TextJoin(Text=join_2)
panel_2 = Panel("""<union>
<item/>
<recurse type="down"/>
</union>
<print mode="body"/>
</osm-script>""")
concat_4 = Concatenate(FragmentA="<union>", FragmentB=join_3, FragmentC="</union>")
concat_5 = Concatenate(FragmentA="<osm-script output=\"xml\" timeout=\"100\" bbox=\"", FragmentB=join, FragmentC="\">")
concat_6 = Concatenate(FragmentA=concat_5, FragmentD=concat_4, FragmentC=panel_2)
p_n_c = PickNChoose(Pattern=equals.Equality, Stream0="insert one and only key", Stream1=concat_6)
filter_3 = StreamFilter(Gate=equals_2.Equality, Stream1=p_n_c)
concat_7 = Concatenate(FragmentA="http://overpass-api.de/api/interpreter?data=", FragmentB=filter_3)
key = Text(txt)
out = Text(filter_3)
feat = Text(key)
in = Text(concat_7)
in_2 = ClusterOutput(in)
out_2 = ClusterOutput(out)
feat_2 = ClusterOutput(feat)
