# Grasshopper definition Dawid_app_prototype_MVP_notworking.gh (Grasshopper 1.0.7)
# plug-ins: Urbano, ShapeDiverForGrasshopper

sddp = ShapeDiverDocumentPayload({AbsoluteTolerance=0, AngleTolerance=0, DistanceDisplayPrecision=0, GltfVersion="Gltf2", GrasshopperVersion="1.0.0007", InputGroups="{}", OutputGroups="{}", RelativeTolerance=0, RhinoVersion="7.36.23346.16351", UnitSystem=0, VersionCreated="1.17.0.0", VersionSaved="1.17.0.0"})

box_size = Panel("0.010")
division = Division(A=box_size, B=2)
division_2 = Division(A=division, B=1.5)

centerpoint_w_e = Panel("17.03434")
coordiantes_w_e = GetNumber(centerpoint_w_e, AtLeast=1, AtMost=1, Maximum=1.797693135e+308, Minimum=-1.797693135e+308, TreeAccess=False)

centerpoint_n_s = Panel("51.10765")
coordinates_n_s = GetNumber(centerpoint_n_s, AtLeast=1, AtMost=1, Maximum=1.797693135e+308, Minimum=-1.797693135e+308, TreeAccess=False)

addition = Addition(A=coordinates_n_s, B=division_2)
subtraction = Subtraction(A=coordinates_n_s, B=division_2)
addition_2 = Addition(A=coordiantes_w_e, B=division)
subtraction_2 = Subtraction(A=coordiantes_w_e, B=division)
text_join = TextJoin(Text=[subtraction_2, subtraction, addition_2, addition], Join=",")
data = Data(text_join)

bbox_left_bottom_right_top = Panel(data)
panel = Panel("""service
residential""")
data_2 = Data(bbox_left_bottom_right_top)

panel_2 = Panel("""footway
bridleway
steps
corridor
path
sidewalk
crossing
pedestrian
living street""")
get_data_from_osm = GetDataFromOSM(T=data_2, txt="highway", txt_2=[panel_2, panel])  # -> out_2, in_2, feat_2
import_osm_features = ImportOSMFeatures(OSMPathOrURL=get_data_from_osm.in_2, OSMFeatureType="street", Format="xml", ImportAltitude=False)  # -> Points, Metadata, UTMZone, TranslationVector
point = Point(import_osm_features.Points)
polyline = PolyLine(Vertices=point, Closed=False)
create_street_network = CreateStreetNetwork(
    StreetCurves=flatten(polyline),
    Metadata=flatten(import_osm_features.Metadata),
    SplitStreetCurves=True,
    UTMZone=import_osm_features.UTMZone,
    TranslationVector=import_osm_features.TranslationVector)  # -> StreetNetwork, StreetSegmentCurves, UTMZone, TranslationVector

panel_3 = Panel("""motorway
trunk
primary
secondary
tertiary
unclassified""")
get_data_from_osm_2 = GetDataFromOSM(T=data_2, txt="highway", txt_2=[panel_3, panel])  # -> out_2, in_2, feat_2
import_osm_features_2 = ImportOSMFeatures(OSMPathOrURL=get_data_from_osm_2.in_2, OSMFeatureType="street", Format="xml", ImportAltitude=False)  # -> Points, Metadata, UTMZone, TranslationVector
point_2 = Point(import_osm_features_2.Points)
polyline_2 = PolyLine(Vertices=point_2, Closed=False)
create_street_network_2 = CreateStreetNetwork(
    StreetCurves=flatten(polyline_2),
    Metadata=flatten(import_osm_features_2.Metadata),
    SplitStreetCurves=True,
    UTMZone=import_osm_features_2.UTMZone,
    TranslationVector=import_osm_features_2.TranslationVector)  # -> StreetNetwork, StreetSegmentCurves, UTMZone, TranslationVector

# ----
# OSM info: https://wiki.openstreetmap.org/wiki/Map_features
amenity = ValueList({"Park": 0, "Playground": 1}, selected="Playground")
get_boolean = GetBoolean(amenity, AtLeast=1, AtMost=1, FalseValue="False", TreeAccess=False, TrueValue="True")

get_data_from_osm_3 = GetDataFromOSM(T=data_2, txt="leisure", txt_2="playground")  # -> out_2, in_2, feat_2
get_data_from_osm_4 = GetDataFromOSM(T=data_2, txt="leisure", txt_2="park")  # -> out_2, in_2, feat_2

get_data_from_osm_5 = GetDataFromOSM(T=data_2, txt="building")  # -> out_2, in_2, feat_2
import_osm_features_3 = ImportOSMFeatures(OSMPathOrURL=get_data_from_osm_5.in_2, OSMFeatureType=get_data_from_osm_5.feat_2, Format="xml", ImportAltitude=False)  # -> Points, Metadata, UTMZone, TranslationVector
point_3 = Point(import_osm_features_3.Points)
polyline_3 = PolyLine(Vertices=point_3, Closed=False)
create_building = CreateBuilding(BuildingCurve=polyline_3, Metadata=import_osm_features_3.Metadata)

stream_filter = StreamFilter(Gate=get_boolean, Stream0=get_data_from_osm_4.in_2, Stream1=get_data_from_osm_3.in_2)
stream_filter_2 = StreamFilter(Gate=get_boolean, Stream0=get_data_from_osm_4.feat_2, Stream1=get_data_from_osm_3.feat_2)
import_osm_features_4 = ImportOSMFeatures(OSMPathOrURL=stream_filter, OSMFeatureType=stream_filter_2, Format="xml", ImportAltitude=False)  # -> Points, Metadata, UTMZone, TranslationVector
point_4 = Point(import_osm_features_4.Points)
polyline_4 = PolyLine(Vertices=point_4, Closed=False)

curve = Curve(flatten(polyline_4))
unit_z = UnitZ(Factor="0.1")
extrude = Extrude(Base=curve, Direction=unit_z)

bounding_box = BoundingBox(Content=flatten(create_building), Plane=PlaneXY(0, 0, 0), UnionBox=True)  # -> Box, Box_2
bounding_box_2 = BoundingBox(Content=flatten(bounding_box.Box), Plane=PlaneXY(0, 0, 0), UnionBox=True)  # -> Box, Box_2
deconstruct_brep = DeconstructBrep(Brep=bounding_box_2.Box)  # -> Faces, Edges, Vertices
surface = Surface(deconstruct_brep.Faces)
area = Area(Geometry=surface)  # -> Area, Centroid
scale = Scale(Geometry=surface, Center=area.Centroid, Factor="1.1")  # -> Geometry, Transform

inspect_building = InspectBuilding(Building=create_building, DefaultHeight="5")  # -> Geometry, Metadata, Amenity, BuildingMesh
curve_2 = Curve(flatten(inspect_building.Geometry))
mesh = Mesh(flatten(inspect_building.BuildingMesh))
clean_tree = CleanTree(RemoveNulls=True, RemoveInvalid=True, RemoveEmpty=invert(False), Tree=curve_2)

clean_tree_2 = CleanTree(RemoveNulls=True, RemoveInvalid=True, RemoveEmpty=invert(False), Tree=extrude)
cap_holes = CapHoles(Brep=clean_tree_2)
mesh_brep = MeshBrep(
    Brep=cap_holes,
    Settings={GridMaxCount=0, GridMinCount=16, JaggedSeams=False, MaxEdgeLength=0, MinEdgeLength=0.0001, MinTolerance=0, Refine=True, RefineAngle=0, RelativeTolerance=0.65, SimplePlanes=True, Tolerance=0})
deconstruct_mesh = DeconstructMesh(Mesh=flatten(mesh_brep))  # -> Vertices, Faces, Colours, Normals

unit_z_2 = UnitZ(Factor="50")
negative = Negative(Value=unit_z_2)
extrude_2 = Extrude(Base=scale.Geometry, Direction=negative)
brep = Brep(extrude_2)

stream_filter_3 = StreamFilter(
    Gate=get_boolean,
    Stream0=ColourSwatch(SwatchColor=RGB(125, 194, 64)),
    Stream1=ColourSwatch(SwatchColor=RGB(194, 64, 181)))
construct_mesh = ConstructMesh(Vertices=deconstruct_mesh.Vertices, Faces=deconstruct_mesh.Faces, Colours=stream_filter_3)  # -> flatten(Mesh)
context_bake = ContextBake(AllAmenities=construct_mesh)

curve_3 = Curve(flatten(polyline_2))
curve_4 = Curve(flatten(polyline))
trim_with_breps = TrimWithBreps(Curve=curve_4, Brep=brep)  # -> Inside, Outside
trim_with_breps_2 = TrimWithBreps(Curve=curve_3, Brep=brep)  # -> Inside, Outside

area_2 = Area(Geometry=brep)  # -> Area, Centroid
area_3 = Area(Geometry=clean_tree)  # -> Area, Centroid
point_5 = Point(area_2.Centroid)
closest_point = ClosestPoint(Point=point_5, Cloud=area_3.Centroid)  # -> ClosestPoint, CPIndex, Distance

simple_mesh = SimpleMesh(Brep=brep)
context_bake_2 = ContextBake(FlatTerrainGeometry=simple_mesh)

curve_5 = Curve(flatten(trim_with_breps.Inside))
context_bake_3 = ContextBake(AllSidewalks=curve_5)

curve_6 = Curve(flatten(trim_with_breps_2.Inside))
context_bake_4 = ContextBake(AllRoads=curve_6)

cull_index = CullIndex(List=mesh, Indices=closest_point.CPIndex, Wrap=True)
clean_tree_3 = CleanTree(RemoveNulls=True, RemoveInvalid=True, RemoveEmpty=invert(False), Tree=cull_index)

list_item = ListItem(List=flatten(mesh), Index=closest_point.CPIndex, Wrap=True)

mesh_2 = Mesh(list_item)
context_bake_5 = ContextBake(StartBuildingGeometry=mesh_2)

mesh_3 = Mesh(clean_tree_3)
context_bake_6 = ContextBake(AllBuildingGeometry=mesh_3)

# ==== cluster GetDataFromOSM
T = ClusterInput()
txt = ClusterInput()
txt_2 = ClusterInput()
txt_3 = ClusterInput()
txt_4 = Text(txt_2)
txt_5 = Text(txt_3)
txt_6 = Text(txt)
lng = ListLength(List=txt_6)
equals = Equality(FirstNumber=lng, SecondNumber="1")  # -> Equality, Inequality
concat = Concatenate(FragmentD=" modv=\"not\"", FragmentA=" v=\"", FragmentB=txt_5, FragmentC="\"")
concat_2 = Concatenate(FragmentA=" v=\"", FragmentB=txt_4, FragmentC="\"")
null = NullItem(Item=txt_4)  # -> NullFlags, InvalidFlags, Description
null_2 = NullItem(Item=txt_5)  # -> NullFlags, InvalidFlags, Description
split = TextSplit(Text=T, Separators=",")
filter = StreamFilter(Gate=null.NullFlags, Stream0=concat_2)
filter_2 = StreamFilter(Gate=null_2.NullFlags, Stream0=concat)
item = ListItem(List=split, Index=0, Wrap=True)  # -> Item, Item1, Item2, Item3
panel = Panel("""node
way
relation""")
merge = Merge(Data1=item.Item1, Data2=item.Item, Data3=item.Item3, Data4=item.Item2)  # -> flatten(Result)
merge_2 = Merge(Data1=filter, Data2=filter_2)  # -> flatten(Result)
concat_3 = Concatenate(
    FragmentA="<query type=\"",
    FragmentB=panel,
    FragmentC="\"><has-kv k=\"",
    FragmentD=txt_6,
    FragmentE="\"",
    FragmentF=graft(merge_2),
    FragmentG="/></query>")
join = TextJoin(Text=merge, Join=",")
lng_2 = ListLength(List=merge)
equals_2 = Equality(FirstNumber="4", SecondNumber=lng_2)  # -> Equality, Inequality
join_2 = TextJoin(Text=concat_3)  # -> flatten(Result)
join_3 = TextJoin(Text=join_2)
panel_2 = Panel("""<union>
<item/>
<recurse type="down"/>
</union>
<print mode="body"/>
</osm-script>""")
concat_4 = Concatenate(FragmentA="<union>", FragmentB=join_3, FragmentC="</union>")
concat_5 = Concatenate(FragmentA="<osm-script output=\"xml\" timeout=\"100\" bbox=\"", FragmentB=join, FragmentC="\">")
concat_6 = Concatenate(FragmentA=concat_5, FragmentD=concat_4, FragmentC=panel_2)
p_n_c = PickNChoose(Pattern=equals.Equality, Stream0="insert one and only key", Stream1=concat_6)
filter_3 = StreamFilter(Gate=equals_2.Equality, Stream1=p_n_c)
concat_7 = Concatenate(FragmentA="http://overpass-api.de/api/interpreter?data=", FragmentB=filter_3)
key = Text(txt)
out = Text(filter_3)
feat = Text(key)
in = Text(concat_7)
in_2 = ClusterOutput(in)
out_2 = ClusterOutput(out)
feat_2 = ClusterOutput(feat)
