# Grasshopper definition Dawid_app_prototype_3.gh (Grasshopper 1.0.7)
# plug-ins: Urbano, Pufferfish

download_dem_and_build_terrain_mesh = DownloadDEMAndBuildTerrainMesh(LeftBound="18.650", RightBound="18.680", TopBound="50.305", BottomBound="50.285", XCount=100, YCount=100)  # -> TerrainMesh, UTMZone, TranslationVector; disabled
download_openstreetmap_osm = DownloadOpenStreetMapOSM(LeftBound="18.650", RightBound="18.680", TopBound="50.305", BottomBound="50.285", RunToggle=True)  # -> OSMQueryURL, OSMFilePath; disabled
text_join = TextJoin(Text=["18.650", "50.285", "18.680", "50.305"], Join=",")
data = Data(text_join)
bbox_left_bottom_right_top = Panel(data)

download_dem_and_build_terrain_mesh_2 = DownloadDEMAndBuildTerrainMesh(LeftBound="17.025", RightBound="17.045", TopBound="51.120", BottomBound="51.105", XCount=100, YCount=100)  # -> TerrainMesh, UTMZone, TranslationVector; disabled
download_openstreetmap_osm_2 = DownloadOpenStreetMapOSM(LeftBound="17.025", RightBound="17.045", TopBound="51.120", BottomBound="51.105", RunToggle=True)  # -> OSMQueryURL, OSMFilePath; disabled
text_join_2 = TextJoin(Text=["17.025", "51.105", "17.045", "51.120"], Join=",")
data_2 = Data(text_join_2)
bbox_left_bottom_right_top_2 = Panel(data_2)

location = ValueList({"Gliwice": 0, "Wroclaw": 1}, selected="Wroclaw")
location_2 = GetInteger(location, AtLeast=1, AtMost=1, Maximum=2147483647, Minimum=-2147483648, TreeAccess=False)

stream_filter = StreamFilter(Gate=location_2, Stream0=bbox_left_bottom_right_top, Stream1=bbox_left_bottom_right_top_2)
data_3 = Data(stream_filter)

panel = Panel("""service
residential""")
panel_2 = Panel("""motorway
trunk
primary
secondary
tertiary
unclassified""")
panel_3 = Panel("""footway
bridleway
steps
corridor
path
sidewalk
crossing
pedestrian
living street""")
get_data_from_osm = GetDataFromOSM(T=data_3, txt="highway", txt_2=[panel_2, panel])  # -> out_2, in_2, feat_2
get_data_from_osm_2 = GetDataFromOSM(T=data_3, txt="highway", txt_2=[panel_3, panel])  # -> out_2, in_2, feat_2

# ----
# OSM info: https://wiki.openstreetmap.org/wiki/Map_features
amenity = ValueList({"Park": 0, "Playground": 1}, selected="Park")
amenity_2 = GetInteger(amenity, AtLeast=1, AtMost=1, Maximum=2147483647, Minimum=-2147483648, TreeAccess=False)

get_data_from_osm_3 = GetDataFromOSM(T=data_3, txt="leisure", txt_2="playground")  # -> out_2, in_2, feat_2
get_data_from_osm_4 = GetDataFromOSM(T=data_3, txt="leisure", txt_2="park")  # -> out_2, in_2, feat_2

get_data_from_osm_5 = GetDataFromOSM(T=data_3, txt="building")  # -> out_2, in_2, feat_2

stream_filter_2 = StreamFilter(Gate=amenity_2, Stream0=get_data_from_osm_4.in_2, Stream1=get_data_from_osm_3.in_2)
stream_filter_3 = StreamFilter(Gate=amenity_2, Stream0=get_data_from_osm_4.feat_2, Stream1=get_data_from_osm_3.feat_2)
import_osm_features = ImportOSMFeatures(OSMPathOrURL=stream_filter_2, OSMFeatureType=stream_filter_3, Format="xml", ImportAltitude=False)  # -> Points, Metadata, UTMZone, TranslationVector
point = Point(import_osm_features.Points)
polyline = PolyLine(Vertices=point, Closed=False)

import_osm_features_2 = ImportOSMFeatures(OSMPathOrURL=get_data_from_osm.in_2, OSMFeatureType="street", Format="xml", ImportAltitude=False)  # -> Points, Metadata, UTMZone, TranslationVector
point_2 = Point(import_osm_features_2.Points)
polyline_2 = PolyLine(Vertices=point_2, Closed=False)
create_street_network = CreateStreetNetwork(
    StreetCurves=flatten(polyline_2),
    Metadata=flatten(import_osm_features_2.Metadata),
    SplitStreetCurves=True,
    UTMZone=import_osm_features_2.UTMZone,
    TranslationVector=import_osm_features_2.TranslationVector)  # -> StreetNetwork, StreetSegmentCurves, UTMZone, TranslationVector

import_osm_features_3 = ImportOSMFeatures(OSMPathOrURL=get_data_from_osm_2.in_2, OSMFeatureType="street", Format="xml", ImportAltitude=False)  # -> Points, Metadata, UTMZone, TranslationVector
point_3 = Point(import_osm_features_3.Points)
polyline_3 = PolyLine(Vertices=point_3, Closed=False)
create_street_network_2 = CreateStreetNetwork(
    StreetCurves=flatten(polyline_3),
    Metadata=flatten(import_osm_features_3.Metadata),
    SplitStreetCurves=True,
    UTMZone=import_osm_features_3.UTMZone,
    TranslationVector=import_osm_features_3.TranslationVector)  # -> StreetNetwork, StreetSegmentCurves, UTMZone, TranslationVector

import_osm_features_4 = ImportOSMFeatures(OSMPathOrURL=get_data_from_osm_5.in_2, OSMFeatureType=get_data_from_osm_5.feat_2, Format="xml", ImportAltitude=False)  # -> Points, Metadata, UTMZone, TranslationVector
point_4 = Point(import_osm_features_4.Points)
polyline_4 = PolyLine(Vertices=point_4, Closed=False)
create_building = CreateBuilding(BuildingCurve=polyline_4, Metadata=import_osm_features_4.Metadata)

curve = Curve(flatten(polyline))
mesh_brep = MeshBrep(
    Brep=curve,
    Settings={GridMaxCount=0, GridMinCount=16, JaggedSeams=False, MaxEdgeLength=0, MinEdgeLength=0.0001, MinTolerance=0, Refine=True, RefineAngle=0, RelativeTolerance=0.65, SimplePlanes=True, Tolerance=0})
context_bake = ContextBake(AllAmenities=mesh_brep)

area = Area(Geometry=flatten(create_building))  # -> Area, Centroid

curve_2 = Curve(flatten(create_building))
mesh_brep_2 = MeshBrep(
    Brep=curve_2,
    Settings={GridMaxCount=0, GridMinCount=16, JaggedSeams=False, MaxEdgeLength=0, MinEdgeLength=0.0001, MinTolerance=0, Refine=True, RefineAngle=0, RelativeTolerance=0.65, SimplePlanes=True, Tolerance=0})
context_bake_2 = ContextBake(BuildingFootprints=mesh_brep_2)

point_5 = Point(Point(832.3373031, 648.4900026, 0))
strating_point = GetPoint(point_5, AtLeast=1, AtMost=1, Realtime=True, TreeAccess=False)

curve_3 = Curve(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)
curve_4 = Curve(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)
start_location_1 = GetGeometry(curve_3, AtLeast=1, AtMost=1, DeleteInput=False, Filter=1074004029, TreeAccess=False)
start_location_2 = GetGeometry(curve_4, AtLeast=1, AtMost=1, DeleteInput=False, Filter=1074004029, TreeAccess=False)
stream_filter_4 = StreamFilter(Gate=location_2, Stream0=start_location_1, Stream1=start_location_2)

closest_point = ClosestPoint(Point=point_5, Cloud=area.Centroid)  # -> ClosestPoint, CPIndex, Distance
inspect_building = InspectBuilding(Building=create_building, DefaultHeight=1)  # -> Geometry, Metadata, Amenity, BuildingMesh

bounding_box = BoundingBox(Content=flatten(polyline), Plane=PlaneXY(0, 0, 0), UnionBox=True)  # -> Box, Box_2
bounding_box_2 = BoundingBox(Content=flatten(create_building), Plane=PlaneXY(0, 0, 0), UnionBox=True)  # -> Box, Box_2
bounding_box_3 = BoundingBox(Content=flatten([bounding_box_2.Box, bounding_box.Box]), Plane=PlaneXY(0, 0, 0), UnionBox=True)  # -> Box, Box_2
deconstruct_brep = DeconstructBrep(Brep=bounding_box_3.Box)  # -> Faces, Edges, Vertices
surface = Surface(deconstruct_brep.Faces)
area_2 = Area(Geometry=surface)  # -> Area, Centroid
scale = Scale(Geometry=surface, Center=area_2.Centroid, Factor="1.1")  # -> Geometry, Transform
unit_z = UnitZ(Factor="50")
negative = Negative(Value=unit_z)
extrude = Extrude(Base=scale.Geometry, Direction=negative)
curve_5 = Curve(flatten(polyline_3))
curve_6 = Curve(flatten(polyline_2))
brep = Brep(extrude)
trim_with_breps = TrimWithBreps(Curve=curve_6, Brep=brep)  # -> Inside, Outside

list_item = ListItem(List=flatten(create_building), Index=closest_point.CPIndex, Wrap=True)
point_6 = Point(closest_point.ClosestPoint)
curve_7 = Curve(list_item)

curve_8 = Curve(stream_filter_4)
mesh_brep_3 = MeshBrep(
    Brep=curve_8,
    Settings={GridMaxCount=0, GridMinCount=16, JaggedSeams=False, MaxEdgeLength=0, MinEdgeLength=0.0001, MinTolerance=0, Refine=True, RefineAngle=0, RelativeTolerance=0.65, SimplePlanes=True, Tolerance=0})
context_bake_3 = ContextBake(StartGeometry=mesh_brep_3)

walking_time_min = GetInteger(Slider(8, range=5..30), AtLeast=1, AtMost=1, Maximum=2147483647, Minimum=-2147483648, TreeAccess=False)

area_3 = Area(Geometry=stream_filter_4)  # -> Area, Centroid
pull_point = PullPoint(Point=area_3.Centroid, Geometry=polyline, ClosestOnly=True)  # -> flatten(ClosestPoint), Distance
router = Router(
    RouterUrbanoModelOrStreetNetwork=create_street_network_2.StreetNetwork,
    Origin=stream_filter_4,
    Destination=pull_point.ClosestPoint,
    TravelMode="pedestrian",
    TimeLimit=-1)  # -> Trip, Route, Time, Distance
panel_4 = Panel(router.Time)
smaller_than = SmallerThan(FirstNumber=router.Time, SecondNumber=walking_time_min)  # -> SmallerThan, OrEqualTo

dispatch = Dispatch(List=flatten(polyline), DispatchPattern=smaller_than.SmallerThan)  # -> ListA, ListB
dispatch_2 = Dispatch(List=router.Trip, DispatchPattern=smaller_than.SmallerThan)  # -> ListA, ListB
dispatch_3 = Dispatch(List=router.Route, DispatchPattern=smaller_than.SmallerThan)  # -> ListA, ListB

trim_with_breps_2 = TrimWithBreps(Curve=curve_5, Brep=brep)  # -> Inside, Outside

intrip = InspectTrip(Trip=dispatch_2.ListA)  # -> Origin, Destination, Time, Distance, Route, Mode, People, Activity, Amenity
list_length = ListLength(List=dispatch_2.ListA)
number = Number(list_length)
curve_9 = Curve(intrip.Origin)
point_7 = Point(intrip.Destination)
number_2 = Number(intrip.Time)
number_3 = Number(intrip.Distance)
round_to_decimal_place = RoundToDecimalPlace(NumberX=number_2, DecimalPlace=1, RoundType=0)  # -> Rounded, Difference
round_to_decimal_place_2 = RoundToDecimalPlace(NumberX=number_3, DecimalPlace=1, RoundType=0)  # -> Rounded, Difference
location_within_the_range = Panel(number)
time_in_minutes = Panel(round_to_decimal_place.Rounded)
distance_in_meters = Panel(round_to_decimal_place_2.Rounded)

curve_10 = Curve(dispatch.ListA)
mesh_brep_4 = MeshBrep(
    Brep=curve_10,
    Settings={GridMaxCount=0, GridMinCount=16, JaggedSeams=False, MaxEdgeLength=0, MinEdgeLength=0.0001, MinTolerance=0, Refine=True, RefineAngle=0, RelativeTolerance=0.65, SimplePlanes=True, Tolerance=0})
context_bake_4 = ContextBake(AvailableAmenities=mesh_brep_4)

curve_11 = Curve(dispatch_3.ListA)
context_bake_5 = ContextBake(Geometry=curve_11)

simple_mesh = SimpleMesh(Brep=brep)
context_bake_6 = ContextBake(FlatTerrain=simple_mesh)

curve_12 = Curve(flatten(trim_with_breps_2.Inside))
context_bake_7 = ContextBake(Sidewalks=curve_12)

curve_13 = Curve(flatten(trim_with_breps.Inside))
context_bake_8 = ContextBake(Geometry=curve_13)

# ==== cluster GetDataFromOSM
T = ClusterInput()
txt = ClusterInput()
txt_2 = ClusterInput()
txt_3 = ClusterInput()
txt_4 = Text(txt_2)
txt_5 = Text(txt_3)
txt_6 = Text(txt)
lng = ListLength(List=txt_6)
equals = Equality(FirstNumber=lng, SecondNumber="1")  # -> Equality, Inequality
concat = Concatenate(FragmentD=" modv=\"not\"", FragmentA=" v=\"", FragmentB=txt_5, FragmentC="\"")
concat_2 = Concatenate(FragmentA=" v=\"", FragmentB=txt_4, FragmentC="\"")
null = NullItem(Item=txt_4)  # -> NullFlags, InvalidFlags, Description
null_2 = NullItem(Item=txt_5)  # -> NullFlags, InvalidFlags, Description
split = TextSplit(Text=T, Separators=",")
filter = StreamFilter(Gate=null.NullFlags, Stream0=concat_2)
filter_2 = StreamFilter(Gate=null_2.NullFlags, Stream0=concat)
item = ListItem(List=split, Index=0, Wrap=True)  # -> Item, Item1, Item2, Item3
panel = Panel("""node
way
relation""")
merge = Merge(Data1=item.Item1, Data2=item.Item, Data3=item.Item3, Data4=item.Item2)  # -> flatten(Result)
merge_2 = Merge(Data1=filter, Data2=filter_2)  # -> flatten(Result)
concat_3 = Concatenate(
    FragmentA="<query type=\"",
    FragmentB=panel,
    FragmentC="\"><has-kv k=\"",
    FragmentD=txt_6,
    FragmentE="\"",
    FragmentF=graft(merge_2),
    FragmentG="/></query>")
join = TextJoin(Text=merge, Join=",")
lng_2 = ListLength(List=merge)
equals_2 = Equality(FirstNumber="4", SecondNumber=lng_2)  # -> Equality, Inequality
join_2 = TextJoin(Text=concat_3)  # -> flatten(Result)
join_3 = TextJoin(Text=join_2)
panel_2 = Panel("""<union>
<item/>
<recurse type="down"/>
</union>
<print mode="body"/>
</osm-script>""")
concat_4 = Concatenate(FragmentA="<union>", FragmentB=join_3, FragmentC="</union>")
concat_5 = Concatenate(FragmentA="<osm-script output=\"xml\" timeout=\"100\" bbox=\"", FragmentB=join, FragmentC="\">")
concat_6 = Concatenate(FragmentA=concat_5, FragmentD=concat_4, FragmentC=panel_2)
p_n_c = PickNChoose(Pattern=equals.Equality, Stream0="insert one and only key", Stream1=concat_6)
filter_3 = StreamFilter(Gate=equals_2.Equality, Stream1=p_n_c)
concat_7 = Concatenate(FragmentA="http://overpass-api.de/api/interpreter?data=", FragmentB=filter_3)
key = Text(txt)
out = Text(filter_3)
feat = Text(key)
in = Text(concat_7)
in_2 = ClusterOutput(in)
out_2 = ClusterOutput(out)
feat_2 = ClusterOutput(feat)
