# Grasshopper definition Dawid_app_prototype_6.gh (Grasshopper 1.0.7)
# plug-ins: Urbano, Pufferfish, ShapeDiverForGrasshopper

sddp = ShapeDiverDocumentPayload({AbsoluteTolerance=0, AngleTolerance=0, DistanceDisplayPrecision=0, GltfVersion="Gltf2", GrasshopperVersion="1.0.0007", InputGroups="{}", OutputGroups="{}", RelativeTolerance=0, RhinoVersion="7.36.23346.16351", UnitSystem=0, VersionCreated="1.17.0.0", VersionSaved="1.17.0.0"})

box_size = Panel("0.020")
division = Division(A=box_size, B=2)
division_2 = Division(A=division, B=1.5)

centerpoint_w_e = Panel("17.03434")
coordiantes_w_e = GetNumber(centerpoint_w_e, AtLeast=1, AtMost=1, Maximum=1.797693135e+308, Minimum=-1.797693135e+308, TreeAccess=False)

centerpoint_n_s = Panel("51.10765")
coordinates_n_s = GetNumber(centerpoint_n_s, AtLeast=1, AtMost=1, Maximum=1.797693135e+308, Minimum=-1.797693135e+308, TreeAccess=False)

addition = Addition(A=coordinates_n_s, B=division_2)
subtraction = Subtraction(A=coordinates_n_s, B=division_2)
addition_2 = Addition(A=coordiantes_w_e, B=division)
subtraction_2 = Subtraction(A=coordiantes_w_e, B=division)
text_join = TextJoin(Text=[subtraction_2, subtraction, addition_2, addition], Join=",")
data = Data(text_join)
bbox_left_bottom_right_top = Panel(data)
data_2 = Data(bbox_left_bottom_right_top)

panel = Panel("""service
residential""")
panel_2 = Panel("""motorway
trunk
primary
secondary
tertiary
unclassified""")
panel_3 = Panel("""footway
bridleway
steps
corridor
path
sidewalk
crossing
pedestrian
living street""")
get_data_from_osm = GetDataFromOSM(T=data_2, txt="highway", txt_2=[panel_2, panel])  # -> out_2, in_2, feat_2
get_data_from_osm_2 = GetDataFromOSM(T=data_2, txt="highway", txt_2=[panel_3, panel])  # -> out_2, in_2, feat_2

# ----
# OSM info: https://wiki.openstreetmap.org/wiki/Map_features
amenity = ValueList({"Park": 0, "Playground": 1}, selected="Playground")
amenity_2 = GetInteger(amenity, AtLeast=1, AtMost=1, Maximum=2147483647, Minimum=-2147483648, TreeAccess=False)

get_data_from_osm_3 = GetDataFromOSM(T=data_2, txt="leisure", txt_2="playground")  # -> out_2, in_2, feat_2
get_data_from_osm_4 = GetDataFromOSM(T=data_2, txt="leisure", txt_2="park")  # -> out_2, in_2, feat_2

get_data_from_osm_5 = GetDataFromOSM(T=data_2, txt="building")  # -> out_2, in_2, feat_2

stream_filter = StreamFilter(Gate=amenity_2, Stream0=get_data_from_osm_4.in_2, Stream1=get_data_from_osm_3.in_2)
stream_filter_2 = StreamFilter(Gate=amenity_2, Stream0=get_data_from_osm_4.feat_2, Stream1=get_data_from_osm_3.feat_2)
import_osm_features = ImportOSMFeatures(OSMPathOrURL=stream_filter, OSMFeatureType=stream_filter_2, Format="xml", ImportAltitude=False)  # -> Points, Metadata, UTMZone, TranslationVector
point = Point(import_osm_features.Points)
polyline = PolyLine(Vertices=point, Closed=False)

import_osm_features_2 = ImportOSMFeatures(OSMPathOrURL=get_data_from_osm.in_2, OSMFeatureType="street", Format="xml", ImportAltitude=False)  # -> Points, Metadata, UTMZone, TranslationVector
point_2 = Point(import_osm_features_2.Points)
polyline_2 = PolyLine(Vertices=point_2, Closed=False)
create_street_network = CreateStreetNetwork(
    StreetCurves=flatten(polyline_2),
    Metadata=flatten(import_osm_features_2.Metadata),
    SplitStreetCurves=True,
    UTMZone=import_osm_features_2.UTMZone,
    TranslationVector=import_osm_features_2.TranslationVector)  # -> StreetNetwork, StreetSegmentCurves, UTMZone, TranslationVector

import_osm_features_3 = ImportOSMFeatures(OSMPathOrURL=get_data_from_osm_2.in_2, OSMFeatureType="street", Format="xml", ImportAltitude=False)  # -> Points, Metadata, UTMZone, TranslationVector
point_3 = Point(import_osm_features_3.Points)
polyline_3 = PolyLine(Vertices=point_3, Closed=False)
create_street_network_2 = CreateStreetNetwork(
    StreetCurves=flatten(polyline_3),
    Metadata=flatten(import_osm_features_3.Metadata),
    SplitStreetCurves=True,
    UTMZone=import_osm_features_3.UTMZone,
    TranslationVector=import_osm_features_3.TranslationVector)  # -> StreetNetwork, StreetSegmentCurves, UTMZone, TranslationVector

import_osm_features_4 = ImportOSMFeatures(OSMPathOrURL=get_data_from_osm_5.in_2, OSMFeatureType=get_data_from_osm_5.feat_2, Format="xml", ImportAltitude=False)  # -> Points, Metadata, UTMZone, TranslationVector
point_4 = Point(import_osm_features_4.Points)
polyline_4 = PolyLine(Vertices=point_4, Closed=False)
create_building = CreateBuilding(BuildingCurve=polyline_4, Metadata=import_osm_features_4.Metadata)

inspect_building = InspectBuilding(Building=create_building, DefaultHeight="5")  # -> Geometry, Metadata, Amenity, BuildingMesh
curve = Curve(flatten(inspect_building.Geometry))
mesh = Mesh(flatten(inspect_building.BuildingMesh))
clean_tree = CleanTree(RemoveNulls=True, RemoveInvalid=True, RemoveEmpty=invert(False), Tree=curve)

curve_2 = Curve(flatten(polyline))
unit_z = UnitZ(Factor=0.1)
extrude = Extrude(Base=curve_2, Direction=unit_z)

bounding_box = BoundingBox(Content=flatten(polyline), Plane=PlaneXY(0, 0, 0), UnionBox=True)  # -> Box, Box_2
bounding_box_2 = BoundingBox(Content=flatten(create_building), Plane=PlaneXY(0, 0, 0), UnionBox=True)  # -> Box, Box_2
bounding_box_3 = BoundingBox(Content=flatten(polyline_3), Plane=PlaneXY(0, 0, 0), UnionBox=True)  # -> Box, Box_2
bounding_box_4 = BoundingBox(Content=flatten([bounding_box_2.Box, bounding_box.Box]), Plane=PlaneXY(0, 0, 0), UnionBox=True)  # -> Box, Box_2
deconstruct_brep = DeconstructBrep(Brep=bounding_box_4.Box)  # -> Faces, Edges, Vertices
surface = Surface(deconstruct_brep.Faces)
area = Area(Geometry=surface)  # -> Area, Centroid
scale = Scale(Geometry=surface, Center=area.Centroid, Factor="1.1")  # -> Geometry, Transform
unit_z_2 = UnitZ(Factor="50")
negative = Negative(Value=unit_z_2)
extrude_2 = Extrude(Base=scale.Geometry, Direction=negative)
brep = Brep(extrude_2)
curve_3 = Curve(flatten(polyline_2))
curve_4 = Curve(flatten(polyline_3))
simple_mesh = SimpleMesh(Brep=brep)
trim_with_breps = TrimWithBreps(Curve=curve_3, Brep=brep)  # -> Inside, Outside
deconstruct_mesh = DeconstructMesh(Mesh=flatten(simple_mesh))  # -> Vertices, Faces, Colours, Normals

clean_tree_2 = CleanTree(RemoveNulls=True, RemoveInvalid=True, RemoveEmpty=invert(False), Tree=extrude)
cap_holes = CapHoles(Brep=clean_tree_2)
mesh_brep = MeshBrep(
    Brep=cap_holes,
    Settings={GridMaxCount=0, GridMinCount=16, JaggedSeams=False, MaxEdgeLength=0, MinEdgeLength=0.0001, MinTolerance=0, Refine=True, RefineAngle=0, RelativeTolerance=0.65, SimplePlanes=True, Tolerance=0})
deconstruct_mesh_2 = DeconstructMesh(Mesh=flatten(mesh_brep))  # -> Vertices, Faces, Colours, Normals

curve_5 = Curve(clean_tree)
context_bake = ContextBake(AllBuildingFootprints=curve_5)

stream_filter_3 = StreamFilter(Gate=amenity_2, Stream0=ColourSwatch(SwatchColor=RGB(125, 194, 64)), Stream1=ColourSwatch(SwatchColor=RGB(194, 64, 181)))
construct_mesh = ConstructMesh(Vertices=deconstruct_mesh_2.Vertices, Faces=deconstruct_mesh_2.Faces, Colours=stream_filter_3)  # -> flatten(Mesh)
context_bake_2 = ContextBake(AllAmenities=construct_mesh)

trim_with_breps_2 = TrimWithBreps(Curve=curve_4, Brep=brep)  # -> Inside, Outside
area_2 = Area(Geometry=brep)  # -> Area, Centroid

point_5 = Point(area_2.Centroid)
strat_point = GetPoint(point_5, AtLeast=1, AtMost=1, Realtime=True, TreeAccess=False)

project_point = ProjectPoint(Point=area_2.Centroid, Direction=Vector(0, 0, -1))  # -> Point, Index

area_3 = Area(Geometry=clean_tree)  # -> Area, Centroid
closest_point = ClosestPoint(Point=strat_point, Cloud=area_3.Centroid)  # -> ClosestPoint, CPIndex, Distance
point_6 = Point(closest_point.ClosestPoint)

construct_mesh_2 = ConstructMesh(Vertices=deconstruct_mesh.Vertices, Faces=deconstruct_mesh.Faces, Colours=ColourSwatch(SwatchColor=RGB(212, 210, 210)))
context_bake_3 = ContextBake(FlatTerrainGeometry=construct_mesh_2)

curve_6 = Curve(flatten(trim_with_breps.Inside))
colour_swatch = ColourSwatch(SwatchColor=RGB(115, 115, 115))
preview = CustomPreview(Geometry=curve_6, Material=colour_swatch)

colour_swatch_2 = ColourSwatch(SwatchColor=RGB(171, 171, 171))
curve_7 = Curve(flatten(trim_with_breps_2.Inside))
uservalue = Text(colour_swatch_2)
userkey = Text("color")
preview_2 = CustomPreview(Geometry=curve_7, Material=colour_swatch_2)

uservalue_2 = Text(colour_swatch)
userkey_2 = Text("color")

c_script = CSharpScript(geometry=curve_7, userKey=userkey, userValue=uservalue)  # -> out, geoWithUserString; inputs geometry: GeometryBase, userKey: String, userValue: String
# ---------- c_script: C# ----------
    geometry.SetUserString(userKey, userValue);
   geoWithUserString = geometry;
# ---------- end c_script ----------
context_bake_4 = ContextBake(AllSidewalks=c_script.geoWithUserString)

c_script_2 = CSharpScript(geometry=curve_6, userKey=userkey_2, userValue=uservalue_2)  # -> out, geoWithUserString; inputs geometry: GeometryBase, userKey: String, userValue: String; same code as c_script
context_bake_5 = ContextBake(AllRoads=c_script_2.geoWithUserString)

list_item = ListItem(List=flatten(clean_tree), Index=closest_point.CPIndex, Wrap=True)
list_item_2 = ListItem(List=flatten(mesh), Index=closest_point.CPIndex, Wrap=True)
deconstruct_mesh_3 = DeconstructMesh(Mesh=flatten(list_item_2))  # -> Vertices, Faces, Colours, Normals

cull_index = CullIndex(List=mesh, Indices=closest_point.CPIndex, Wrap=True)
clean_tree_3 = CleanTree(RemoveNulls=True, RemoveInvalid=True, RemoveEmpty=invert(False), Tree=cull_index)
deconstruct_mesh_4 = DeconstructMesh(Mesh=flatten(clean_tree_3))  # -> Vertices, Faces, Colours, Normals

construct_mesh_3 = ConstructMesh(
    Vertices=deconstruct_mesh_3.Vertices,
    Faces=deconstruct_mesh_3.Faces,
    Colours=ColourSwatch(SwatchColor=RGB(240, 192, 192)))
context_bake_6 = ContextBake(StartBuildingGeometry=construct_mesh_3)

curve_8 = Curve(list_item)
context_bake_7 = ContextBake(StartBuildingFootprint=curve_8)

construct_mesh_4 = ConstructMesh(
    Vertices=deconstruct_mesh_4.Vertices,
    Faces=deconstruct_mesh_4.Faces,
    Colours=ColourSwatch(SwatchColor=RGB(232, 232, 232)))
context_bake_8 = ContextBake(AllBuildingGeometry=construct_mesh_4)

walking_time_min = GetInteger(Slider(8, range=5..15), AtLeast=1, AtMost=1, Maximum=2147483647, Minimum=-2147483648, TreeAccess=False)

area_4 = Area(Geometry=curve_8)  # -> Area, Centroid
pull_point = PullPoint(Point=area_4.Centroid, Geometry=polyline, ClosestOnly=True)  # -> flatten(ClosestPoint), Distance
router = Router(
    RouterUrbanoModelOrStreetNetwork=create_street_network_2.StreetNetwork,
    Origin=curve_8,
    Destination=pull_point.ClosestPoint,
    TravelMode="pedestrian",
    TimeLimit=-1)  # -> Trip, Route, Time, Distance
panel_4 = Panel(router.Time)
smaller_than = SmallerThan(FirstNumber=router.Time, SecondNumber=walking_time_min)  # -> SmallerThan, OrEqualTo

dispatch = Dispatch(List=flatten(polyline), DispatchPattern=smaller_than.SmallerThan)  # -> ListA, ListB
dispatch_2 = Dispatch(List=router.Trip, DispatchPattern=smaller_than.SmallerThan)  # -> ListA, ListB
dispatch_3 = Dispatch(List=router.Route, DispatchPattern=smaller_than.SmallerThan)  # -> ListA, ListB

unit_z_3 = UnitZ(Factor=0.3)
curve_9 = Curve(dispatch.ListA)
extrude_3 = Extrude(Base=curve_9, Direction=unit_z_3)
cap_holes_2 = CapHoles(Brep=extrude_3)
mesh_brep_2 = MeshBrep(
    Brep=cap_holes_2,
    Settings={GridMaxCount=0, GridMinCount=16, JaggedSeams=False, MaxEdgeLength=0, MinEdgeLength=0.0001, MinTolerance=0, Refine=True, RefineAngle=0, RelativeTolerance=0.65, SimplePlanes=True, Tolerance=0})
deconstruct_mesh_5 = DeconstructMesh(Mesh=flatten(mesh_brep_2))  # -> Vertices, Faces, Colours, Normals

intrip = InspectTrip(Trip=dispatch_2.ListA)  # -> Origin, Destination, Time, Distance, Route, Mode, People, Activity, Amenity
list_length = ListLength(List=dispatch_2.ListA)
number = Number(list_length)
point_7 = Point(intrip.Destination)
number_2 = Number(intrip.Time)
number_3 = Number(intrip.Distance)
round_to_decimal_place = RoundToDecimalPlace(NumberX=number_2, DecimalPlace=1, RoundType=0)  # -> Rounded, Difference
round_to_decimal_place_2 = RoundToDecimalPlace(NumberX=number_3, DecimalPlace=1, RoundType=0)  # -> Rounded, Difference

colour_swatch_3 = ColourSwatch(SwatchColor=RGB(0, 0, 0))
curve_10 = Curve(dispatch_3.ListA)
preview_3 = CustomPreview(Geometry=curve_10, Material=colour_swatch_3)

area_5 = Area(Geometry=curve_9)  # -> Area, Centroid

uservalue_3 = Text(colour_swatch_3)
userkey_3 = Text("color")

c_script_3 = CSharpScript(geometry=curve_10, userKey=userkey_3, userValue=uservalue_3)  # -> out, geoWithUserString; inputs geometry: GeometryBase, userKey: String, userValue: String; same code as c_script
context_bake_9 = ContextBake(Geometry=c_script_3.geoWithUserString)

distance_in_meters = Panel(round_to_decimal_place_2.Rounded)
time_in_minutes = Panel(round_to_decimal_place.Rounded)
locations_within_the_range = Panel(number)
context_print = ContextPrint(LocationsWithinTheRange=number)
context_print_2 = ContextPrint(DistanceInMeters=round_to_decimal_place_2.Rounded)
context_print_3 = ContextPrint(TimeInMinutes=round_to_decimal_place.Rounded)

stream_filter_4 = StreamFilter(Gate=amenity_2, Stream0=ColourSwatch(SwatchColor=RGB(125, 194, 64)), Stream1=ColourSwatch(SwatchColor=RGB(194, 64, 181)))
construct_mesh_5 = ConstructMesh(Vertices=deconstruct_mesh_5.Vertices, Faces=deconstruct_mesh_5.Faces, Colours=stream_filter_4)
context_bake_10 = ContextBake(AvailableAmenities=construct_mesh_5)

# ==== cluster GetDataFromOSM
T = ClusterInput()
txt = ClusterInput()
txt_2 = ClusterInput()
txt_3 = ClusterInput()
txt_4 = Text(txt_2)
txt_5 = Text(txt_3)
txt_6 = Text(txt)
lng = ListLength(List=txt_6)
equals = Equality(FirstNumber=lng, SecondNumber="1")  # -> Equality, Inequality
concat = Concatenate(FragmentD=" modv=\"not\"", FragmentA=" v=\"", FragmentB=txt_5, FragmentC="\"")
concat_2 = Concatenate(FragmentA=" v=\"", FragmentB=txt_4, FragmentC="\"")
null = NullItem(Item=txt_4)  # -> NullFlags, InvalidFlags, Description
null_2 = NullItem(Item=txt_5)  # -> NullFlags, InvalidFlags, Description
split = TextSplit(Text=T, Separators=",")
filter = StreamFilter(Gate=null.NullFlags, Stream0=concat_2)
filter_2 = StreamFilter(Gate=null_2.NullFlags, Stream0=concat)
item = ListItem(List=split, Index=0, Wrap=True)  # -> Item, Item1, Item2, Item3
panel = Panel("""node
way
relation""")
merge = Merge(Data1=item.Item1, Data2=item.Item, Data3=item.Item3, Data4=item.Item2)  # -> flatten(Result)
merge_2 = Merge(Data1=filter, Data2=filter_2)  # -> flatten(Result)
concat_3 = Concatenate(
    FragmentA="<query type=\"",
    FragmentB=panel,
    FragmentC="\"><has-kv k=\"",
    FragmentD=txt_6,
    FragmentE="\"",
    FragmentF=graft(merge_2),
    FragmentG="/></query>")
join = TextJoin(Text=merge, Join=",")
lng_2 = ListLength(List=merge)
equals_2 = Equality(FirstNumber="4", SecondNumber=lng_2)  # -> Equality, Inequality
join_2 = TextJoin(Text=concat_3)  # -> flatten(Result)
join_3 = TextJoin(Text=join_2)
panel_2 = Panel("""<union>
<item/>
<recurse type="down"/>
</union>
<print mode="body"/>
</osm-script>""")
concat_4 = Concatenate(FragmentA="<union>", FragmentB=join_3, FragmentC="</union>")
concat_5 = Concatenate(FragmentA="<osm-script output=\"xml\" timeout=\"100\" bbox=\"", FragmentB=join, FragmentC="\">")
concat_6 = Concatenate(FragmentA=concat_5, FragmentD=concat_4, FragmentC=panel_2)
p_n_c = PickNChoose(Pattern=equals.Equality, Stream0="insert one and only key", Stream1=concat_6)
filter_3 = StreamFilter(Gate=equals_2.Equality, Stream1=p_n_c)
concat_7 = Concatenate(FragmentA="http://overpass-api.de/api/interpreter?data=", FragmentB=filter_3)
key = Text(txt)
out = Text(filter_3)
feat = Text(key)
in = Text(concat_7)
in_2 = ClusterOutput(in)
out_2 = ClusterOutput(out)
feat_2 = ClusterOutput(feat)
