# Grasshopper definition EvaluateYourCity3.gh (Grasshopper 1.0.7)
# plug-ins: Urbano

map_size = ValueList({"Small": 0, "Medium": 1, "Large": 2, "Super large": 3}, selected="Small")
integer = Integer(map_size)
map_size_2 = GetInteger(integer, AtLeast=1, AtMost=1, Maximum=2147483647, Minimum=-2147483648, TreeAccess=False)
integer_2 = Integer(map_size_2)

# ----
# Description: This app will help you to evaluate how close do you live to certain amenities like parks, playgrounds etc. ...
# 
# To get started go to www.openstreetmap.org, zoom the location that you want to evaluate, right clik on the map, and choose "show adress". From the left sidebar copy the geogrphical coordinates and past them ...
title = Panel("Evaluate your city")
box_size = Panel("0.010")
box_size_2 = Panel("0.019")
box_size_3 = Panel("0.013")
box_size_4 = Panel("0.016")

warsaw = Panel("20.99155")
warsaw_2 = Panel("52.23955")

barcelona = Panel("2.15728")
barcelona_2 = Panel("41.39233")

paris = Panel("2.34712")
paris_2 = Panel("48.89072")

london = Panel("-0.09304")
london_2 = Panel("51.48972")

vienna = Panel("16.40139")
vienna_2 = Panel("48.19906")

kopenhagen = Panel("12.54772")
kopenhagen_2 = Panel("55.67762")

stream_filter = StreamFilter(Gate=integer_2, Stream0=box_size, Stream1=box_size_3, Stream2=box_size_4, Stream3=box_size_2)

number = Number(warsaw)
location_w_e = GetNumber(number, AtLeast=1, AtMost=1, Maximum=1.797693135e+308, Minimum=-1.797693135e+308, TreeAccess=False)

number_2 = Number(warsaw_2)
location_n_s = GetNumber(number_2, AtLeast=1, AtMost=1, Maximum=1.797693135e+308, Minimum=-1.797693135e+308, TreeAccess=False)

division = Division(A=stream_filter, B=2)
division_2 = Division(A=division, B=1.5)

addition = Addition(A=location_n_s, B=division_2)
subtraction = Subtraction(A=location_n_s, B=division_2)
addition_2 = Addition(A=location_w_e, B=division)
subtraction_2 = Subtraction(A=location_w_e, B=division)
text_join = TextJoin(Text=[subtraction_2, subtraction, addition_2, addition], Join=",")
data = Data(text_join)
bbox_left_bottom_right_top = Panel(data)
data_2 = Data(bbox_left_bottom_right_top)

# ----
# OSM info: https://wiki.openstreetmap.org/wiki/Map_features
amenity = ValueList({"Parks": 0, "Playgrounds": 1, "Groceries": 2, "Restaurants": 3, "Public transport": 4, "Education": 5}, selected="Education")
integer_3 = Integer(amenity)
amenity_2 = GetInteger(integer_3, AtLeast=1, AtMost=1, Maximum=2147483647, Minimum=-2147483648, TreeAccess=False)
integer_4 = Integer(amenity_2)

panel = Panel("""kindergarten
school
university
college""")
panel_2 = Panel("""supermarket
convenience""")
panel_3 = Panel("""bar
pub
cafe
restaurant""")

download_openstreetmap_osm = DownloadOpenStreetMapOSM(LeftBound=subtraction_2, RightBound=addition_2, TopBound=addition, BottomBound=subtraction, RunToggle=True)  # -> OSMQueryURL, OSMFilePath
panel_4 = Panel(download_openstreetmap_osm.OSMQueryURL)

panel_5 = Panel("""service
residential""")  # disabled
panel_6 = Panel("""motorway
trunk
primary
secondary
tertiary
unclassified""")  # disabled
panel_7 = Panel("""footway
bridleway
steps
corridor
path
sidewalk
crossing
pedestrian
living street""")  # disabled
panel_8 = Panel("highway")  # disabled
panel_9 = Panel("highway")  # disabled
get_data_from_osm = GetDataFromOSM(T=data_2, txt=panel_8, txt_2=[panel_5, panel_6])  # -> out_2, in_2, feat_2; disabled
get_data_from_osm_2 = GetDataFromOSM(T=data_2, txt=panel_9, txt_2=[panel_7, panel_5])  # -> out_2, in_2, feat_2; disabled

panel_10 = Panel("")  # disabled
panel_11 = Panel("building")  # disabled
get_data_from_osm_3 = GetDataFromOSM(T=data_2, txt=panel_11, txt_2=panel_10)  # -> out_2, in_2, feat_2; disabled

import_osm_features = ImportOSMFeatures(OSMPathOrURL=get_data_from_osm.in_2, OSMFeatureType=get_data_from_osm.feat_2, Format="xml", ImportAltitude=False)  # -> Points, Metadata, UTMZone, TranslationVector; disabled
point = Point(import_osm_features.Points)  # disabled
polyline = PolyLine(Vertices=point, Closed=False)  # disabled

import_osm_features_2 = ImportOSMFeatures(OSMPathOrURL=get_data_from_osm_2.in_2, OSMFeatureType=get_data_from_osm_2.feat_2, Format="xml", ImportAltitude=False)  # -> Points, Metadata, UTMZone, TranslationVector; disabled
point_2 = Point(import_osm_features_2.Points)  # disabled
polyline_2 = PolyLine(Vertices=point_2, Closed=False)  # disabled

import_osm_features_3 = ImportOSMFeatures(OSMPathOrURL=download_openstreetmap_osm.OSMQueryURL, OSMFeatureType="leisure", Format="xml", ImportAltitude=False)  # -> Points, Metadata, UTMZone, TranslationVector
point_3 = Point(import_osm_features_3.Points)
lookup_metadata = LookupMetadata(MetadataGeometry=import_osm_features_3.Metadata, SearchKey="leisure")
list = ValueList({"playground"}, selected="playground")
polyline_3 = PolyLine(Vertices=point_3, Closed=False)
tmatch = MatchText(Text=flatten(lookup_metadata), Pattern=graft(list), Case=True)
dispatch = Dispatch(List=flatten(import_osm_features_3.Metadata), DispatchPattern=tmatch)  # -> ListA, ListB
dispatch_2 = Dispatch(List=flatten(polyline_3), DispatchPattern=tmatch)  # -> ListA, ListB
panel_12 = Panel(tmatch)

get_data_from_osm_4 = GetDataFromOSM(T=data_2, txt="leisure", txt_2="playground")  # -> out_2, in_2, feat_2

import_osm_features_4 = ImportOSMFeatures(OSMPathOrURL=download_openstreetmap_osm.OSMQueryURL, OSMFeatureType="leisure", Format="xml", ImportAltitude=False)  # -> Points, Metadata, UTMZone, TranslationVector
point_4 = Point(import_osm_features_4.Points)
lookup_metadata_2 = LookupMetadata(MetadataGeometry=import_osm_features_4.Metadata, SearchKey="leisure")
list_2 = ValueList({"park"}, selected="park")
polyline_4 = PolyLine(Vertices=point_4, Closed=False)
tmatch_2 = MatchText(Text=flatten(lookup_metadata_2), Pattern=graft(list_2), Case=True)
dispatch_3 = Dispatch(List=flatten(import_osm_features_4.Metadata), DispatchPattern=tmatch_2)  # -> ListA, ListB
dispatch_4 = Dispatch(List=flatten(polyline_4), DispatchPattern=tmatch_2)  # -> ListA, ListB
panel_13 = Panel(tmatch_2)

get_data_from_osm_5 = GetDataFromOSM(T=data_2, txt="leisure", txt_2="park")  # -> out_2, in_2, feat_2

import_osm_features_5 = ImportOSMFeatures(OSMPathOrURL=download_openstreetmap_osm.OSMQueryURL, OSMFeatureType="amenity", Format="xml", ImportAltitude=False)  # -> Points, Metadata, UTMZone, TranslationVector
lookup_metadata_3 = LookupMetadata(MetadataGeometry=import_osm_features_5.Metadata, SearchKey="amenity")
list_3 = ValueList({"kindergarten", "school", "university", "college"}, selected=["kindergarten", "school", "university", "college"])
point_5 = Point(import_osm_features_5.Points)
tmatch_3 = MatchText(Text=flatten(lookup_metadata_3), Pattern=graft(list_3), Case=True)
dispatch_5 = Dispatch(List=flatten(import_osm_features_5.Metadata), DispatchPattern=tmatch_3)  # -> ListA, ListB
dispatch_6 = Dispatch(List=flatten(point_5), DispatchPattern=tmatch_3)  # -> ListA, ListB
panel_14 = Panel(tmatch_3)

get_data_from_osm_6 = GetDataFromOSM(T=data_2, txt="amenity", txt_2=panel)  # -> out_2, in_2, feat_2

import_osm_features_6 = ImportOSMFeatures(OSMPathOrURL=download_openstreetmap_osm.OSMQueryURL, OSMFeatureType="shop", Format="xml", ImportAltitude=False)  # -> Points, Metadata, UTMZone, TranslationVector
lookup_metadata_4 = LookupMetadata(MetadataGeometry=import_osm_features_6.Metadata, SearchKey="shop")
list_4 = ValueList({"supermarket", "convenience"}, selected=["supermarket", "convenience"])
point_6 = Point(import_osm_features_6.Points)
tmatch_4 = MatchText(Text=flatten(lookup_metadata_4), Pattern=graft(list_4), Case=True)
dispatch_7 = Dispatch(List=flatten(import_osm_features_6.Metadata), DispatchPattern=tmatch_4)  # -> ListA, ListB
dispatch_8 = Dispatch(List=flatten(point_6), DispatchPattern=tmatch_4)  # -> ListA, ListB
panel_15 = Panel(tmatch_4)

get_data_from_osm_7 = GetDataFromOSM(T=data_2, txt="shop", txt_2=panel_2)  # -> out_2, in_2, feat_2

import_osm_features_7 = ImportOSMFeatures(OSMPathOrURL=download_openstreetmap_osm.OSMQueryURL, OSMFeatureType="amenity", Format="xml", ImportAltitude=False)  # -> Points, Metadata, UTMZone, TranslationVector
lookup_metadata_5 = LookupMetadata(MetadataGeometry=import_osm_features_7.Metadata, SearchKey="amenity")
list_5 = ValueList({"bar", "pub", "cafe", "restaurant"}, selected=["bar", "pub", "cafe", "restaurant"])
point_7 = Point(import_osm_features_7.Points)
tmatch_5 = MatchText(Text=flatten(lookup_metadata_5), Pattern=graft(list_5), Case=True)
dispatch_9 = Dispatch(List=flatten(import_osm_features_7.Metadata), DispatchPattern=tmatch_5)  # -> ListA, ListB
dispatch_10 = Dispatch(List=flatten(point_7), DispatchPattern=tmatch_5)  # -> ListA, ListB
panel_16 = Panel(tmatch_5)

get_data_from_osm_8 = GetDataFromOSM(T=data_2, txt="amenity", txt_2=panel_3)  # -> out_2, in_2, feat_2

import_osm_features_8 = ImportOSMFeatures(
    OSMPathOrURL=download_openstreetmap_osm.OSMQueryURL,
    OSMFeatureType="public_transport",
    Format="xml",
    ImportAltitude=False)  # -> Points, Metadata, UTMZone, TranslationVector
lookup_metadata_6 = LookupMetadata(MetadataGeometry=import_osm_features_8.Metadata, SearchKey="public_transport")
list_6 = ValueList({"stop_position"}, selected="stop_position")
point_8 = Point(import_osm_features_8.Points)
tmatch_6 = MatchText(Text=flatten(lookup_metadata_6), Pattern=graft(list_6), Case=True)
dispatch_11 = Dispatch(List=flatten(import_osm_features_8.Metadata), DispatchPattern=tmatch_6)  # -> ListA, ListB
dispatch_12 = Dispatch(List=flatten(point_8), DispatchPattern=tmatch_6)  # -> ListA, ListB
panel_17 = Panel(tmatch_6)

get_data_from_osm_9 = GetDataFromOSM(T=data_2, txt="public_transport", txt_2="stop_position")  # -> out_2, in_2, feat_2
stream_filter_2 = StreamFilter(
    Gate=integer_4,
    Stream0=get_data_from_osm_5.in_2,
    Stream1=get_data_from_osm_4.in_2,
    Stream2=get_data_from_osm_7.in_2,
    Stream3=get_data_from_osm_8.in_2,
    Stream4=get_data_from_osm_9.in_2,
    Stream5=get_data_from_osm_6.in_2)
stream_filter_3 = StreamFilter(
    Gate=integer_4,
    Stream0=get_data_from_osm_5.feat_2,
    Stream1=get_data_from_osm_4.feat_2,
    Stream2=get_data_from_osm_7.feat_2,
    Stream3=get_data_from_osm_8.feat_2,
    Stream4=get_data_from_osm_9.feat_2,
    Stream5=get_data_from_osm_6.feat_2)

import_osm_features_9 = ImportOSMFeatures(OSMPathOrURL=download_openstreetmap_osm.OSMQueryURL, OSMFeatureType="street", Format="xml", ImportAltitude=False)  # -> Points, Metadata, UTMZone, TranslationVector
point_9 = Point(import_osm_features_9.Points)
lookup_metadata_7 = LookupMetadata(MetadataGeometry=import_osm_features_9.Metadata, SearchKey="highway")
list_7 = ValueList({"footway", "bridleway", "steps", "corridor", "path", "sidewalk", "crossing", "pedestrian", "living street", "service", "residential"}, selected=["footway", "bridleway", "steps", "corridor", "path", "sidewalk", "crossing", "pedestrian", "living street", "service", "residential"])
polyline_5 = PolyLine(Vertices=point_9, Closed=False)
tmatch_7 = MatchText(Text=flatten(lookup_metadata_7), Pattern=graft(list_7), Case=True)
panel_18 = Panel(tmatch_7)
dispatch_13 = Dispatch(List=flatten(polyline_5), DispatchPattern=tmatch_7)  # -> ListA, ListB
crv = Curve(dispatch_13.ListA)

import_osm_features_10 = ImportOSMFeatures(OSMPathOrURL=download_openstreetmap_osm.OSMQueryURL, OSMFeatureType="street", Format="xml", ImportAltitude=False)  # -> Points, Metadata, UTMZone, TranslationVector
point_10 = Point(import_osm_features_10.Points)
lookup_metadata_8 = LookupMetadata(MetadataGeometry=import_osm_features_10.Metadata, SearchKey="highway")
list_8 = ValueList({"motorway", "trunk", "primary", "secondary", "tertiary", "unclassified", "service", "residential"}, selected=["motorway", "trunk", "primary", "secondary", "tertiary", "unclassified", "service", "residential"])
polyline_6 = PolyLine(Vertices=point_10, Closed=False)
tmatch_8 = MatchText(Text=flatten(lookup_metadata_8), Pattern=graft(list_8), Case=True)
panel_19 = Panel(tmatch_8)
dispatch_14 = Dispatch(List=flatten(polyline_6), DispatchPattern=tmatch_8)  # -> ListA, ListB
crv_2 = Curve(dispatch_14.ListA)

import_osm_features_11 = ImportOSMFeatures(OSMPathOrURL=download_openstreetmap_osm.OSMQueryURL, OSMFeatureType="building", Format="xml", ImportAltitude=False)  # -> Points, Metadata, UTMZone, TranslationVector
point_11 = Point(import_osm_features_11.Points)
polyline_7 = PolyLine(Vertices=point_11, Closed=False)
lookup_metadata_9 = LookupMetadata(MetadataGeometry=import_osm_features_11.Metadata, SearchKey="height")
create_building = CreateBuilding(BuildingCurve=polyline_7, Metadata=import_osm_features_11.Metadata)
panel_20 = Panel(lookup_metadata_9)

import_osm_features_12 = ImportOSMFeatures(OSMPathOrURL=stream_filter_2, OSMFeatureType=stream_filter_3, Format="xml", ImportAltitude=False)  # -> Points, Metadata, UTMZone, TranslationVector
point_12 = Point(import_osm_features_12.Points)
stream_gate = StreamGate(Stream=point_12, Gate=integer_4)  # -> Target0, Target1, Target2, Target3, Target4, Target5

stream_filter_4 = StreamFilter(
    Gate=integer_4,
    Stream0=dispatch_3.ListA,
    Stream1=dispatch.ListA,
    Stream2=dispatch_7.ListA,
    Stream3=dispatch_9.ListA,
    Stream4=dispatch_11.ListA,
    Stream5=dispatch_5.ListA)
clean_tree = CleanTree(RemoveNulls=True, RemoveInvalid=True, RemoveEmpty=invert(False), Tree=stream_filter_4)
flatten_tree = FlattenTree(Tree=clean_tree, Path="{0}")

stream_filter_5 = StreamFilter(
    Gate=integer_4,
    Stream0=dispatch_4.ListA,
    Stream1=dispatch_2.ListA,
    Stream2=dispatch_8.ListA,
    Stream3=dispatch_10.ListA,
    Stream4=dispatch_12.ListA,
    Stream5=dispatch_6.ListA)
clean_tree_2 = CleanTree(RemoveNulls=True, RemoveInvalid=True, RemoveEmpty=invert(False), Tree=stream_filter_5)
flatten_tree_2 = FlattenTree(Tree=clean_tree_2, Path="{0}")

polyline_8 = PolyLine(Vertices=[stream_gate.Target1, stream_gate.Target0], Closed=False)
unit_z = UnitZ(Factor=0.1)
curve = Curve(flatten(polyline_8))
extrude = Extrude(Base=curve, Direction=unit_z)
clean_tree_3 = CleanTree(RemoveNulls=True, RemoveInvalid=True, RemoveEmpty=invert(False), Tree=extrude)

deconstruct_metadata = DeconstructMetadata(Metadata=flatten_tree)  # -> Keys, Values
panel_21 = Panel(deconstruct_metadata.Keys)
panel_22 = Panel(deconstruct_metadata.Values)
cull_index = CullIndex(List=panel_21, Indices=0, Wrap=True)
cull_index_2 = CullIndex(List=panel_22, Indices=0, Wrap=True)
concatenate = Concatenate(Fragment_A=cull_index, A=" : ", Fragment_B=cull_index_2)
panel_23 = Panel(concatenate)
text_join_2 = TextJoin(Text=panel_23)  # -> flatten(Result)
panel_24 = Panel(text_join_2)

# ----
# It's ok, if it fails to collect data
merge = Merge(Data1=stream_gate.Target2, Data2=stream_gate.Target3, Data3=stream_gate.Target4, Data4=stream_gate.Target5)
cap_holes = CapHoles(Brep=clean_tree_3)
mesh_brep = MeshBrep(
    Brep=cap_holes,
    Settings={GridMaxCount=0, GridMinCount=16, JaggedSeams=False, MaxEdgeLength=0, MinEdgeLength=0.0001, MinTolerance=0, Refine=True, RefineAngle=0, RelativeTolerance=0.65, SimplePlanes=True, Tolerance=0})
mesh_sphere = MeshSphere(Base=flatten(merge), Radius="8", UCount=10, VCount=20)
merge_2 = Merge(Data1=flatten(mesh_brep), Data2=flatten(mesh_sphere))

c_script = CSharpScript()  # -> fonts
# ---------- c_script: C# ----------
    fonts = Rhino.DocObjects.Font.AvailableFontFaceNames();
# ---------- end c_script ----------
item = ListItem(List=c_script, Index=Slider(45, range=0..423), Wrap=True)

integer_5 = Integer(Slider(250, range=100..500))
data_radius = GetInteger(integer_5, AtLeast=1, AtMost=1, Maximum=2147483647, Minimum=-2147483648, TreeAccess=False)
integer_6 = Integer(data_radius)

_3d_inside = GetBoolean(Toggle(True), AtLeast=1, AtMost=1, FalseValue="False", TreeAccess=False, TrueValue="True")
boolean = Boolean(_3d_inside)

merge_3 = Merge(
    Data1=polyline_8,
    Data2=stream_gate.Target2,
    Data3=stream_gate.Target3,
    Data4=stream_gate.Target4,
    Data5=stream_gate.Target5)
bounding_box = BoundingBox(Content=flatten(merge_3), Plane=PlaneXY(0, 0, 0), UnionBox=True)  # -> Box, Box_2
bounding_box_2 = BoundingBox(Content=flatten(create_building), Plane=PlaneXY(0, 0, 0), UnionBox=True)  # -> Box, Box_2
bounding_box_3 = BoundingBox(Content=flatten([bounding_box_2.Box, bounding_box.Box]), Plane=PlaneXY(0, 0, 0), UnionBox=True)  # -> Box, Box_2
deconstruct_brep = DeconstructBrep(Brep=bounding_box_3.Box)  # -> Faces, Edges, Vertices
surface = Surface(deconstruct_brep.Faces)
area = Area(Geometry=surface)  # -> Area, Centroid
unit_z_2 = UnitZ(Factor="50")
scale = Scale(Geometry=surface, Center=area.Centroid, Factor="1.1")  # -> Geometry, Transform
negative = Negative(Value=unit_z_2)
extrude_2 = Extrude(Base=scale.Geometry, Direction=negative)
brep = Brep(extrude_2)
curve_2 = Curve(flatten(crv_2))
curve_3 = Curve(flatten(crv))
trim_with_breps = TrimWithBreps(Curve=curve_3, Brep=brep)  # -> Inside, Outside
trim_with_breps_2 = TrimWithBreps(Curve=curve_2, Brep=brep)  # -> Inside, Outside

area_2 = Area(Geometry=scale.Geometry)  # -> Area, Centroid
m2 = Panel(area_2.Area)
number_3 = Number(expr("Round(x,2)", m2))
multiplication = Multiplication(A=number_3, B="0.000001")

deconstruct_brep_2 = DeconstructBrep(Brep=scale.Geometry)  # -> Faces, Edges, Vertices
division_3 = Division(A=negative, B=2)
curve_4 = Curve(deconstruct_brep_2.Edges)
move = Move(Geometry=curve_4, Motion=division_3)  # -> Geometry, Transform
offset_curve = OffsetCurve(Curve=move.Geometry, Distance=Slider(50, range=0..100), Corners=1)  # -> flatten(Curve)
end_points = EndPoints(Curve=move.Geometry)  # -> Start, End
end_points_2 = EndPoints(Curve=offset_curve)  # -> Start, End
line = Line(StartPoint=end_points.Start, EndPoint=end_points_2.Start)
line_2 = Line(StartPoint=end_points.End, EndPoint=end_points_2.End)
end_points_3 = EndPoints(Curve=line)  # -> Start, End
end_points_4 = EndPoints(Curve=line_2)  # -> Start, End
scale_2 = Scale(Geometry=line, Center=end_points_3.End, Factor="0.3")  # -> Geometry, Transform
scale_3 = Scale(Geometry=line_2, Center=end_points_4.End, Factor="0.3")  # -> Geometry, Transform
vector = Vector(scale_2.Geometry)
vector_2 = Vector(scale_3.Geometry)
move_2 = Move(Geometry=scale_2.Geometry, Motion=vector)  # -> Geometry, Transform
move_3 = Move(Geometry=scale_3.Geometry, Motion=vector_2)  # -> Geometry, Transform
join_curves = JoinCurves(Curves=[scale_2.Geometry, move_2.Geometry], Preserve=False)
join_curves_2 = JoinCurves(Curves=[scale_3.Geometry, move_3.Geometry], Preserve=False)

volume = Volume(Geometry=brep)  # -> Volume, Centroid
orient = Orient(Geometry=brep, Source=volume.Centroid, Target="0,0,0")  # -> Geometry, Transform
volume_2 = Volume(Geometry=orient.Geometry)  # -> Volume, Centroid
vector_2pt = Vector2Pt(PointA=volume.Centroid, PointB=volume_2.Centroid, Unitize=False)  # -> Vector, Length

simple_mesh = SimpleMesh(Brep=orient.Geometry)
deconstruct_mesh = DeconstructMesh(Mesh=flatten(simple_mesh))  # -> Vertices, Faces, Colours, Normals

length = Length(Curve=move.Geometry)
concatenate_2 = Concatenate(FragmentA=length, FragmentB=" m")

number_4 = Number(expr("Round(x,2)", multiplication))
context_print = ContextPrint(Text=number_4)

clean_tree_4 = CleanTree(RemoveNulls=True, RemoveInvalid=True, RemoveEmpty=invert(False), Tree=merge_2)
move_4 = Move(Geometry=clean_tree_4, Motion=vector_2pt.Vector)  # -> Geometry, Transform
mesh = Mesh(move_4.Geometry)
deconstruct_mesh_2 = DeconstructMesh(Mesh=flatten(mesh))  # -> Vertices, Faces, Colours, Normals

panel_25 = Panel(item)
c_script_2 = CSharpScript(face=panel_25, bold=Toggle(False), italics=Toggle(False), size=Slider(10, range=1..20), content=concatenate_2)  # -> out, A; inputs face: String, bold: Boolean, italics: Boolean, size: Double, content: String
# ---------- c_script_2: C# ----------
    if(content != null && content != String.Empty
    && face != null && face != String.Empty ){

      if(size == 0)
        size = 5;

      Rhino.DocObjects.Font.FontStyle fontStyle = Rhino.DocObjects.Font.FontStyle.Upright;
      if (italics) fontStyle = Rhino.DocObjects.Font.FontStyle.Italic;
      Rhino.DocObjects.Font.FontWeight fontWeight = Rhino.DocObjects.Font.FontWeight.Normal;
      if (bold) fontWeight = Rhino.DocObjects.Font.FontWeight.Bold;

      bool underlined = false;
      bool strikethrough = false;

      Rhino.DocObjects.Font font = new Rhino.DocObjects.Font(face, fontWeight, fontStyle, underlined, strikethrough);


      TextEntity text_entity = new TextEntity
        {
          Plane = Plane.WorldXY,
          PlainText = content,
          Justification = TextJustification.MiddleCenter,
          Font = font
          };
      Rhino.DocObjects.DimensionStyle dimstyle = new Rhino.DocObjects.DimensionStyle();
      dimstyle.TextHeight = size;
      double smallCapsScale = 1;
      double spacing = 0;
      A = text_entity.CreateSurfaces(dimstyle, smallCapsScale, spacing);



    } else {

      Print("Some content is required.");

    }
# ---------- end c_script_2 ----------
mesh_2 = Mesh(c_script_2.A)
mesh_join = MeshJoin(Meshes=mesh_2)  # -> flatten(Mesh)

km2 = Panel(number_4)

brep_2 = Brep(orient.Geometry)
deconstruct_brep_3 = DeconstructBrep(Brep=brep_2)  # -> Faces, Edges, Vertices
area_3 = Area(Geometry=brep_2)  # -> Area, Centroid
unit_z_3 = UnitZ(Factor=1)
list_item = ListItem(List=deconstruct_brep_3.Faces, Index=0, Wrap=True)
project_point = ProjectPoint(Point=area_3.Centroid, Direction=unit_z_3, Geometry=list_item)  # -> Point, Index

construct_mesh = ConstructMesh(Vertices=deconstruct_mesh.Vertices, Faces=deconstruct_mesh.Faces, Colours=ColourSwatch(SwatchColor=RGB(204, 204, 204)))
context_bake = ContextBake(Geometry=construct_mesh)

list_length = ListLength(List=mesh)
context_print_2 = ContextPrint(AmenitiesNumber=list_length)

division_4 = Division(A=1, B=number_4)
multiplication_2 = Multiplication(A=division_4, B=list_length)

number_5 = Number(expr("Round(x,2)", multiplication_2))
context_print_3 = ContextPrint(AmenitiesPerArea=number_5)

panel_26 = Panel(number_5)

stream_filter_6 = StreamFilter(
    Gate=integer_4,
    Stream0=ColourSwatch(SwatchColor=RGB(125, 194, 64)),
    Stream1=ColourSwatch(SwatchColor=RGB(212, 87, 174)),
    Stream2=ColourSwatch(SwatchColor=RGB(194, 64, 64)),
    Stream3=ColourSwatch(SwatchColor=RGB(219, 196, 64)),
    Stream4=ColourSwatch(SwatchColor=RGB(47, 222, 219)),
    Stream5=ColourSwatch(SwatchColor=RGB(161, 92, 214)))
construct_mesh_2 = ConstructMesh(Vertices=deconstruct_mesh_2.Vertices, Faces=deconstruct_mesh_2.Faces, Colours=stream_filter_6)  # -> flatten(Mesh)
context_bake_2 = ContextBake(Amenities=construct_mesh_2)

bounding_box_4 = BoundingBox(Content=mesh_join, Plane=PlaneXY(0, 0, 0))  # -> Box, Box_2
curve_middle = CurveMiddle(Curve=offset_curve)
volume_3 = Volume(Geometry=bounding_box_4.Box)  # -> Volume, Centroid
orient_2 = Orient(Geometry=mesh_join, Source=volume_3.Centroid, Target=curve_middle)  # -> Geometry, Transform
series = Series(Start=0, Step=90, Count=4)
rotate = Rotate(Geometry=orient_2.Geometry, Angle=degrees(series), Plane=curve_middle)  # -> Geometry, Transform
unit_z_4 = UnitZ(Factor=5)
move_5 = Move(Geometry=rotate.Geometry, Motion=unit_z_4)  # -> Geometry, Transform
move_6 = Move(Geometry=move_5.Geometry, Motion=vector_2pt.Vector)  # -> Geometry, Transform
deconstruct_mesh_3 = DeconstructMesh(Mesh=flatten(move_6.Geometry))  # -> Vertices, Faces, Colours, Normals

inspect_building = InspectBuilding(Building=create_building, DefaultHeight="12")  # -> Geometry, Metadata, Amenity, BuildingMesh
mesh_3 = Mesh(flatten(inspect_building.BuildingMesh))
curve_5 = Curve(flatten(inspect_building.Geometry))
clean_tree_5 = CleanTree(RemoveNulls=True, RemoveInvalid=True, RemoveEmpty=invert(False), Tree=mesh_3)
clean_tree_6 = CleanTree(RemoveNulls=True, RemoveInvalid=True, RemoveEmpty=invert(False), Tree=curve_5)
move_7 = Move(Geometry=clean_tree_6, Motion=vector_2pt.Vector)  # -> Geometry, Transform
move_8 = Move(Geometry=clean_tree_5, Motion=vector_2pt.Vector)  # -> Geometry, Transform

move_9 = Move(Geometry=trim_with_breps_2.Inside, Motion=vector_2pt.Vector)  # -> Geometry, Transform
curve_6 = Curve(flatten(move_9.Geometry))
colour_swatch = ColourSwatch(SwatchColor=RGB(59, 59, 59))
preview = CustomPreview(Geometry=curve_6, Material=colour_swatch)
clean_tree_7 = CleanTree(RemoveNulls=True, RemoveInvalid=True, RemoveEmpty=invert(False), Tree=curve_6)

move_10 = Move(Geometry=trim_with_breps.Inside, Motion=vector_2pt.Vector)  # -> Geometry, Transform
colour_swatch_2 = ColourSwatch(SwatchColor=RGB(115, 115, 115))
curve_7 = Curve(flatten(move_10.Geometry))
uservalue = Text(colour_swatch_2)
userkey = Text("color")
preview_2 = CustomPreview(Geometry=curve_7, Material=colour_swatch_2)
clean_tree_8 = CleanTree(RemoveNulls=True, RemoveInvalid=True, RemoveEmpty=invert(False), Tree=curve_7)

inputpoint = GetPoint(project_point.Point, AtLeast=1, AtMost=1, Realtime=True, TreeAccess=False)

uservalue_2 = Text(colour_swatch)
userkey_2 = Text("color")

move_11 = Move(Geometry=[offset_curve, join_curves, join_curves_2], Motion=vector_2pt.Vector)  # -> Geometry, Transform
curve_8 = Curve(move_11.Geometry)
colour_swatch_3 = ColourSwatch(SwatchColor=RGB(0, 0, 0))
preview_3 = CustomPreview(Geometry=curve_8, Material=colour_swatch_3)

circle = Circle(Plane=inputpoint, Radius=integer_6)
unit_z_5 = UnitZ(Factor=50)
unit_z_6 = UnitZ(Factor=-50)
extrude_3 = Extrude(Base=circle, Direction=[unit_z_5, unit_z_6])
brep_join = BrepJoin(Breps=extrude_3)  # -> Breps, Closed
cap_holes_2 = CapHoles(Brep=brep_join.Breps)

c_script_3 = CSharpScript(geometry=clean_tree_8, userKey=userkey, userValue=uservalue)  # -> out, geoWithUserString; inputs geometry: GeometryBase, userKey: String, userValue: String
# ---------- c_script_3: C# ----------
    geometry.SetUserString(userKey, userValue);
   geoWithUserString = geometry;
# ---------- end c_script_3 ----------
context_bake_3 = ContextBake(Sidewalks=c_script_3.geoWithUserString)

c_script_4 = CSharpScript(geometry=clean_tree_7, userKey=userkey_2, userValue=uservalue_2)  # -> out, geoWithUserString; inputs geometry: GeometryBase, userKey: String, userValue: String
# ---------- c_script_4: C# ----------
    geometry.SetUserString(userKey, userValue);
    geoWithUserString = geometry;
# ---------- end c_script_4 ----------
context_bake_4 = ContextBake(Geometry=c_script_4.geoWithUserString)

pipe = Pipe(Curve=circle, Radius=1.2, Caps=0)
mesh_brep_2 = MeshBrep(
    Brep=pipe,
    Settings={GridMaxCount=0, GridMinCount=16, JaggedSeams=False, MaxEdgeLength=0, MinEdgeLength=0.0001, MinTolerance=0, Refine=True, RefineAngle=0, RelativeTolerance=0.65, SimplePlanes=True, Tolerance=0})
deconstruct_mesh_4 = DeconstructMesh(Mesh=flatten(mesh_brep_2))  # -> Vertices, Faces, Colours, Normals

area_4 = Area(Geometry=move_7.Geometry)  # -> Area, Centroid
point_in_brep = PointInBrep(Brep=cap_holes_2, Point=area_4.Centroid, Strict=False)
dispatch_15 = Dispatch(List=move_8.Geometry, DispatchPattern=point_in_brep)  # -> ListA, ListB
dispatch_16 = Dispatch(List=move_7.Geometry, DispatchPattern=point_in_brep)  # -> ListA, ListB
mesh_4 = Mesh(dispatch_15.ListB)
curve_9 = Curve(dispatch_16.ListA)
mesh_5 = Mesh(dispatch_15.ListA)
curve_10 = Curve(dispatch_16.ListB)

uservalue_3 = Text(colour_swatch_3)
userkey_3 = Text("color")

c_script_5 = CSharpScript(geometry=curve_8, userKey=userkey_3, userValue=uservalue_3)  # -> out, geoWithUserString; inputs geometry: GeometryBase, userKey: String, userValue: String; same code as c_script_3
context_bake_5 = ContextBake(Geometry=c_script_5.geoWithUserString)

volume_4 = Volume(Geometry=construct_mesh_2)  # -> Volume, Centroid
text_tag = TextTag(Location=volume_4.Centroid, Text=panel_24)

construct_mesh_3 = ConstructMesh(Vertices=deconstruct_mesh_4.Vertices, Faces=deconstruct_mesh_4.Faces, Colours=ColourSwatch(SwatchColor=RGB(0, 0, 0)))  # -> flatten(Mesh)
context_bake_6 = ContextBake(Geometry=construct_mesh_3)

point_in_brep_2 = PointInBrep(Brep=cap_holes_2, Point=volume_4.Centroid, Strict=False)
dispatch_17 = Dispatch(List=panel_24, DispatchPattern=point_in_brep_2)  # -> ListA, ListB
data_3 = Data(dispatch_17.ListA)

construct_mesh_4 = ConstructMesh(Vertices=deconstruct_mesh_3.Vertices, Faces=deconstruct_mesh_3.Faces, Colours=ColourSwatch(SwatchColor=RGB(59, 59, 59)))  # -> flatten(Mesh)
context_bake_7 = ContextBake(Geometry=construct_mesh_4)

unit_z_7 = UnitZ(Factor=0.1)
surface_2 = Surface(curve_10)
extrude_4 = Extrude(Base=surface_2, Direction=unit_z_7)
mesh_brep_3 = MeshBrep(
    Brep=extrude_4,
    Settings={GridMaxCount=0, GridMinCount=16, JaggedSeams=False, MaxEdgeLength=0, MinEdgeLength=0.0001, MinTolerance=0, Refine=True, RefineAngle=0, RelativeTolerance=0.65, SimplePlanes=True, Tolerance=0})

unit_z_8 = UnitZ(Factor=0.1)
surface_3 = Surface(curve_9)
extrude_5 = Extrude(Base=surface_3, Direction=unit_z_8)
mesh_brep_4 = MeshBrep(
    Brep=extrude_5,
    Settings={GridMaxCount=0, GridMinCount=16, JaggedSeams=False, MaxEdgeLength=0, MinEdgeLength=0.0001, MinTolerance=0, Refine=True, RefineAngle=0, RelativeTolerance=0.65, SimplePlanes=True, Tolerance=0})

dispatch_18 = Dispatch(List=volume_4.Centroid, DispatchPattern=point_in_brep_2)  # -> ListA, ListB
deconstruct = Deconstruct(Point=dispatch_18.ListA)  # -> XComponent, YComponent, ZComponent

amenitiesmetadata = ContextPrint(AmenitiesMetadata=data_3)
amenitiesmetadata_2 = ContextPrint(AmenitiesLocationX=deconstruct.XComponent)
amenitiesmetadata_3 = ContextPrint(AmenitiesLocationY=deconstruct.YComponent)
amenitiesmetadata_4 = ContextPrint(AmenitiesLocationZ=deconstruct.ZComponent)

mesh_join_2 = MeshJoin(Meshes=[mesh_5, mesh_brep_3])
mesh_join_3 = MeshJoin(Meshes=[mesh_brep_4, mesh_4])

stream_filter_7 = StreamFilter(Gate=boolean, Stream0=mesh_join_3, Stream1=mesh_join_2)
deconstruct_mesh_5 = DeconstructMesh(Mesh=flatten(stream_filter_7))  # -> Vertices, Faces, Colours, Normals

construct_mesh_5 = ConstructMesh(
    Vertices=deconstruct_mesh_5.Vertices,
    Faces=deconstruct_mesh_5.Faces,
    Colours=ColourSwatch(SwatchColor=RGB(255, 255, 255)))  # -> flatten(Mesh)
context_bake_8 = ContextBake(BuildingsGeo=construct_mesh_5)

# ==== cluster GetDataFromOSM
T = ClusterInput()
txt = ClusterInput()
txt_2 = ClusterInput()
txt_3 = ClusterInput()
txt_4 = Text(txt_2)
txt_5 = Text(txt_3)
txt_6 = Text(txt)
null = NullItem(Item=txt_4)  # -> NullFlags, InvalidFlags, Description
lng = ListLength(List=txt_6)
list_item = ListItem(List=null.NullFlags, Index=0, Wrap=True)
equals = Equality(FirstNumber=lng, SecondNumber="1")  # -> Equality, Inequality
concat = Concatenate(FragmentD=" modv=\"not\"", FragmentA=" v=\"", FragmentB=txt_5, FragmentC="\"")
concat_2 = Concatenate(FragmentA=" v=\"", FragmentB=txt_4, FragmentC="\"")
null_2 = NullItem(Item=txt_5)  # -> NullFlags, InvalidFlags, Description
split = TextSplit(Text=T, Separators=",")
filter = StreamFilter(Gate=list_item, Stream0=concat_2)
filter_2 = StreamFilter(Gate=null_2.NullFlags, Stream0=concat)
item = ListItem(List=split, Index=0, Wrap=True)  # -> Item, Item1, Item2, Item3
panel = Panel("""node
way
relation""")
merge = Merge(Data1=item.Item1, Data2=item.Item, Data3=item.Item3, Data4=item.Item2)  # -> flatten(Result)
merge_2 = Merge(Data1=filter, Data2=filter_2)  # -> flatten(Result)
concat_3 = Concatenate(
    FragmentA="<query type=\"",
    FragmentB=panel,
    FragmentC="\"><has-kv k=\"",
    FragmentD=txt_6,
    FragmentE="\"",
    FragmentF=graft(merge_2),
    FragmentG="/></query>")
join = TextJoin(Text=merge, Join=",")
lng_2 = ListLength(List=merge)
equals_2 = Equality(FirstNumber="4", SecondNumber=lng_2)  # -> Equality, Inequality
join_2 = TextJoin(Text=concat_3)  # -> flatten(Result)
join_3 = TextJoin(Text=join_2)
panel_2 = Panel("""<union>
<item/>
<recurse type="down"/>
</union>
<print mode="body"/>
</osm-script>""")
concat_4 = Concatenate(FragmentA="<union>", FragmentB=join_3, FragmentC="</union>")
concat_5 = Concatenate(FragmentA="<osm-script output=\"xml\" timeout=\"200\" bbox=\"", FragmentB=join, FragmentC="\">")
concat_6 = Concatenate(FragmentA=concat_5, FragmentD=concat_4, FragmentC=panel_2)
p_n_c = PickNChoose(Pattern=equals.Equality, Stream0="insert one and only key", Stream1=concat_6)
filter_3 = StreamFilter(Gate=equals_2.Equality, Stream1=p_n_c)
concat_7 = Concatenate(FragmentA="http://overpass-api.de/api/interpreter?data=", FragmentB=filter_3)
key = Text(txt)
out = Text(filter_3)
in = Text(concat_7)
feat = Text(key)
in_2 = ClusterOutput(in)
out_2 = ClusterOutput(out)
feat_2 = ClusterOutput(feat)
