# Grasshopper definition EvaluateYourCity4.gh (Grasshopper 1.0.7)
# plug-ins: Urbano

map_size = ValueList({"Small": 0, "Medium": 1, "Large": 2, "Super large": 3}, selected="Small")
integer = Integer(map_size)
map_size_2 = GetInteger(integer, AtLeast=1, AtMost=1, Maximum=2147483647, Minimum=-2147483648, TreeAccess=False)
integer_2 = Integer(map_size_2)

# ----
# Description: This app will help you to evaluate how close do you live to certain amenities like parks, playgrounds etc. ...
# 
# To get started go to www.openstreetmap.org, zoom the location that you want to evaluate, right clik on the map, and choose "show adress". From the left sidebar copy the geogrphical coordinates and past them ...
title = Panel("Evaluate your city")
box_size = Panel("0.010")
box_size_2 = Panel("0.019")
box_size_3 = Panel("0.013")
box_size_4 = Panel("0.016")

warsaw = Panel("20.99155")
warsaw_2 = Panel("52.23955")

barcelona = Panel("2.15728")
barcelona_2 = Panel("41.39233")

paris = Panel("2.34712")
paris_2 = Panel("48.89072")

london = Panel("-0.09304")
london_2 = Panel("51.48972")

vienna = Panel("16.40139")
vienna_2 = Panel("48.19906")

kopenhagen = Panel("12.54772")
kopenhagen_2 = Panel("55.67762")

stream_filter = StreamFilter(Gate=integer_2, Stream0=box_size, Stream1=box_size_3, Stream2=box_size_4, Stream3=box_size_2)

number = Number(warsaw)
location_w_e = GetNumber(number, AtLeast=1, AtMost=1, Maximum=1.797693135e+308, Minimum=-1.797693135e+308, TreeAccess=False)

number_2 = Number(warsaw_2)
location_n_s = GetNumber(number_2, AtLeast=1, AtMost=1, Maximum=1.797693135e+308, Minimum=-1.797693135e+308, TreeAccess=False)

division = Division(A=stream_filter, B=2)
division_2 = Division(A=division, B=1.5)

addition = Addition(A=location_n_s, B=division_2)
subtraction = Subtraction(A=location_n_s, B=division_2)
addition_2 = Addition(A=location_w_e, B=division)
subtraction_2 = Subtraction(A=location_w_e, B=division)

download_openstreetmap_osm = DownloadOpenStreetMapOSM(LeftBound=subtraction_2, RightBound=addition_2, TopBound=addition, BottomBound=subtraction, RunToggle=True)  # -> OSMQueryURL, OSMFilePath
panel = Panel(download_openstreetmap_osm.OSMQueryURL)

# ----
# OSM info: https://wiki.openstreetmap.org/wiki/Map_features
amenity = ValueList({"Parks": 0, "Playgrounds": 1, "Groceries": 2, "Restaurants": 3, "Public transport": 4, "Education": 5}, selected="Parks")
integer_3 = Integer(amenity)
amenity_2 = GetInteger(integer_3, AtLeast=1, AtMost=1, Maximum=2147483647, Minimum=-2147483648, TreeAccess=False)
integer_4 = Integer(amenity_2)

import_osm_features = ImportOSMFeatures(OSMPathOrURL=download_openstreetmap_osm.OSMQueryURL, OSMFeatureType="leisure", Format="xml", ImportAltitude=False)  # -> Points, Metadata, UTMZone, TranslationVector
point = Point(import_osm_features.Points)
lookup_metadata = LookupMetadata(MetadataGeometry=import_osm_features.Metadata, SearchKey="leisure")
list = ValueList({"playground"}, selected="playground")
polyline = PolyLine(Vertices=point, Closed=False)
tmatch = MatchText(Text=flatten(lookup_metadata), Pattern=graft(list), Case=True)
dispatch = Dispatch(List=flatten(import_osm_features.Metadata), DispatchPattern=tmatch)  # -> ListA, ListB
dispatch_2 = Dispatch(List=flatten(polyline), DispatchPattern=tmatch)  # -> ListA, ListB
panel_2 = Panel(tmatch)

import_osm_features_2 = ImportOSMFeatures(OSMPathOrURL=download_openstreetmap_osm.OSMQueryURL, OSMFeatureType="leisure", Format="xml", ImportAltitude=False)  # -> Points, Metadata, UTMZone, TranslationVector
point_2 = Point(import_osm_features_2.Points)
lookup_metadata_2 = LookupMetadata(MetadataGeometry=import_osm_features_2.Metadata, SearchKey="leisure")
list_2 = ValueList({"park"}, selected="park")
polyline_2 = PolyLine(Vertices=point_2, Closed=False)
tmatch_2 = MatchText(Text=flatten(lookup_metadata_2), Pattern=graft(list_2), Case=True)
dispatch_3 = Dispatch(List=flatten(import_osm_features_2.Metadata), DispatchPattern=tmatch_2)  # -> ListA, ListB
dispatch_4 = Dispatch(List=flatten(polyline_2), DispatchPattern=tmatch_2)  # -> ListA, ListB
panel_3 = Panel(tmatch_2)

import_osm_features_3 = ImportOSMFeatures(OSMPathOrURL=download_openstreetmap_osm.OSMQueryURL, OSMFeatureType="amenity", Format="xml", ImportAltitude=False)  # -> Points, Metadata, UTMZone, TranslationVector
lookup_metadata_3 = LookupMetadata(MetadataGeometry=import_osm_features_3.Metadata, SearchKey="amenity")
list_3 = ValueList({"kindergarten", "school", "university", "college"}, selected=["kindergarten", "school", "university", "college"])
point_3 = Point(import_osm_features_3.Points)
tmatch_3 = MatchText(Text=flatten(lookup_metadata_3), Pattern=graft(list_3), Case=True)
dispatch_5 = Dispatch(List=flatten(import_osm_features_3.Metadata), DispatchPattern=tmatch_3)  # -> ListA, ListB
dispatch_6 = Dispatch(List=flatten(point_3), DispatchPattern=tmatch_3)  # -> ListA, ListB
panel_4 = Panel(tmatch_3)

import_osm_features_4 = ImportOSMFeatures(OSMPathOrURL=download_openstreetmap_osm.OSMQueryURL, OSMFeatureType="shop", Format="xml", ImportAltitude=False)  # -> Points, Metadata, UTMZone, TranslationVector
lookup_metadata_4 = LookupMetadata(MetadataGeometry=import_osm_features_4.Metadata, SearchKey="shop")
list_4 = ValueList({"supermarket", "convenience"}, selected=["supermarket", "convenience"])
point_4 = Point(import_osm_features_4.Points)
tmatch_4 = MatchText(Text=flatten(lookup_metadata_4), Pattern=graft(list_4), Case=True)
dispatch_7 = Dispatch(List=flatten(import_osm_features_4.Metadata), DispatchPattern=tmatch_4)  # -> ListA, ListB
dispatch_8 = Dispatch(List=flatten(point_4), DispatchPattern=tmatch_4)  # -> ListA, ListB
panel_5 = Panel(tmatch_4)

import_osm_features_5 = ImportOSMFeatures(OSMPathOrURL=download_openstreetmap_osm.OSMQueryURL, OSMFeatureType="amenity", Format="xml", ImportAltitude=False)  # -> Points, Metadata, UTMZone, TranslationVector
lookup_metadata_5 = LookupMetadata(MetadataGeometry=import_osm_features_5.Metadata, SearchKey="amenity")
list_5 = ValueList({"bar", "pub", "cafe", "restaurant"}, selected=["bar", "pub", "cafe", "restaurant"])
point_5 = Point(import_osm_features_5.Points)
tmatch_5 = MatchText(Text=flatten(lookup_metadata_5), Pattern=graft(list_5), Case=True)
dispatch_9 = Dispatch(List=flatten(import_osm_features_5.Metadata), DispatchPattern=tmatch_5)  # -> ListA, ListB
dispatch_10 = Dispatch(List=flatten(point_5), DispatchPattern=tmatch_5)  # -> ListA, ListB
panel_6 = Panel(tmatch_5)

import_osm_features_6 = ImportOSMFeatures(
    OSMPathOrURL=download_openstreetmap_osm.OSMQueryURL,
    OSMFeatureType="public_transport",
    Format="xml",
    ImportAltitude=False)  # -> Points, Metadata, UTMZone, TranslationVector
lookup_metadata_6 = LookupMetadata(MetadataGeometry=import_osm_features_6.Metadata, SearchKey="public_transport")
list_6 = ValueList({"stop_position"}, selected="stop_position")
point_6 = Point(import_osm_features_6.Points)
tmatch_6 = MatchText(Text=flatten(lookup_metadata_6), Pattern=graft(list_6), Case=True)
dispatch_11 = Dispatch(List=flatten(import_osm_features_6.Metadata), DispatchPattern=tmatch_6)  # -> ListA, ListB
dispatch_12 = Dispatch(List=flatten(point_6), DispatchPattern=tmatch_6)  # -> ListA, ListB
panel_7 = Panel(tmatch_6)

import_osm_features_7 = ImportOSMFeatures(OSMPathOrURL=download_openstreetmap_osm.OSMQueryURL, OSMFeatureType="street", Format="xml", ImportAltitude=False)  # -> Points, Metadata, UTMZone, TranslationVector
point_7 = Point(import_osm_features_7.Points)
lookup_metadata_7 = LookupMetadata(MetadataGeometry=import_osm_features_7.Metadata, SearchKey="highway")
list_7 = ValueList({"footway", "bridleway", "steps", "corridor", "path", "sidewalk", "crossing", "pedestrian", "living street", "service", "residential"}, selected=["footway", "bridleway", "steps", "corridor", "path", "sidewalk", "crossing", "pedestrian", "living street", "service", "residential"])
polyline_3 = PolyLine(Vertices=point_7, Closed=False)
tmatch_7 = MatchText(Text=flatten(lookup_metadata_7), Pattern=graft(list_7), Case=True)
panel_8 = Panel(tmatch_7)
dispatch_13 = Dispatch(List=flatten(polyline_3), DispatchPattern=tmatch_7)  # -> ListA, ListB
crv = Curve(dispatch_13.ListA)

import_osm_features_8 = ImportOSMFeatures(OSMPathOrURL=download_openstreetmap_osm.OSMQueryURL, OSMFeatureType="street", Format="xml", ImportAltitude=False)  # -> Points, Metadata, UTMZone, TranslationVector
point_8 = Point(import_osm_features_8.Points)
lookup_metadata_8 = LookupMetadata(MetadataGeometry=import_osm_features_8.Metadata, SearchKey="highway")
list_8 = ValueList({"motorway", "trunk", "primary", "secondary", "tertiary", "unclassified", "service", "residential"}, selected=["motorway", "trunk", "primary", "secondary", "tertiary", "unclassified", "service", "residential"])
polyline_4 = PolyLine(Vertices=point_8, Closed=False)
tmatch_8 = MatchText(Text=flatten(lookup_metadata_8), Pattern=graft(list_8), Case=True)
panel_9 = Panel(tmatch_8)
dispatch_14 = Dispatch(List=flatten(polyline_4), DispatchPattern=tmatch_8)  # -> ListA, ListB
crv_2 = Curve(dispatch_14.ListA)

import_osm_features_9 = ImportOSMFeatures(OSMPathOrURL=download_openstreetmap_osm.OSMQueryURL, OSMFeatureType="building", Format="xml", ImportAltitude=False)  # -> Points, Metadata, UTMZone, TranslationVector
point_9 = Point(import_osm_features_9.Points)
polyline_5 = PolyLine(Vertices=point_9, Closed=False)
lookup_metadata_9 = LookupMetadata(MetadataGeometry=import_osm_features_9.Metadata, SearchKey="height")
create_building = CreateBuilding(BuildingCurve=polyline_5, Metadata=import_osm_features_9.Metadata)
panel_10 = Panel(lookup_metadata_9)

stream_filter_2 = StreamFilter(
    Gate=integer_4,
    Stream0=dispatch_3.ListA,
    Stream1=dispatch.ListA,
    Stream2=dispatch_7.ListA,
    Stream3=dispatch_9.ListA,
    Stream4=dispatch_11.ListA,
    Stream5=dispatch_5.ListA)
clean_tree = CleanTree(RemoveNulls=True, RemoveInvalid=True, RemoveEmpty=invert(False), Tree=stream_filter_2)
flatten_tree = FlattenTree(Tree=clean_tree, Path="{0}")

larger_than = LargerThan(FirstNumber=integer_4, SecondNumber=2)  # -> LargerThan, OrEqualTo
stream_filter_3 = StreamFilter(
    Gate=integer_4,
    Stream0=dispatch_4.ListA,
    Stream1=dispatch_2.ListA,
    Stream2=dispatch_8.ListA,
    Stream3=dispatch_10.ListA,
    Stream4=dispatch_12.ListA,
    Stream5=dispatch_6.ListA)
dispatch_15 = Dispatch(List=stream_filter_3, DispatchPattern=larger_than.LargerThan)  # -> ListA, ListB
clean_tree_2 = CleanTree(RemoveNulls=True, RemoveInvalid=True, RemoveEmpty=invert(False), Tree=dispatch_15.ListA)
clean_tree_3 = CleanTree(RemoveNulls=True, RemoveInvalid=True, RemoveEmpty=invert(False), Tree=dispatch_15.ListB)
flatten_tree_2 = FlattenTree(Tree=clean_tree_2, Path="{0}")
flatten_tree_3 = FlattenTree(Tree=clean_tree_3, Path="{0}")

unit_z = UnitZ(Factor=0.1)
curve = Curve(flatten(flatten_tree_3))
extrude = Extrude(Base=curve, Direction=unit_z)
clean_tree_4 = CleanTree(RemoveNulls=True, RemoveInvalid=True, RemoveEmpty=invert(False), Tree=extrude)

deconstruct_metadata = DeconstructMetadata(Metadata=flatten_tree)  # -> Keys, Values
panel_11 = Panel(deconstruct_metadata.Keys)
panel_12 = Panel(deconstruct_metadata.Values)
cull_index = CullIndex(List=panel_11, Indices=0, Wrap=True)
cull_index_2 = CullIndex(List=panel_12, Indices=0, Wrap=True)
concatenate = Concatenate(Fragment_A=cull_index, A=" : ", Fragment_B=cull_index_2)
panel_13 = Panel(concatenate)
text_join = TextJoin(Text=panel_13)  # -> flatten(Result)
panel_14 = Panel(text_join)

# ----
# It's ok, if it fails to collect data
cap_holes = CapHoles(Brep=clean_tree_4)
mesh_brep = MeshBrep(
    Brep=cap_holes,
    Settings={GridMaxCount=0, GridMinCount=16, JaggedSeams=False, MaxEdgeLength=0, MinEdgeLength=0.0001, MinTolerance=0, Refine=True, RefineAngle=0, RelativeTolerance=0.65, SimplePlanes=True, Tolerance=0})
mesh_sphere = MeshSphere(Base=flatten(flatten_tree_2), Radius="8", UCount=10, VCount=20)
merge = Merge(Data1=flatten(mesh_brep), Data2=flatten(mesh_sphere))

c_script = CSharpScript()  # -> fonts
# ---------- c_script: C# ----------
    fonts = Rhino.DocObjects.Font.AvailableFontFaceNames();
# ---------- end c_script ----------
item = ListItem(List=c_script, Index=Slider(45, range=0..423), Wrap=True)

integer_5 = Integer(Slider(250, range=100..500))
data_radius = GetInteger(integer_5, AtLeast=1, AtMost=1, Maximum=2147483647, Minimum=-2147483648, TreeAccess=False)
integer_6 = Integer(data_radius)

_3d_inside = GetBoolean(Toggle(True), AtLeast=1, AtMost=1, FalseValue="False", TreeAccess=False, TrueValue="True")
boolean = Boolean(_3d_inside)

merge_2 = Merge(Data1=flatten_tree_3, Data2=flatten_tree_2)
bounding_box = BoundingBox(Content=flatten(merge_2), Plane=PlaneXY(0, 0, 0), UnionBox=True)  # -> Box, Box_2
bounding_box_2 = BoundingBox(Content=flatten(create_building), Plane=PlaneXY(0, 0, 0), UnionBox=True)  # -> Box, Box_2
bounding_box_3 = BoundingBox(Content=flatten([bounding_box_2.Box, bounding_box.Box]), Plane=PlaneXY(0, 0, 0), UnionBox=True)  # -> Box, Box_2
deconstruct_brep = DeconstructBrep(Brep=bounding_box_3.Box)  # -> Faces, Edges, Vertices
surface = Surface(deconstruct_brep.Faces)
area = Area(Geometry=surface)  # -> Area, Centroid
unit_z_2 = UnitZ(Factor="50")
scale = Scale(Geometry=surface, Center=area.Centroid, Factor="1.1")  # -> Geometry, Transform
negative = Negative(Value=unit_z_2)
extrude_2 = Extrude(Base=scale.Geometry, Direction=negative)
brep = Brep(extrude_2)
curve_2 = Curve(flatten(crv_2))
curve_3 = Curve(flatten(crv))
trim_with_breps = TrimWithBreps(Curve=curve_3, Brep=brep)  # -> Inside, Outside
trim_with_breps_2 = TrimWithBreps(Curve=curve_2, Brep=brep)  # -> Inside, Outside

area_2 = Area(Geometry=scale.Geometry)  # -> Area, Centroid
m2 = Panel(area_2.Area)
number_3 = Number(expr("Round(x,2)", m2))
multiplication = Multiplication(A=number_3, B="0.000001")

deconstruct_brep_2 = DeconstructBrep(Brep=scale.Geometry)  # -> Faces, Edges, Vertices
division_3 = Division(A=negative, B=2)
curve_4 = Curve(deconstruct_brep_2.Edges)
move = Move(Geometry=curve_4, Motion=division_3)  # -> Geometry, Transform
offset_curve = OffsetCurve(Curve=move.Geometry, Distance=Slider(50, range=0..100), Corners=1)  # -> flatten(Curve)
end_points = EndPoints(Curve=move.Geometry)  # -> Start, End
end_points_2 = EndPoints(Curve=offset_curve)  # -> Start, End
line = Line(StartPoint=end_points.Start, EndPoint=end_points_2.Start)
line_2 = Line(StartPoint=end_points.End, EndPoint=end_points_2.End)
end_points_3 = EndPoints(Curve=line)  # -> Start, End
end_points_4 = EndPoints(Curve=line_2)  # -> Start, End
scale_2 = Scale(Geometry=line, Center=end_points_3.End, Factor="0.3")  # -> Geometry, Transform
scale_3 = Scale(Geometry=line_2, Center=end_points_4.End, Factor="0.3")  # -> Geometry, Transform
vector = Vector(scale_2.Geometry)
vector_2 = Vector(scale_3.Geometry)
move_2 = Move(Geometry=scale_2.Geometry, Motion=vector)  # -> Geometry, Transform
move_3 = Move(Geometry=scale_3.Geometry, Motion=vector_2)  # -> Geometry, Transform
join_curves = JoinCurves(Curves=[scale_2.Geometry, move_2.Geometry], Preserve=False)
join_curves_2 = JoinCurves(Curves=[scale_3.Geometry, move_3.Geometry], Preserve=False)

volume = Volume(Geometry=brep)  # -> Volume, Centroid
orient = Orient(Geometry=brep, Source=volume.Centroid, Target="0,0,0")  # -> Geometry, Transform
volume_2 = Volume(Geometry=orient.Geometry)  # -> Volume, Centroid
vector_2pt = Vector2Pt(PointA=volume.Centroid, PointB=volume_2.Centroid, Unitize=False)  # -> Vector, Length

simple_mesh = SimpleMesh(Brep=orient.Geometry)
deconstruct_mesh = DeconstructMesh(Mesh=flatten(simple_mesh))  # -> Vertices, Faces, Colours, Normals

length = Length(Curve=move.Geometry)
concatenate_2 = Concatenate(FragmentA=length, FragmentB=" m")

number_4 = Number(expr("Round(x,2)", multiplication))
context_print = ContextPrint(Text=number_4)

clean_tree_5 = CleanTree(RemoveNulls=True, RemoveInvalid=True, RemoveEmpty=invert(False), Tree=merge)
move_4 = Move(Geometry=clean_tree_5, Motion=vector_2pt.Vector)  # -> Geometry, Transform
mesh = Mesh(move_4.Geometry)
deconstruct_mesh_2 = DeconstructMesh(Mesh=flatten(mesh))  # -> Vertices, Faces, Colours, Normals

panel_15 = Panel(item)
c_script_2 = CSharpScript(face=panel_15, bold=Toggle(False), italics=Toggle(False), size=Slider(10, range=1..20), content=concatenate_2)  # -> out, A; inputs face: String, bold: Boolean, italics: Boolean, size: Double, content: String
# ---------- c_script_2: C# ----------
    if(content != null && content != String.Empty
    && face != null && face != String.Empty ){

      if(size == 0)
        size = 5;

      Rhino.DocObjects.Font.FontStyle fontStyle = Rhino.DocObjects.Font.FontStyle.Upright;
      if (italics) fontStyle = Rhino.DocObjects.Font.FontStyle.Italic;
      Rhino.DocObjects.Font.FontWeight fontWeight = Rhino.DocObjects.Font.FontWeight.Normal;
      if (bold) fontWeight = Rhino.DocObjects.Font.FontWeight.Bold;

      bool underlined = false;
      bool strikethrough = false;

      Rhino.DocObjects.Font font = new Rhino.DocObjects.Font(face, fontWeight, fontStyle, underlined, strikethrough);


      TextEntity text_entity = new TextEntity
        {
          Plane = Plane.WorldXY,
          PlainText = content,
          Justification = TextJustification.MiddleCenter,
          Font = font
          };
      Rhino.DocObjects.DimensionStyle dimstyle = new Rhino.DocObjects.DimensionStyle();
      dimstyle.TextHeight = size;
      double smallCapsScale = 1;
      double spacing = 0;
      A = text_entity.CreateSurfaces(dimstyle, smallCapsScale, spacing);



    } else {

      Print("Some content is required.");

    }
# ---------- end c_script_2 ----------
mesh_2 = Mesh(c_script_2.A)
mesh_join = MeshJoin(Meshes=mesh_2)  # -> flatten(Mesh)

km2 = Panel(number_4)

brep_2 = Brep(orient.Geometry)
deconstruct_brep_3 = DeconstructBrep(Brep=brep_2)  # -> Faces, Edges, Vertices
area_3 = Area(Geometry=brep_2)  # -> Area, Centroid
unit_z_3 = UnitZ(Factor=1)
list_item = ListItem(List=deconstruct_brep_3.Faces, Index=0, Wrap=True)
project_point = ProjectPoint(Point=area_3.Centroid, Direction=unit_z_3, Geometry=list_item)  # -> Point, Index

construct_mesh = ConstructMesh(Vertices=deconstruct_mesh.Vertices, Faces=deconstruct_mesh.Faces, Colours=ColourSwatch(SwatchColor=RGB(204, 204, 204)))
context_bake = ContextBake(Geometry=construct_mesh)

list_length = ListLength(List=mesh)
context_print_2 = ContextPrint(AmenitiesNumber=list_length)

division_4 = Division(A=1, B=number_4)
multiplication_2 = Multiplication(A=division_4, B=list_length)

number_5 = Number(expr("Round(x,2)", multiplication_2))
context_print_3 = ContextPrint(AmenitiesPerArea=number_5)

panel_16 = Panel(number_5)

stream_filter_4 = StreamFilter(
    Gate=integer_4,
    Stream0=ColourSwatch(SwatchColor=RGB(125, 194, 64)),
    Stream1=ColourSwatch(SwatchColor=RGB(212, 87, 174)),
    Stream2=ColourSwatch(SwatchColor=RGB(194, 64, 64)),
    Stream3=ColourSwatch(SwatchColor=RGB(219, 196, 64)),
    Stream4=ColourSwatch(SwatchColor=RGB(47, 222, 219)),
    Stream5=ColourSwatch(SwatchColor=RGB(161, 92, 214)))
construct_mesh_2 = ConstructMesh(Vertices=deconstruct_mesh_2.Vertices, Faces=deconstruct_mesh_2.Faces, Colours=stream_filter_4)  # -> flatten(Mesh)
context_bake_2 = ContextBake(Amenities=construct_mesh_2)

bounding_box_4 = BoundingBox(Content=mesh_join, Plane=PlaneXY(0, 0, 0))  # -> Box, Box_2
curve_middle = CurveMiddle(Curve=offset_curve)
volume_3 = Volume(Geometry=bounding_box_4.Box)  # -> Volume, Centroid
orient_2 = Orient(Geometry=mesh_join, Source=volume_3.Centroid, Target=curve_middle)  # -> Geometry, Transform
series = Series(Start=0, Step=90, Count=4)
rotate = Rotate(Geometry=orient_2.Geometry, Angle=degrees(series), Plane=curve_middle)  # -> Geometry, Transform
unit_z_4 = UnitZ(Factor=5)
move_5 = Move(Geometry=rotate.Geometry, Motion=unit_z_4)  # -> Geometry, Transform
move_6 = Move(Geometry=move_5.Geometry, Motion=vector_2pt.Vector)  # -> Geometry, Transform
deconstruct_mesh_3 = DeconstructMesh(Mesh=flatten(move_6.Geometry))  # -> Vertices, Faces, Colours, Normals

inspect_building = InspectBuilding(Building=create_building, DefaultHeight="12")  # -> Geometry, Metadata, Amenity, BuildingMesh
mesh_3 = Mesh(flatten(inspect_building.BuildingMesh))
curve_5 = Curve(flatten(inspect_building.Geometry))
clean_tree_6 = CleanTree(RemoveNulls=True, RemoveInvalid=True, RemoveEmpty=invert(False), Tree=mesh_3)
clean_tree_7 = CleanTree(RemoveNulls=True, RemoveInvalid=True, RemoveEmpty=invert(False), Tree=curve_5)
move_7 = Move(Geometry=clean_tree_7, Motion=vector_2pt.Vector)  # -> Geometry, Transform
move_8 = Move(Geometry=clean_tree_6, Motion=vector_2pt.Vector)  # -> Geometry, Transform

move_9 = Move(Geometry=trim_with_breps_2.Inside, Motion=vector_2pt.Vector)  # -> Geometry, Transform
curve_6 = Curve(flatten(move_9.Geometry))
colour_swatch = ColourSwatch(SwatchColor=RGB(59, 59, 59))
preview = CustomPreview(Geometry=curve_6, Material=colour_swatch)
clean_tree_8 = CleanTree(RemoveNulls=True, RemoveInvalid=True, RemoveEmpty=invert(False), Tree=curve_6)

move_10 = Move(Geometry=trim_with_breps.Inside, Motion=vector_2pt.Vector)  # -> Geometry, Transform
colour_swatch_2 = ColourSwatch(SwatchColor=RGB(115, 115, 115))
curve_7 = Curve(flatten(move_10.Geometry))
uservalue = Text(colour_swatch_2)
userkey = Text("color")
preview_2 = CustomPreview(Geometry=curve_7, Material=colour_swatch_2)
clean_tree_9 = CleanTree(RemoveNulls=True, RemoveInvalid=True, RemoveEmpty=invert(False), Tree=curve_7)

inputpoint = GetPoint(project_point.Point, AtLeast=1, AtMost=1, Realtime=True, TreeAccess=False)

uservalue_2 = Text(colour_swatch)
userkey_2 = Text("color")

move_11 = Move(Geometry=[offset_curve, join_curves, join_curves_2], Motion=vector_2pt.Vector)  # -> Geometry, Transform
curve_8 = Curve(move_11.Geometry)
colour_swatch_3 = ColourSwatch(SwatchColor=RGB(0, 0, 0))
preview_3 = CustomPreview(Geometry=curve_8, Material=colour_swatch_3)

circle = Circle(Plane=inputpoint, Radius=integer_6)
unit_z_5 = UnitZ(Factor=50)
unit_z_6 = UnitZ(Factor=-50)
extrude_3 = Extrude(Base=circle, Direction=[unit_z_5, unit_z_6])
brep_join = BrepJoin(Breps=extrude_3)  # -> Breps, Closed
cap_holes_2 = CapHoles(Brep=brep_join.Breps)

c_script_3 = CSharpScript(geometry=clean_tree_9, userKey=userkey, userValue=uservalue)  # -> out, geoWithUserString; inputs geometry: GeometryBase, userKey: String, userValue: String
# ---------- c_script_3: C# ----------
    geometry.SetUserString(userKey, userValue);
   geoWithUserString = geometry;
# ---------- end c_script_3 ----------
context_bake_3 = ContextBake(Sidewalks=c_script_3.geoWithUserString)

c_script_4 = CSharpScript(geometry=clean_tree_8, userKey=userkey_2, userValue=uservalue_2)  # -> out, geoWithUserString; inputs geometry: GeometryBase, userKey: String, userValue: String
# ---------- c_script_4: C# ----------
    geometry.SetUserString(userKey, userValue);
    geoWithUserString = geometry;
# ---------- end c_script_4 ----------
context_bake_4 = ContextBake(Geometry=c_script_4.geoWithUserString)

pipe = Pipe(Curve=circle, Radius=1.2, Caps=0)
mesh_brep_2 = MeshBrep(
    Brep=pipe,
    Settings={GridMaxCount=0, GridMinCount=16, JaggedSeams=False, MaxEdgeLength=0, MinEdgeLength=0.0001, MinTolerance=0, Refine=True, RefineAngle=0, RelativeTolerance=0.65, SimplePlanes=True, Tolerance=0})
deconstruct_mesh_4 = DeconstructMesh(Mesh=flatten(mesh_brep_2))  # -> Vertices, Faces, Colours, Normals

area_4 = Area(Geometry=move_7.Geometry)  # -> Area, Centroid
point_in_brep = PointInBrep(Brep=cap_holes_2, Point=area_4.Centroid, Strict=False)
dispatch_16 = Dispatch(List=move_8.Geometry, DispatchPattern=point_in_brep)  # -> ListA, ListB
dispatch_17 = Dispatch(List=move_7.Geometry, DispatchPattern=point_in_brep)  # -> ListA, ListB
mesh_4 = Mesh(dispatch_16.ListB)
curve_9 = Curve(dispatch_17.ListA)
mesh_5 = Mesh(dispatch_16.ListA)
curve_10 = Curve(dispatch_17.ListB)

uservalue_3 = Text(colour_swatch_3)
userkey_3 = Text("color")

c_script_5 = CSharpScript(geometry=curve_8, userKey=userkey_3, userValue=uservalue_3)  # -> out, geoWithUserString; inputs geometry: GeometryBase, userKey: String, userValue: String; same code as c_script_3
context_bake_5 = ContextBake(Geometry=c_script_5.geoWithUserString)

volume_4 = Volume(Geometry=construct_mesh_2)  # -> Volume, Centroid
text_tag = TextTag(Location=volume_4.Centroid, Text=panel_14)

construct_mesh_3 = ConstructMesh(Vertices=deconstruct_mesh_4.Vertices, Faces=deconstruct_mesh_4.Faces, Colours=ColourSwatch(SwatchColor=RGB(0, 0, 0)))  # -> flatten(Mesh)
context_bake_6 = ContextBake(Geometry=construct_mesh_3)

point_in_brep_2 = PointInBrep(Brep=cap_holes_2, Point=volume_4.Centroid, Strict=False)
dispatch_18 = Dispatch(List=panel_14, DispatchPattern=point_in_brep_2)  # -> ListA, ListB
data = Data(dispatch_18.ListA)

construct_mesh_4 = ConstructMesh(Vertices=deconstruct_mesh_3.Vertices, Faces=deconstruct_mesh_3.Faces, Colours=ColourSwatch(SwatchColor=RGB(59, 59, 59)))  # -> flatten(Mesh)
context_bake_7 = ContextBake(Geometry=construct_mesh_4)

unit_z_7 = UnitZ(Factor=0.1)
surface_2 = Surface(curve_10)
extrude_4 = Extrude(Base=surface_2, Direction=unit_z_7)
mesh_brep_3 = MeshBrep(
    Brep=extrude_4,
    Settings={GridMaxCount=0, GridMinCount=16, JaggedSeams=False, MaxEdgeLength=0, MinEdgeLength=0.0001, MinTolerance=0, Refine=True, RefineAngle=0, RelativeTolerance=0.65, SimplePlanes=True, Tolerance=0})

unit_z_8 = UnitZ(Factor=0.1)
surface_3 = Surface(curve_9)
extrude_5 = Extrude(Base=surface_3, Direction=unit_z_8)
mesh_brep_4 = MeshBrep(
    Brep=extrude_5,
    Settings={GridMaxCount=0, GridMinCount=16, JaggedSeams=False, MaxEdgeLength=0, MinEdgeLength=0.0001, MinTolerance=0, Refine=True, RefineAngle=0, RelativeTolerance=0.65, SimplePlanes=True, Tolerance=0})

dispatch_19 = Dispatch(List=volume_4.Centroid, DispatchPattern=point_in_brep_2)  # -> ListA, ListB
deconstruct = Deconstruct(Point=dispatch_19.ListA)  # -> XComponent, YComponent, ZComponent

amenitiesmetadata = ContextPrint(AmenitiesMetadata=data)
amenitiesmetadata_2 = ContextPrint(AmenitiesLocationX=deconstruct.XComponent)
amenitiesmetadata_3 = ContextPrint(AmenitiesLocationY=deconstruct.YComponent)
amenitiesmetadata_4 = ContextPrint(AmenitiesLocationZ=deconstruct.ZComponent)

mesh_join_2 = MeshJoin(Meshes=[mesh_5, mesh_brep_3])
mesh_join_3 = MeshJoin(Meshes=[mesh_brep_4, mesh_4])

stream_filter_5 = StreamFilter(Gate=boolean, Stream0=mesh_join_3, Stream1=mesh_join_2)
deconstruct_mesh_5 = DeconstructMesh(Mesh=flatten(stream_filter_5))  # -> Vertices, Faces, Colours, Normals

construct_mesh_5 = ConstructMesh(
    Vertices=deconstruct_mesh_5.Vertices,
    Faces=deconstruct_mesh_5.Faces,
    Colours=ColourSwatch(SwatchColor=RGB(255, 255, 255)))  # -> flatten(Mesh)
context_bake_8 = ContextBake(BuildingsGeo=construct_mesh_5)
