# Grasshopper definition EvaluateYourCity5.gh (Grasshopper 1.0.7)
# plug-ins: Urbano

london = Panel("-0.09304")
london_2 = Panel("51.48972")

vienna = Panel("16.40139")
vienna_2 = Panel("48.19906")

kopenhagen = Panel("12.54772")
kopenhagen_2 = Panel("55.67762")

map_size = ValueList({"Small": 0, "Medium": 1, "Large": 2}, selected="Small")
integer = Integer(map_size)
map_size_2 = GetInteger(integer, AtLeast=1, AtMost=1, Maximum=2147483647, Minimum=-2147483648, TreeAccess=False)
integer_2 = Integer(map_size_2)

warsaw = Panel("20.99155")
warsaw_2 = Panel("52.23955")

barcelona = Panel("2.15728")
barcelona_2 = Panel("41.39233")

paris = Panel("2.34712")
paris_2 = Panel("48.89072")

number = Number(warsaw)
location_w_e = GetNumber(number, AtLeast=1, AtMost=1, Maximum=1.797693135e+308, Minimum=-1.797693135e+308, TreeAccess=False)

number_2 = Number(warsaw_2)
location_n_s = GetNumber(number_2, AtLeast=1, AtMost=1, Maximum=1.797693135e+308, Minimum=-1.797693135e+308, TreeAccess=False)

box_size = Panel("0.008")
box_size_2 = Panel("0.009")
box_size_3 = Panel("0.010")

division = Division(A=box_size_3, B=2)
division_2 = Division(A=division, B=1.5)
addition = Addition(A=location_n_s, B=division_2)
subtraction = Subtraction(A=location_n_s, B=division_2)
addition_2 = Addition(A=location_w_e, B=division)
subtraction_2 = Subtraction(A=location_w_e, B=division)
text_join = TextJoin(Text=[subtraction_2, subtraction, addition_2, addition], Join=",")
data = Data(text_join)
bbox_left_bottom_right_top = Panel(data)
data_2 = Data(bbox_left_bottom_right_top)

amenity = ValueList({"Parks": 0, "Playgrounds": 1, "Groceries": 2, "Restaurants": 3, "Public transport": 4, "Education": 5}, selected="Playgrounds")
integer_3 = Integer(amenity)
amenity_2 = GetInteger(integer_3, AtLeast=1, AtMost=1, Maximum=2147483647, Minimum=-2147483648, TreeAccess=False)
integer_4 = Integer(amenity_2)

division_3 = Division(A=box_size_3, B=2)
division_4 = Division(A=division_3, B=1.5)
addition_3 = Addition(A=location_n_s, B=division_4)
subtraction_3 = Subtraction(A=location_n_s, B=division_4)
addition_4 = Addition(A=location_w_e, B=division_3)
subtraction_4 = Subtraction(A=location_w_e, B=division_3)
text_join_2 = TextJoin(Text=[subtraction_4, subtraction_3, addition_4, addition_3], Join=",")
data_3 = Data(text_join_2)
bbox_left_bottom_right_top_2 = Panel(data_3)
data_4 = Data(bbox_left_bottom_right_top_2)

division_5 = Division(A=box_size_3, B=2)
division_6 = Division(A=division_5, B=1.5)
addition_5 = Addition(A=location_n_s, B=division_6)
subtraction_5 = Subtraction(A=location_n_s, B=division_6)
addition_6 = Addition(A=location_w_e, B=division_5)
subtraction_6 = Subtraction(A=location_w_e, B=division_5)
text_join_3 = TextJoin(Text=[subtraction_6, subtraction_5, addition_6, addition_5], Join=",")
data_5 = Data(text_join_3)
bbox_left_bottom_right_top_3 = Panel(data_5)
data_6 = Data(bbox_left_bottom_right_top_3)

panel = Panel("""service
residential""")
panel_2 = Panel("""motorway
trunk
primary
secondary
tertiary
unclassified""")
panel_3 = Panel("""footway
bridleway
steps
corridor
path
sidewalk
crossing
pedestrian
living street""")
get_data_from_osm = GetDataFromOSM(T=data_2, txt="highway", txt_2=panel)  # -> out_2, in_2, feat_2
get_data_from_osm_2 = GetDataFromOSM(T=data_2, txt="highway", txt_2=[panel_3, panel])  # -> out_2, in_2, feat_2

panel_4 = Panel("""service
residential""")
panel_6 = Panel("""footway
bridleway
steps
corridor
path
sidewalk
crossing
pedestrian
living street""")
get_data_from_osm_3 = GetDataFromOSM(T=data_4, txt="highway", txt_2=panel_4)  # -> out_2, in_2, feat_2
get_data_from_osm_4 = GetDataFromOSM(T=data_4, txt="highway", txt_2=[panel_6, panel_4])  # -> out_2, in_2, feat_2

panel_7 = Panel("""service
residential""")
panel_9 = Panel("""footway
bridleway
steps
corridor
path
sidewalk
crossing
pedestrian
living street""")
get_data_from_osm_5 = GetDataFromOSM(T=data_6, txt="highway", txt_2=panel_7)  # -> out_2, in_2, feat_2
get_data_from_osm_6 = GetDataFromOSM(T=data_6, txt="highway", txt_2=[panel_9, panel_7])  # -> out_2, in_2, feat_2

get_data_from_osm_7 = GetDataFromOSM(T=data_2, txt="building")  # -> out_2, in_2, feat_2

panel_10 = Panel("""kindergarten
school
university
college""")
panel_11 = Panel("""supermarket
convenience""")
panel_12 = Panel("""bar
pub
cafe
restaurant""")
get_data_from_osm_8 = GetDataFromOSM(T=data_2, txt="leisure", txt_2="playground")  # -> out_2, in_2, feat_2
get_data_from_osm_9 = GetDataFromOSM(T=data_2, txt="amenity", txt_2=panel_10)  # -> out_2, in_2, feat_2
get_data_from_osm_10 = GetDataFromOSM(T=data_2, txt="leisure", txt_2="park")  # -> out_2, in_2, feat_2
get_data_from_osm_11 = GetDataFromOSM(T=data_2, txt="shop", txt_2=panel_11)  # -> out_2, in_2, feat_2
get_data_from_osm_12 = GetDataFromOSM(T=data_2, txt="public_transport", txt_2="stop_position")  # -> out_2, in_2, feat_2
get_data_from_osm_13 = GetDataFromOSM(T=data_2, txt="amenity", txt_2=panel_12)  # -> out_2, in_2, feat_2
stream_filter = StreamFilter(
    Gate=integer_4,
    Stream0=get_data_from_osm_10.in_2,
    Stream1=get_data_from_osm_8.in_2,
    Stream2=get_data_from_osm_11.in_2,
    Stream3=get_data_from_osm_13.in_2,
    Stream4=get_data_from_osm_12.in_2,
    Stream5=get_data_from_osm_9.in_2)
stream_filter_2 = StreamFilter(
    Gate=integer_4,
    Stream0=get_data_from_osm_10.feat_2,
    Stream1=get_data_from_osm_8.feat_2,
    Stream2=get_data_from_osm_11.feat_2,
    Stream3=get_data_from_osm_13.feat_2,
    Stream4=get_data_from_osm_12.feat_2,
    Stream5=get_data_from_osm_9.feat_2)

get_data_from_osm_14 = GetDataFromOSM(T=data_4, txt="building")  # -> out_2, in_2, feat_2

panel_13 = Panel("""kindergarten
school
university
college""")
panel_14 = Panel("""supermarket
convenience""")
panel_15 = Panel("""bar
pub
cafe
restaurant""")
get_data_from_osm_15 = GetDataFromOSM(T=data_4, txt="leisure", txt_2="playground")  # -> out_2, in_2, feat_2
get_data_from_osm_16 = GetDataFromOSM(T=data_4, txt="amenity", txt_2=panel_13)  # -> out_2, in_2, feat_2
get_data_from_osm_17 = GetDataFromOSM(T=data_4, txt="leisure", txt_2="park")  # -> out_2, in_2, feat_2
get_data_from_osm_18 = GetDataFromOSM(T=data_4, txt="shop", txt_2=panel_14)  # -> out_2, in_2, feat_2
get_data_from_osm_19 = GetDataFromOSM(T=data_4, txt="public_transport", txt_2="stop_position")  # -> out_2, in_2, feat_2
get_data_from_osm_20 = GetDataFromOSM(T=data_4, txt="amenity", txt_2=panel_15)  # -> out_2, in_2, feat_2
stream_filter_3 = StreamFilter(
    Gate=integer_4,
    Stream0=get_data_from_osm_17.in_2,
    Stream1=get_data_from_osm_15.in_2,
    Stream2=get_data_from_osm_18.in_2,
    Stream3=get_data_from_osm_20.in_2,
    Stream4=get_data_from_osm_19.in_2,
    Stream5=get_data_from_osm_16.in_2)
stream_filter_4 = StreamFilter(
    Gate=integer_4,
    Stream0=get_data_from_osm_17.feat_2,
    Stream1=get_data_from_osm_15.feat_2,
    Stream2=get_data_from_osm_18.feat_2,
    Stream3=get_data_from_osm_20.feat_2,
    Stream4=get_data_from_osm_19.feat_2,
    Stream5=get_data_from_osm_16.feat_2)

get_data_from_osm_21 = GetDataFromOSM(T=data_6, txt="building")  # -> out_2, in_2, feat_2

panel_16 = Panel("""kindergarten
school
university
college""")
panel_17 = Panel("""supermarket
convenience""")
panel_18 = Panel("""bar
pub
cafe
restaurant""")
get_data_from_osm_22 = GetDataFromOSM(T=data_6, txt="leisure", txt_2="playground")  # -> out_2, in_2, feat_2
get_data_from_osm_23 = GetDataFromOSM(T=data_6, txt="amenity", txt_2=panel_16)  # -> out_2, in_2, feat_2
get_data_from_osm_24 = GetDataFromOSM(T=data_6, txt="leisure", txt_2="park")  # -> out_2, in_2, feat_2
get_data_from_osm_25 = GetDataFromOSM(T=data_6, txt="shop", txt_2=panel_17)  # -> out_2, in_2, feat_2
get_data_from_osm_26 = GetDataFromOSM(T=data_6, txt="public_transport", txt_2="stop_position")  # -> out_2, in_2, feat_2
get_data_from_osm_27 = GetDataFromOSM(T=data_6, txt="amenity", txt_2=panel_18)  # -> out_2, in_2, feat_2
stream_filter_5 = StreamFilter(
    Gate=integer_4,
    Stream0=get_data_from_osm_24.in_2,
    Stream1=get_data_from_osm_22.in_2,
    Stream2=get_data_from_osm_25.in_2,
    Stream3=get_data_from_osm_27.in_2,
    Stream4=get_data_from_osm_26.in_2,
    Stream5=get_data_from_osm_23.in_2)
stream_filter_6 = StreamFilter(
    Gate=integer_4,
    Stream0=get_data_from_osm_24.feat_2,
    Stream1=get_data_from_osm_22.feat_2,
    Stream2=get_data_from_osm_25.feat_2,
    Stream3=get_data_from_osm_27.feat_2,
    Stream4=get_data_from_osm_26.feat_2,
    Stream5=get_data_from_osm_23.feat_2)

import_osm_features = ImportOSMFeatures(OSMPathOrURL=get_data_from_osm_7.in_2, OSMFeatureType=get_data_from_osm_7.feat_2, Format="xml", ImportAltitude=False)  # -> Points, Metadata, UTMZone, TranslationVector
point = Point(import_osm_features.Points)
polyline = PolyLine(Vertices=point, Closed=False)
lookup_metadata = LookupMetadata(MetadataGeometry=import_osm_features.Metadata, SearchKey="height")
create_building = CreateBuilding(BuildingCurve=polyline, Metadata=import_osm_features.Metadata)
panel_19 = Panel(lookup_metadata)

import_osm_features_2 = ImportOSMFeatures(OSMPathOrURL=get_data_from_osm_2.in_2, OSMFeatureType=get_data_from_osm_2.feat_2, Format="xml", ImportAltitude=False)  # -> Points, Metadata, UTMZone, TranslationVector
point_2 = Point(import_osm_features_2.Points)
polyline_2 = PolyLine(Vertices=point_2, Closed=False)

import_osm_features_3 = ImportOSMFeatures(OSMPathOrURL=get_data_from_osm.in_2, OSMFeatureType=get_data_from_osm.feat_2, Format="xml", ImportAltitude=False)  # -> Points, Metadata, UTMZone, TranslationVector
point_3 = Point(import_osm_features_3.Points)
polyline_3 = PolyLine(Vertices=point_3, Closed=False)

import_osm_features_4 = ImportOSMFeatures(OSMPathOrURL=get_data_from_osm_14.in_2, OSMFeatureType=get_data_from_osm_14.feat_2, Format="xml", ImportAltitude=False)  # -> Points, Metadata, UTMZone, TranslationVector
point_4 = Point(import_osm_features_4.Points)
polyline_4 = PolyLine(Vertices=point_4, Closed=False)
lookup_metadata_2 = LookupMetadata(MetadataGeometry=import_osm_features_4.Metadata, SearchKey="height")
create_building_2 = CreateBuilding(BuildingCurve=polyline_4, Metadata=import_osm_features_4.Metadata)
panel_20 = Panel(lookup_metadata_2)

import_osm_features_5 = ImportOSMFeatures(OSMPathOrURL=get_data_from_osm_21.in_2, OSMFeatureType=get_data_from_osm_21.feat_2, Format="xml", ImportAltitude=False)  # -> Points, Metadata, UTMZone, TranslationVector
point_5 = Point(import_osm_features_5.Points)
polyline_5 = PolyLine(Vertices=point_5, Closed=False)
lookup_metadata_3 = LookupMetadata(MetadataGeometry=import_osm_features_5.Metadata, SearchKey="height")
create_building_3 = CreateBuilding(BuildingCurve=polyline_5, Metadata=import_osm_features_5.Metadata)
panel_21 = Panel(lookup_metadata_3)

import_osm_features_6 = ImportOSMFeatures(OSMPathOrURL=get_data_from_osm_4.in_2, OSMFeatureType=get_data_from_osm_4.feat_2, Format="xml", ImportAltitude=False)  # -> Points, Metadata, UTMZone, TranslationVector
point_6 = Point(import_osm_features_6.Points)
polyline_6 = PolyLine(Vertices=point_6, Closed=False)

import_osm_features_7 = ImportOSMFeatures(OSMPathOrURL=get_data_from_osm_3.in_2, OSMFeatureType=get_data_from_osm_3.feat_2, Format="xml", ImportAltitude=False)  # -> Points, Metadata, UTMZone, TranslationVector
point_7 = Point(import_osm_features_7.Points)
polyline_7 = PolyLine(Vertices=point_7, Closed=False)

import_osm_features_8 = ImportOSMFeatures(OSMPathOrURL=get_data_from_osm_6.in_2, OSMFeatureType=get_data_from_osm_6.feat_2, Format="xml", ImportAltitude=False)  # -> Points, Metadata, UTMZone, TranslationVector
point_8 = Point(import_osm_features_8.Points)
polyline_8 = PolyLine(Vertices=point_8, Closed=False)

import_osm_features_9 = ImportOSMFeatures(OSMPathOrURL=get_data_from_osm_5.in_2, OSMFeatureType=get_data_from_osm_5.feat_2, Format="xml", ImportAltitude=False)  # -> Points, Metadata, UTMZone, TranslationVector
point_9 = Point(import_osm_features_9.Points)
polyline_9 = PolyLine(Vertices=point_9, Closed=False)

import_osm_features_10 = ImportOSMFeatures(OSMPathOrURL=stream_filter, OSMFeatureType=stream_filter_2, Format="xml", ImportAltitude=False)  # -> Points, Metadata, UTMZone, TranslationVector
point_10 = Point(import_osm_features_10.Points)
stream_gate = StreamGate(Stream=point_10, Gate=integer_4)  # -> Target0, Target1, Target2, Target3, Target4, Target5

import_osm_features_11 = ImportOSMFeatures(OSMPathOrURL=stream_filter_3, OSMFeatureType=stream_filter_4, Format="xml", ImportAltitude=False)  # -> Points, Metadata, UTMZone, TranslationVector
point_11 = Point(import_osm_features_11.Points)
stream_gate_2 = StreamGate(Stream=point_11, Gate=integer_4)  # -> Target0, Target1, Target2, Target3, Target4, Target5

import_osm_features_12 = ImportOSMFeatures(OSMPathOrURL=stream_filter_5, OSMFeatureType=stream_filter_6, Format="xml", ImportAltitude=False)  # -> Points, Metadata, UTMZone, TranslationVector
point_12 = Point(import_osm_features_12.Points)
stream_gate_3 = StreamGate(Stream=point_12, Gate=integer_4)  # -> Target0, Target1, Target2, Target3, Target4, Target5

# ----
# For the script to work on web all the maps have to be pre-calcuulated
stream_filter_7 = StreamFilter(
    Gate=integer_2,
    Stream0=import_osm_features_10.Metadata,
    Stream1=import_osm_features_11.Metadata,
    Stream2=import_osm_features_12.Metadata)
stream_filter_8 = StreamFilter(Gate=integer_2, Stream0=stream_gate.Target0, Stream1=stream_gate_2.Target0, Stream2=stream_gate_3.Target0)
stream_filter_9 = StreamFilter(Gate=integer_2, Stream0=stream_gate.Target1, Stream1=stream_gate_2.Target1, Stream2=stream_gate_3.Target1)
stream_filter_10 = StreamFilter(Gate=integer_2, Stream0=stream_gate.Target2, Stream1=stream_gate_2.Target2, Stream2=stream_gate_3.Target2)
stream_filter_11 = StreamFilter(Gate=integer_2, Stream0=stream_gate.Target3, Stream1=stream_gate_2.Target3, Stream2=stream_gate_3.Target3)
stream_filter_12 = StreamFilter(Gate=integer_2, Stream0=stream_gate.Target4, Stream1=stream_gate_2.Target4, Stream2=stream_gate_3.Target4)
stream_filter_13 = StreamFilter(Gate=integer_2, Stream0=stream_gate.Target5, Stream1=stream_gate_2.Target5, Stream2=stream_gate_3.Target5)
stream_filter_14 = StreamFilter(Gate=integer_2, Stream0=polyline_2, Stream1=polyline_6, Stream2=polyline_8)
stream_filter_15 = StreamFilter(Gate=integer_2, Stream0=polyline_3, Stream1=polyline_7, Stream2=polyline_9)
stream_filter_16 = StreamFilter(Gate=integer_2, Stream0=create_building, Stream1=create_building_2, Stream2=create_building_3)

deconstruct_metadata = DeconstructMetadata(Metadata=stream_filter_7)  # -> Keys, Values
panel_22 = Panel(deconstruct_metadata.Keys)
panel_23 = Panel(deconstruct_metadata.Values)
cull_index = CullIndex(List=panel_22, Indices=0, Wrap=True)
cull_index_2 = CullIndex(List=panel_23, Indices=0, Wrap=True)
concatenate = Concatenate(Fragment_A=cull_index, A=" : ", Fragment_B=cull_index_2)
panel_24 = Panel(concatenate)
text_join_4 = TextJoin(Text=panel_24)  # -> flatten(Result)
panel_25 = Panel(text_join_4)

polyline_10 = PolyLine(Vertices=[stream_filter_9, stream_filter_8], Closed=False)
unit_z = UnitZ(Factor=0.1)
curve = Curve(flatten(polyline_10))
extrude = Extrude(Base=curve, Direction=unit_z)
clean_tree = CleanTree(RemoveNulls=True, RemoveInvalid=True, RemoveEmpty=invert(False), Tree=extrude)

# ----
# It's ok, if it fails to collect data
merge = Merge(Data1=stream_filter_10, Data2=stream_filter_11, Data3=stream_filter_12, Data4=stream_filter_13)
cap_holes = CapHoles(Brep=clean_tree)
mesh_brep = MeshBrep(
    Brep=cap_holes,
    Settings={GridMaxCount=0, GridMinCount=16, JaggedSeams=False, MaxEdgeLength=0, MinEdgeLength=0.0001, MinTolerance=0, Refine=True, RefineAngle=0, RelativeTolerance=0.65, SimplePlanes=True, Tolerance=0})
mesh_sphere = MeshSphere(Base=flatten(merge), Radius="8", UCount=10, VCount=20)
merge_2 = Merge(Data1=flatten(mesh_brep), Data2=flatten(mesh_sphere))

c_script = CSharpScript()  # -> fonts
# ---------- c_script: C# ----------
    fonts = Rhino.DocObjects.Font.AvailableFontFaceNames();
# ---------- end c_script ----------
item = ListItem(List=c_script, Index=Slider(45, range=0..423), Wrap=True)

integer_5 = Integer(Slider(250, range=100..500))
data_radius = GetInteger(integer_5, AtLeast=1, AtMost=1, Maximum=2147483647, Minimum=-2147483648, TreeAccess=False)
integer_6 = Integer(data_radius)

_3d_inside = GetBoolean(Toggle(True), AtLeast=1, AtMost=1, FalseValue="False", TreeAccess=False, TrueValue="True")
boolean = Boolean(_3d_inside)

merge_3 = Merge(Data1=polyline_10, Data2=stream_filter_10, Data3=stream_filter_11, Data4=stream_filter_12, Data5=stream_filter_13)
bounding_box = BoundingBox(Content=flatten(merge_3), Plane=PlaneXY(0, 0, 0), UnionBox=True)  # -> Box, Box_2
bounding_box_2 = BoundingBox(Content=flatten(stream_filter_16), Plane=PlaneXY(0, 0, 0), UnionBox=True)  # -> Box, Box_2
bounding_box_3 = BoundingBox(Content=flatten([bounding_box_2.Box, bounding_box.Box]), Plane=PlaneXY(0, 0, 0), UnionBox=True)  # -> Box, Box_2
deconstruct_brep = DeconstructBrep(Brep=bounding_box_3.Box)  # -> Faces, Edges, Vertices
surface = Surface(deconstruct_brep.Faces)
area = Area(Geometry=surface)  # -> Area, Centroid
unit_z_2 = UnitZ(Factor="50")
scale = Scale(Geometry=surface, Center=area.Centroid, Factor="1.1")  # -> Geometry, Transform
negative = Negative(Value=unit_z_2)
extrude_2 = Extrude(Base=scale.Geometry, Direction=negative)
brep = Brep(extrude_2)
curve_2 = Curve(flatten(stream_filter_15))
curve_3 = Curve(flatten(stream_filter_14))
trim_with_breps = TrimWithBreps(Curve=curve_3, Brep=brep)  # -> Inside, Outside
trim_with_breps_2 = TrimWithBreps(Curve=curve_2, Brep=brep)  # -> Inside, Outside

area_2 = Area(Geometry=scale.Geometry)  # -> Area, Centroid
m2 = Panel(area_2.Area)
number_3 = Number(expr("Round(x,2)", m2))
multiplication = Multiplication(A=number_3, B="0.000001")

deconstruct_brep_2 = DeconstructBrep(Brep=scale.Geometry)  # -> Faces, Edges, Vertices
division_7 = Division(A=negative, B=2)
curve_4 = Curve(deconstruct_brep_2.Edges)
move = Move(Geometry=curve_4, Motion=division_7)  # -> Geometry, Transform
offset_curve = OffsetCurve(Curve=move.Geometry, Distance=Slider(50, range=0..100), Corners=1)  # -> flatten(Curve)
end_points = EndPoints(Curve=move.Geometry)  # -> Start, End
end_points_2 = EndPoints(Curve=offset_curve)  # -> Start, End
line = Line(StartPoint=end_points.Start, EndPoint=end_points_2.Start)
line_2 = Line(StartPoint=end_points.End, EndPoint=end_points_2.End)
end_points_3 = EndPoints(Curve=line)  # -> Start, End
end_points_4 = EndPoints(Curve=line_2)  # -> Start, End
scale_2 = Scale(Geometry=line, Center=end_points_3.End, Factor="0.3")  # -> Geometry, Transform
scale_3 = Scale(Geometry=line_2, Center=end_points_4.End, Factor="0.3")  # -> Geometry, Transform
vector = Vector(scale_2.Geometry)
vector_2 = Vector(scale_3.Geometry)
move_2 = Move(Geometry=scale_2.Geometry, Motion=vector)  # -> Geometry, Transform
move_3 = Move(Geometry=scale_3.Geometry, Motion=vector_2)  # -> Geometry, Transform
join_curves = JoinCurves(Curves=[scale_2.Geometry, move_2.Geometry], Preserve=False)
join_curves_2 = JoinCurves(Curves=[scale_3.Geometry, move_3.Geometry], Preserve=False)

volume = Volume(Geometry=brep)  # -> Volume, Centroid
orient = Orient(Geometry=brep, Source=volume.Centroid, Target="0,0,0")  # -> Geometry, Transform
volume_2 = Volume(Geometry=orient.Geometry)  # -> Volume, Centroid
vector_2pt = Vector2Pt(PointA=volume.Centroid, PointB=volume_2.Centroid, Unitize=False)  # -> Vector, Length

simple_mesh = SimpleMesh(Brep=orient.Geometry)
deconstruct_mesh = DeconstructMesh(Mesh=flatten(simple_mesh))  # -> Vertices, Faces, Colours, Normals

length = Length(Curve=move.Geometry)
concatenate_2 = Concatenate(FragmentA=length, FragmentB=" m")

number_4 = Number(expr("Round(x,2)", multiplication))
context_print = ContextPrint(Text=number_4)

clean_tree_2 = CleanTree(RemoveNulls=True, RemoveInvalid=True, RemoveEmpty=invert(False), Tree=merge_2)
move_4 = Move(Geometry=clean_tree_2, Motion=vector_2pt.Vector)  # -> Geometry, Transform
mesh = Mesh(move_4.Geometry)
deconstruct_mesh_2 = DeconstructMesh(Mesh=flatten(mesh))  # -> Vertices, Faces, Colours, Normals

panel_26 = Panel(item)
c_script_2 = CSharpScript(face=panel_26, bold=Toggle(False), italics=Toggle(False), size=Slider(10, range=1..20), content=concatenate_2)  # -> out, A; inputs face: String, bold: Boolean, italics: Boolean, size: Double, content: String
# ---------- c_script_2: C# ----------
    if(content != null && content != String.Empty
    && face != null && face != String.Empty ){

      if(size == 0)
        size = 5;

      Rhino.DocObjects.Font.FontStyle fontStyle = Rhino.DocObjects.Font.FontStyle.Upright;
      if (italics) fontStyle = Rhino.DocObjects.Font.FontStyle.Italic;
      Rhino.DocObjects.Font.FontWeight fontWeight = Rhino.DocObjects.Font.FontWeight.Normal;
      if (bold) fontWeight = Rhino.DocObjects.Font.FontWeight.Bold;

      bool underlined = false;
      bool strikethrough = false;

      Rhino.DocObjects.Font font = new Rhino.DocObjects.Font(face, fontWeight, fontStyle, underlined, strikethrough);


      TextEntity text_entity = new TextEntity
        {
          Plane = Plane.WorldXY,
          PlainText = content,
          Justification = TextJustification.MiddleCenter,
          Font = font
          };
      Rhino.DocObjects.DimensionStyle dimstyle = new Rhino.DocObjects.DimensionStyle();
      dimstyle.TextHeight = size;
      double smallCapsScale = 1;
      double spacing = 0;
      A = text_entity.CreateSurfaces(dimstyle, smallCapsScale, spacing);



    } else {

      Print("Some content is required.");

    }
# ---------- end c_script_2 ----------
mesh_2 = Mesh(c_script_2.A)
mesh_join = MeshJoin(Meshes=mesh_2)  # -> flatten(Mesh)

km2 = Panel(number_4)

brep_2 = Brep(orient.Geometry)
deconstruct_brep_3 = DeconstructBrep(Brep=brep_2)  # -> Faces, Edges, Vertices
area_3 = Area(Geometry=brep_2)  # -> Area, Centroid
unit_z_3 = UnitZ(Factor=1)
list_item = ListItem(List=deconstruct_brep_3.Faces, Index=0, Wrap=True)
project_point = ProjectPoint(Point=area_3.Centroid, Direction=unit_z_3, Geometry=list_item)  # -> Point, Index

construct_mesh = ConstructMesh(Vertices=deconstruct_mesh.Vertices, Faces=deconstruct_mesh.Faces, Colours=ColourSwatch(SwatchColor=RGB(204, 204, 204)))
context_bake = ContextBake(Geometry=construct_mesh)

list_length = ListLength(List=mesh)
context_print_2 = ContextPrint(AmenitiesNumber=list_length)

division_8 = Division(A=1, B=number_4)
multiplication_2 = Multiplication(A=division_8, B=list_length)

number_5 = Number(expr("Round(x,2)", multiplication_2))
context_print_3 = ContextPrint(AmenitiesPerArea=number_5)

panel_27 = Panel(number_5)

stream_filter_17 = StreamFilter(
    Gate=integer_4,
    Stream0=ColourSwatch(SwatchColor=RGB(125, 194, 64)),
    Stream1=ColourSwatch(SwatchColor=RGB(212, 87, 174)),
    Stream2=ColourSwatch(SwatchColor=RGB(194, 64, 64)),
    Stream3=ColourSwatch(SwatchColor=RGB(219, 196, 64)),
    Stream4=ColourSwatch(SwatchColor=RGB(47, 222, 219)),
    Stream5=ColourSwatch(SwatchColor=RGB(161, 92, 214)))
construct_mesh_2 = ConstructMesh(Vertices=deconstruct_mesh_2.Vertices, Faces=deconstruct_mesh_2.Faces, Colours=stream_filter_17)  # -> flatten(Mesh)
context_bake_2 = ContextBake(Amenities=construct_mesh_2)

bounding_box_4 = BoundingBox(Content=mesh_join, Plane=PlaneXY(0, 0, 0))  # -> Box, Box_2
curve_middle = CurveMiddle(Curve=offset_curve)
volume_3 = Volume(Geometry=bounding_box_4.Box)  # -> Volume, Centroid
orient_2 = Orient(Geometry=mesh_join, Source=volume_3.Centroid, Target=curve_middle)  # -> Geometry, Transform
series = Series(Start=0, Step=90, Count=4)
rotate = Rotate(Geometry=orient_2.Geometry, Angle=degrees(series), Plane=curve_middle)  # -> Geometry, Transform
unit_z_4 = UnitZ(Factor=5)
move_5 = Move(Geometry=rotate.Geometry, Motion=unit_z_4)  # -> Geometry, Transform
move_6 = Move(Geometry=move_5.Geometry, Motion=vector_2pt.Vector)  # -> Geometry, Transform
deconstruct_mesh_3 = DeconstructMesh(Mesh=flatten(move_6.Geometry))  # -> Vertices, Faces, Colours, Normals

inspect_building = InspectBuilding(Building=stream_filter_16, DefaultHeight="12")  # -> Geometry, Metadata, Amenity, BuildingMesh
mesh_3 = Mesh(flatten(inspect_building.BuildingMesh))
curve_5 = Curve(flatten(inspect_building.Geometry))
clean_tree_3 = CleanTree(RemoveNulls=True, RemoveInvalid=True, RemoveEmpty=invert(False), Tree=mesh_3)
clean_tree_4 = CleanTree(RemoveNulls=True, RemoveInvalid=True, RemoveEmpty=invert(False), Tree=curve_5)
move_7 = Move(Geometry=clean_tree_4, Motion=vector_2pt.Vector)  # -> Geometry, Transform
move_8 = Move(Geometry=clean_tree_3, Motion=vector_2pt.Vector)  # -> Geometry, Transform

move_9 = Move(Geometry=trim_with_breps_2.Inside, Motion=vector_2pt.Vector)  # -> Geometry, Transform
curve_6 = Curve(flatten(move_9.Geometry))
colour_swatch = ColourSwatch(SwatchColor=RGB(59, 59, 59))
preview = CustomPreview(Geometry=curve_6, Material=colour_swatch)
clean_tree_5 = CleanTree(RemoveNulls=True, RemoveInvalid=True, RemoveEmpty=invert(False), Tree=curve_6)

move_10 = Move(Geometry=trim_with_breps.Inside, Motion=vector_2pt.Vector)  # -> Geometry, Transform
colour_swatch_2 = ColourSwatch(SwatchColor=RGB(115, 115, 115))
curve_7 = Curve(flatten(move_10.Geometry))
uservalue = Text(colour_swatch_2)
userkey = Text("color")
preview_2 = CustomPreview(Geometry=curve_7, Material=colour_swatch_2)
clean_tree_6 = CleanTree(RemoveNulls=True, RemoveInvalid=True, RemoveEmpty=invert(False), Tree=curve_7)

inputpoint = GetPoint(project_point.Point, AtLeast=1, AtMost=1, Realtime=True, TreeAccess=False)

uservalue_2 = Text(colour_swatch)
userkey_2 = Text("color")

move_11 = Move(Geometry=[offset_curve, join_curves, join_curves_2], Motion=vector_2pt.Vector)  # -> Geometry, Transform
curve_8 = Curve(move_11.Geometry)
colour_swatch_3 = ColourSwatch(SwatchColor=RGB(0, 0, 0))
preview_3 = CustomPreview(Geometry=curve_8, Material=colour_swatch_3)

circle = Circle(Plane=inputpoint, Radius=integer_6)
unit_z_5 = UnitZ(Factor=50)
unit_z_6 = UnitZ(Factor=-50)
extrude_3 = Extrude(Base=circle, Direction=[unit_z_5, unit_z_6])
brep_join = BrepJoin(Breps=extrude_3)  # -> Breps, Closed
cap_holes_2 = CapHoles(Brep=brep_join.Breps)

c_script_3 = CSharpScript(geometry=clean_tree_6, userKey=userkey, userValue=uservalue)  # -> out, geoWithUserString; inputs geometry: GeometryBase, userKey: String, userValue: String
# ---------- c_script_3: C# ----------
    geometry.SetUserString(userKey, userValue);
   geoWithUserString = geometry;
# ---------- end c_script_3 ----------
context_bake_3 = ContextBake(Sidewalks=c_script_3.geoWithUserString)

c_script_4 = CSharpScript(geometry=clean_tree_5, userKey=userkey_2, userValue=uservalue_2)  # -> out, geoWithUserString; inputs geometry: GeometryBase, userKey: String, userValue: String
# ---------- c_script_4: C# ----------
    geometry.SetUserString(userKey, userValue);
    geoWithUserString = geometry;
# ---------- end c_script_4 ----------
context_bake_4 = ContextBake(Geometry=c_script_4.geoWithUserString)

pipe = Pipe(Curve=circle, Radius=1.2, Caps=0)
mesh_brep_2 = MeshBrep(
    Brep=pipe,
    Settings={GridMaxCount=0, GridMinCount=16, JaggedSeams=False, MaxEdgeLength=0, MinEdgeLength=0.0001, MinTolerance=0, Refine=True, RefineAngle=0, RelativeTolerance=0.65, SimplePlanes=True, Tolerance=0})
deconstruct_mesh_4 = DeconstructMesh(Mesh=flatten(mesh_brep_2))  # -> Vertices, Faces, Colours, Normals

area_4 = Area(Geometry=move_7.Geometry)  # -> Area, Centroid
point_in_brep = PointInBrep(Brep=cap_holes_2, Point=area_4.Centroid, Strict=False)
dispatch = Dispatch(List=move_8.Geometry, DispatchPattern=point_in_brep)  # -> ListA, ListB
dispatch_2 = Dispatch(List=move_7.Geometry, DispatchPattern=point_in_brep)  # -> ListA, ListB
mesh_4 = Mesh(dispatch.ListB)
curve_9 = Curve(dispatch_2.ListA)
mesh_5 = Mesh(dispatch.ListA)
curve_10 = Curve(dispatch_2.ListB)

uservalue_3 = Text(colour_swatch_3)
userkey_3 = Text("color")

c_script_5 = CSharpScript(geometry=curve_8, userKey=userkey_3, userValue=uservalue_3)  # -> out, geoWithUserString; inputs geometry: GeometryBase, userKey: String, userValue: String; same code as c_script_3
context_bake_5 = ContextBake(Geometry=c_script_5.geoWithUserString)

volume_4 = Volume(Geometry=construct_mesh_2)  # -> Volume, Centroid
text_tag = TextTag(Location=volume_4.Centroid, Text=panel_25)

construct_mesh_3 = ConstructMesh(Vertices=deconstruct_mesh_4.Vertices, Faces=deconstruct_mesh_4.Faces, Colours=ColourSwatch(SwatchColor=RGB(0, 0, 0)))  # -> flatten(Mesh)
context_bake_6 = ContextBake(Geometry=construct_mesh_3)

point_in_brep_2 = PointInBrep(Brep=cap_holes_2, Point=volume_4.Centroid, Strict=False)
dispatch_3 = Dispatch(List=panel_25, DispatchPattern=point_in_brep_2)  # -> ListA, ListB
data_7 = Data(dispatch_3.ListA)

construct_mesh_4 = ConstructMesh(Vertices=deconstruct_mesh_3.Vertices, Faces=deconstruct_mesh_3.Faces, Colours=ColourSwatch(SwatchColor=RGB(59, 59, 59)))  # -> flatten(Mesh)
context_bake_7 = ContextBake(Geometry=construct_mesh_4)

unit_z_7 = UnitZ(Factor=0.1)
surface_2 = Surface(curve_10)
extrude_4 = Extrude(Base=surface_2, Direction=unit_z_7)
mesh_brep_3 = MeshBrep(
    Brep=extrude_4,
    Settings={GridMaxCount=0, GridMinCount=16, JaggedSeams=False, MaxEdgeLength=0, MinEdgeLength=0.0001, MinTolerance=0, Refine=True, RefineAngle=0, RelativeTolerance=0.65, SimplePlanes=True, Tolerance=0})

unit_z_8 = UnitZ(Factor=0.1)
surface_3 = Surface(curve_9)
extrude_5 = Extrude(Base=surface_3, Direction=unit_z_8)
mesh_brep_4 = MeshBrep(
    Brep=extrude_5,
    Settings={GridMaxCount=0, GridMinCount=16, JaggedSeams=False, MaxEdgeLength=0, MinEdgeLength=0.0001, MinTolerance=0, Refine=True, RefineAngle=0, RelativeTolerance=0.65, SimplePlanes=True, Tolerance=0})

dispatch_4 = Dispatch(List=volume_4.Centroid, DispatchPattern=point_in_brep_2)  # -> ListA, ListB
deconstruct = Deconstruct(Point=dispatch_4.ListA)  # -> XComponent, YComponent, ZComponent

amenitiesmetadata = ContextPrint(AmenitiesMetadata=data_7)
amenitiesmetadata_2 = ContextPrint(AmenitiesLocationX=deconstruct.XComponent)
amenitiesmetadata_3 = ContextPrint(AmenitiesLocationY=deconstruct.YComponent)
amenitiesmetadata_4 = ContextPrint(AmenitiesLocationZ=deconstruct.ZComponent)

mesh_join_2 = MeshJoin(Meshes=[mesh_5, mesh_brep_3])
mesh_join_3 = MeshJoin(Meshes=[mesh_brep_4, mesh_4])

stream_filter_18 = StreamFilter(Gate=boolean, Stream0=mesh_join_3, Stream1=mesh_join_2)
deconstruct_mesh_5 = DeconstructMesh(Mesh=flatten(stream_filter_18))  # -> Vertices, Faces, Colours, Normals

construct_mesh_5 = ConstructMesh(
    Vertices=deconstruct_mesh_5.Vertices,
    Faces=deconstruct_mesh_5.Faces,
    Colours=ColourSwatch(SwatchColor=RGB(255, 255, 255)))  # -> flatten(Mesh)
context_bake_8 = ContextBake(BuildingsGeo=construct_mesh_5)

# ==== cluster GetDataFromOSM
T = ClusterInput()
txt = ClusterInput()
txt_2 = ClusterInput()
txt_3 = ClusterInput()
txt_4 = Text(txt_2)
txt_5 = Text(txt_3)
txt_6 = Text(txt)
null = NullItem(Item=txt_4)  # -> NullFlags, InvalidFlags, Description
lng = ListLength(List=txt_6)
list_item = ListItem(List=null.NullFlags, Index=0, Wrap=True)
equals = Equality(FirstNumber=lng, SecondNumber="1")  # -> Equality, Inequality
concat = Concatenate(FragmentD=" modv=\"not\"", FragmentA=" v=\"", FragmentB=txt_5, FragmentC="\"")
concat_2 = Concatenate(FragmentA=" v=\"", FragmentB=txt_4, FragmentC="\"")
null_2 = NullItem(Item=txt_5)  # -> NullFlags, InvalidFlags, Description
split = TextSplit(Text=T, Separators=",")
filter = StreamFilter(Gate=list_item, Stream0=concat_2)
filter_2 = StreamFilter(Gate=null_2.NullFlags, Stream0=concat)
item = ListItem(List=split, Index=0, Wrap=True)  # -> Item, Item1, Item2, Item3
panel = Panel("""node
way
relation""")
merge = Merge(Data1=item.Item1, Data2=item.Item, Data3=item.Item3, Data4=item.Item2)  # -> flatten(Result)
merge_2 = Merge(Data1=filter, Data2=filter_2)  # -> flatten(Result)
concat_3 = Concatenate(
    FragmentA="<query type=\"",
    FragmentB=panel,
    FragmentC="\"><has-kv k=\"",
    FragmentD=txt_6,
    FragmentE="\"",
    FragmentF=graft(merge_2),
    FragmentG="/></query>")
join = TextJoin(Text=merge, Join=",")
lng_2 = ListLength(List=merge)
equals_2 = Equality(FirstNumber="4", SecondNumber=lng_2)  # -> Equality, Inequality
join_2 = TextJoin(Text=concat_3)  # -> flatten(Result)
join_3 = TextJoin(Text=join_2)
panel_2 = Panel("""<union>
<item/>
<recurse type="down"/>
</union>
<print mode="body"/>
</osm-script>""")
concat_4 = Concatenate(FragmentA="<union>", FragmentB=join_3, FragmentC="</union>")
concat_5 = Concatenate(FragmentA="<osm-script output=\"xml\" timeout=\"200\" bbox=\"", FragmentB=join, FragmentC="\">")
concat_6 = Concatenate(FragmentA=concat_5, FragmentD=concat_4, FragmentC=panel_2)
p_n_c = PickNChoose(Pattern=equals.Equality, Stream0="insert one and only key", Stream1=concat_6)
filter_3 = StreamFilter(Gate=equals_2.Equality, Stream1=p_n_c)
concat_7 = Concatenate(FragmentA="http://overpass-api.de/api/interpreter?data=", FragmentB=filter_3)
key = Text(txt)
out = Text(filter_3)
in = Text(concat_7)
feat = Text(key)
in_2 = ClusterOutput(in)
out_2 = ClusterOutput(out)
feat_2 = ClusterOutput(feat)
