# Grasshopper definition EvaluateYourCity6.gh (Grasshopper 1.0.7)
# plug-ins: Urbano

warsaw = Panel("20.99155")
warsaw_2 = Panel("52.23955")

barcelona = Panel("2.15728")
barcelona_2 = Panel("41.39233")

paris = Panel("2.34712")
paris_2 = Panel("48.89072")

london = Panel("-0.09304")
london_2 = Panel("51.48972")

vienna = Panel("16.40139")
vienna_2 = Panel("48.19906")

kopenhagen = Panel("12.54772")
kopenhagen_2 = Panel("55.67762")

box_size = Panel("0.008")
box_size_2 = Panel("0.009")
box_size_3 = Panel("0.010")
box_size_4 = Panel("0.020")

number = Number(warsaw)
location_w_e = GetNumber(number, AtLeast=1, AtMost=1, Maximum=1.797693135e+308, Minimum=-1.797693135e+308, TreeAccess=False)

number_2 = Number(warsaw_2)
location_n_s = GetNumber(number_2, AtLeast=1, AtMost=1, Maximum=1.797693135e+308, Minimum=-1.797693135e+308, TreeAccess=False)

division = Division(A=box_size_3, B=2)
division_2 = Division(A=division, B=1.5)

addition = Addition(A=location_n_s, B=division_2)
subtraction = Subtraction(A=location_n_s, B=division_2)
addition_2 = Addition(A=location_w_e, B=division)
subtraction_2 = Subtraction(A=location_w_e, B=division)
text_join = TextJoin(Text=[subtraction_2, subtraction, addition_2, addition], Join=",")
data = Data(text_join)
bbox_left_bottom_right_top = Panel(data)
data_2 = Data(bbox_left_bottom_right_top)

panel = Panel("""service
residential""")
panel_2 = Panel("""motorway
trunk
primary
secondary
tertiary
unclassified""")
panel_3 = Panel("""footway
bridleway
steps
corridor
path
sidewalk
crossing
pedestrian
living street""")
get_data_from_osm = GetDataFromOSM(T=data_2, txt="highway", txt_2=panel)  # -> out_2, in_2, feat_2
get_data_from_osm_2 = GetDataFromOSM(T=data_2, txt="highway", txt_2=[panel_3, panel])  # -> out_2, in_2, feat_2

amenity = ValueList({"Parks": 0, "Playgrounds": 1, "Groceries": 2, "Restaurants": 3, "Public transport": 4, "Education": 5}, selected="Playgrounds")
integer = Integer(amenity)
amenity_2 = GetInteger(integer, AtLeast=1, AtMost=1, Maximum=2147483647, Minimum=-2147483648, TreeAccess=False)
integer_2 = Integer(amenity_2)

get_data_from_osm_3 = GetDataFromOSM(T=data_2, txt="building")  # -> out_2, in_2, feat_2

panel_4 = Panel("""kindergarten
school
university
college""")
panel_5 = Panel("""supermarket
convenience""")
panel_6 = Panel("""bar
pub
cafe
restaurant""")
get_data_from_osm_4 = GetDataFromOSM(T=data_2, txt="leisure", txt_2="playground")  # -> out_2, in_2, feat_2
get_data_from_osm_5 = GetDataFromOSM(T=data_2, txt="amenity", txt_2=panel_4)  # -> out_2, in_2, feat_2
get_data_from_osm_6 = GetDataFromOSM(T=data_2, txt="leisure", txt_2="park")  # -> out_2, in_2, feat_2
get_data_from_osm_7 = GetDataFromOSM(T=data_2, txt="shop", txt_2=panel_5)  # -> out_2, in_2, feat_2
get_data_from_osm_8 = GetDataFromOSM(T=data_2, txt="public_transport", txt_2="stop_position")  # -> out_2, in_2, feat_2
get_data_from_osm_9 = GetDataFromOSM(T=data_2, txt="amenity", txt_2=panel_6)  # -> out_2, in_2, feat_2
stream_filter = StreamFilter(
    Gate=integer_2,
    Stream0=get_data_from_osm_6.in_2,
    Stream1=get_data_from_osm_4.in_2,
    Stream2=get_data_from_osm_7.in_2,
    Stream3=get_data_from_osm_9.in_2,
    Stream4=get_data_from_osm_8.in_2,
    Stream5=get_data_from_osm_5.in_2)
stream_filter_2 = StreamFilter(
    Gate=integer_2,
    Stream0=get_data_from_osm_6.feat_2,
    Stream1=get_data_from_osm_4.feat_2,
    Stream2=get_data_from_osm_7.feat_2,
    Stream3=get_data_from_osm_9.feat_2,
    Stream4=get_data_from_osm_8.feat_2,
    Stream5=get_data_from_osm_5.feat_2)

import_osm_features = ImportOSMFeatures(OSMPathOrURL=get_data_from_osm_2.in_2, OSMFeatureType=get_data_from_osm_2.feat_2, Format="xml", ImportAltitude=False)  # -> Points, Metadata, UTMZone, TranslationVector
point = Point(import_osm_features.Points)
polyline = PolyLine(Vertices=point, Closed=False)

import_osm_features_2 = ImportOSMFeatures(OSMPathOrURL=get_data_from_osm.in_2, OSMFeatureType=get_data_from_osm.feat_2, Format="xml", ImportAltitude=False)  # -> Points, Metadata, UTMZone, TranslationVector
point_2 = Point(import_osm_features_2.Points)
polyline_2 = PolyLine(Vertices=point_2, Closed=False)

import_osm_features_3 = ImportOSMFeatures(OSMPathOrURL=get_data_from_osm_3.in_2, OSMFeatureType=get_data_from_osm_3.feat_2, Format="xml", ImportAltitude=False)  # -> Points, Metadata, UTMZone, TranslationVector
point_3 = Point(import_osm_features_3.Points)
polyline_3 = PolyLine(Vertices=point_3, Closed=False)
lookup_metadata = LookupMetadata(MetadataGeometry=import_osm_features_3.Metadata, SearchKey="height")
create_building = CreateBuilding(BuildingCurve=polyline_3, Metadata=import_osm_features_3.Metadata)
panel_7 = Panel(lookup_metadata)

import_osm_features_4 = ImportOSMFeatures(OSMPathOrURL=stream_filter, OSMFeatureType=stream_filter_2, Format="xml", ImportAltitude=False)  # -> Points, Metadata, UTMZone, TranslationVector
point_4 = Point(import_osm_features_4.Points)
stream_gate = StreamGate(Stream=point_4, Gate=integer_2)  # -> Target0, Target1, Target2, Target3, Target4, Target5

polyline_4 = PolyLine(Vertices=[stream_gate.Target1, stream_gate.Target0], Closed=False)
merge = Merge(Data1=stream_gate.Target2, Data2=stream_gate.Target3, Data3=stream_gate.Target4, Data4=stream_gate.Target5)
curve = Curve(flatten(polyline_4))

merge_2 = Merge(
    Data1=polyline_4,
    Data2=stream_gate.Target2,
    Data3=stream_gate.Target3,
    Data4=stream_gate.Target4,
    Data5=stream_gate.Target5)
bounding_box = BoundingBox(Content=flatten(merge_2), Plane=PlaneXY(0, 0, 0), UnionBox=True)  # -> Box, Box_2
bounding_box_2 = BoundingBox(Content=flatten(create_building), Plane=PlaneXY(0, 0, 0), UnionBox=True)  # -> Box, Box_2
bounding_box_3 = BoundingBox(Content=flatten([bounding_box_2.Box, bounding_box.Box]), Plane=PlaneXY(0, 0, 0), UnionBox=True)  # -> Box, Box_2
deconstruct_brep = DeconstructBrep(Brep=bounding_box_3.Box)  # -> Faces, Edges, Vertices
area = Area(Geometry=deconstruct_brep.Faces)  # -> Area, Centroid

curve_2 = Curve(deconstruct_brep.Edges)
length = Length(Curve=curve_2)
sort_list = SortList(Keys=length, ValuesA=length)  # -> Keys, ValuesA
list_item = ListItem(List=sort_list.ValuesA, Index=0, Wrap=True)  # -> Item1, Item
number_3 = Number(expr("round(x,0)", list_item.Item1))
division_3 = Division(A=number_3, B=2)
panel_8 = Panel(division_3)

plane_surface = PlaneSurface(Plane=PlaneXY(0, 0, 0), XSize="-400 to 400", YSize="-400 to 400")
plane_surface_2 = PlaneSurface(Plane=PlaneXY(0, 0, 0), XSize="-300 to 300", YSize="-300 to 300")
plane_surface_3 = PlaneSurface(Plane=PlaneXY(0, 0, 0), XSize="-350 to 350", YSize="-350 to 350")
area_2 = Area(Geometry=plane_surface)  # -> Area, Centroid
area_3 = Area(Geometry=plane_surface_2)  # -> Area, Centroid
area_4 = Area(Geometry=plane_surface_3)  # -> Area, Centroid
orient = Orient(Geometry=plane_surface, Source=area_2.Centroid, Target=area.Centroid)  # -> Geometry, Transform
orient_2 = Orient(Geometry=plane_surface_2, Source=area_3.Centroid, Target=area.Centroid)  # -> Geometry, Transform
orient_3 = Orient(Geometry=plane_surface_3, Source=area_4.Centroid, Target=area.Centroid)  # -> Geometry, Transform

map_size = ValueList({"Small": 0, "Medium": 1, "Large": 2}, selected="Small")
integer_3 = Integer(map_size)
map_size_2 = GetInteger(integer_3, AtLeast=1, AtMost=1, Maximum=2147483647, Minimum=-2147483648, TreeAccess=False)
integer_4 = Integer(map_size_2)

unit_z = UnitZ(Factor=50)
unit_z_2 = UnitZ(Factor=-50)
extrude = Extrude(Base=deconstruct_brep.Faces, Direction=[unit_z, unit_z_2])
brep_join = BrepJoin(Breps=extrude)  # -> Breps, Closed
area_5 = Area(Geometry=create_building)  # -> Area, Centroid
cap_holes = CapHoles(Brep=brep_join.Breps)
point_in_brep = PointInBrep(Brep=cap_holes, Point=area_5.Centroid, Strict=False)
dispatch = Dispatch(List=create_building, DispatchPattern=point_in_brep)  # -> ListA, ListB
curve_3 = Curve(dispatch.ListA)

stream_filter_3 = StreamFilter(Gate=integer_4, Stream0=orient_2.Geometry, Stream1=orient_3.Geometry, Stream2=orient.Geometry)

area_6 = Area(Geometry=curve)  # -> Area, Centroid
point_in_brep_2 = PointInBrep(Brep=cap_holes, Point=area_6.Centroid, Strict=False)
dispatch_2 = Dispatch(List=curve, DispatchPattern=point_in_brep_2)  # -> ListA, ListB
curve_4 = Curve(dispatch_2.ListA)

point_in_brep_3 = PointInBrep(Brep=cap_holes, Point=merge, Strict=False)
dispatch_3 = Dispatch(List=merge, DispatchPattern=point_in_brep_3)  # -> ListA, ListB
point_5 = Point(dispatch_3.ListA)

merge_3 = Merge(Data1=point_in_brep_2, Data2=point_in_brep_3)
dispatch_4 = Dispatch(List=flatten(import_osm_features_4.Metadata), DispatchPattern=merge_3)  # -> ListA, ListB

# ----
# It's ok, if it fails to collect data
unit_z_3 = UnitZ(Factor=0.1)
extrude_2 = Extrude(Base=curve_4, Direction=unit_z_3)
clean_tree = CleanTree(RemoveNulls=True, RemoveInvalid=True, RemoveEmpty=invert(False), Tree=extrude_2)
mesh_sphere = MeshSphere(Base=flatten(point_5), Radius="8", UCount=10, VCount=20)
cap_holes_2 = CapHoles(Brep=clean_tree)
mesh_brep = MeshBrep(
    Brep=cap_holes_2,
    Settings={GridMaxCount=0, GridMinCount=16, JaggedSeams=False, MaxEdgeLength=0, MinEdgeLength=0.0001, MinTolerance=0, Refine=True, RefineAngle=0, RelativeTolerance=0.65, SimplePlanes=True, Tolerance=0})
merge_4 = Merge(Data1=flatten(mesh_brep), Data2=flatten(mesh_sphere))

bounding_box_4 = BoundingBox(Content=flatten(merge_4), Plane=PlaneXY(0, 0, 0), UnionBox=True)  # -> Box, Box_2
bounding_box_5 = BoundingBox(Content=flatten(curve_3), Plane=PlaneXY(0, 0, 0), UnionBox=True)  # -> Box, Box_2
bounding_box_6 = BoundingBox(Content=flatten([bounding_box_4.Box, bounding_box_5.Box]), Plane=PlaneXY(0, 0, 0), UnionBox=True)  # -> Box, Box_2
deconstruct_brep_2 = DeconstructBrep(Brep=bounding_box_6.Box)  # -> Faces, Edges, Vertices
area_7 = Area(Geometry=deconstruct_brep_2.Faces)  # -> Area, Centroid
deconstruct = Deconstruct(Point=area_7.Centroid)  # -> XComponent, YComponent, ZComponent
sort_list_2 = SortList(Keys=deconstruct.ZComponent, ValuesA=deconstruct_brep_2.Faces)  # -> Keys, ValuesA
list_item_2 = ListItem(List=sort_list_2.ValuesA, Index=0, Wrap=True)
geometry = Geometry(list_item_2)
flip = Flip(Surface=geometry)  # -> Surface, Result

unit_z_4 = UnitZ(Factor="50")
negative = Negative(Value=unit_z_4)
extrude_3 = Extrude(Base=list_item_2, Direction=negative)
brep = Brep(extrude_3)
curve_5 = Curve(flatten(polyline_2))
curve_6 = Curve(flatten(polyline))
trim_with_breps = TrimWithBreps(Curve=curve_6, Brep=brep)  # -> Inside, Outside
trim_with_breps_2 = TrimWithBreps(Curve=curve_5, Brep=brep)  # -> Inside, Outside

deconstruct_metadata = DeconstructMetadata(Metadata=dispatch_4.ListA)  # -> Keys, Values
panel_9 = Panel(deconstruct_metadata.Keys)
panel_10 = Panel(deconstruct_metadata.Values)
cull_index = CullIndex(List=panel_9, Indices=0, Wrap=True)
cull_index_2 = CullIndex(List=panel_10, Indices=0, Wrap=True)
concatenate = Concatenate(Fragment_A=cull_index, A=" : ", Fragment_B=cull_index_2)
panel_11 = Panel(concatenate)
text_join_2 = TextJoin(Text=panel_11)  # -> flatten(Result)
panel_12 = Panel(text_join_2)

deconstruct_brep_3 = DeconstructBrep(Brep=flip.Surface)  # -> Faces, Edges, Vertices
division_4 = Division(A=negative, B=2)
curve_7 = Curve(deconstruct_brep_3.Edges)
move = Move(Geometry=curve_7, Motion=division_4)  # -> Geometry, Transform
offset_curve = OffsetCurve(Curve=move.Geometry, Distance=Slider(50, range=0..100), Corners=1)  # -> flatten(Curve)
end_points = EndPoints(Curve=move.Geometry)  # -> Start, End
end_points_2 = EndPoints(Curve=offset_curve)  # -> Start, End
line = Line(StartPoint=end_points.Start, EndPoint=end_points_2.Start)
line_2 = Line(StartPoint=end_points.End, EndPoint=end_points_2.End)
end_points_3 = EndPoints(Curve=line)  # -> Start, End
end_points_4 = EndPoints(Curve=line_2)  # -> Start, End
scale = Scale(Geometry=line, Center=end_points_3.End, Factor="0.3")  # -> Geometry, Transform
scale_2 = Scale(Geometry=line_2, Center=end_points_4.End, Factor="0.3")  # -> Geometry, Transform
vector = Vector(scale.Geometry)
vector_2 = Vector(scale_2.Geometry)
move_2 = Move(Geometry=scale.Geometry, Motion=vector)  # -> Geometry, Transform
move_3 = Move(Geometry=scale_2.Geometry, Motion=vector_2)  # -> Geometry, Transform
join_curves = JoinCurves(Curves=[scale.Geometry, move_2.Geometry], Preserve=False)
join_curves_2 = JoinCurves(Curves=[scale_2.Geometry, move_3.Geometry], Preserve=False)

area_8 = Area(Geometry=list_item_2)  # -> Area, Centroid
m2 = Panel(area_8.Area)
number_4 = Number(expr("Round(x,2)", m2))
multiplication = Multiplication(A=number_4, B="0.000001")

volume = Volume(Geometry=brep)  # -> Volume, Centroid
orient_4 = Orient(Geometry=brep, Source=volume.Centroid, Target="0,0,0")  # -> Geometry, Transform
volume_2 = Volume(Geometry=orient_4.Geometry)  # -> Volume, Centroid
vector_2pt = Vector2Pt(PointA=volume.Centroid, PointB=volume_2.Centroid, Unitize=False)  # -> Vector, Length

c_script = CSharpScript()  # -> fonts
# ---------- c_script: C# ----------
    fonts = Rhino.DocObjects.Font.AvailableFontFaceNames();
# ---------- end c_script ----------
item = ListItem(List=c_script, Index=Slider(45, range=0..423), Wrap=True)

simple_mesh = SimpleMesh(Brep=orient_4.Geometry)
deconstruct_mesh = DeconstructMesh(Mesh=flatten(simple_mesh))  # -> Vertices, Faces, Colours, Normals

length_2 = Length(Curve=move.Geometry)
number_5 = Number(expr("round(x,1)", length_2))
concatenate_2 = Concatenate(FragmentA=number_5, FragmentB=" m")

number_6 = Number(expr("Round(x,2)", multiplication))
context_print = ContextPrint(Text=number_6)

clean_tree_2 = CleanTree(RemoveNulls=True, RemoveInvalid=True, RemoveEmpty=invert(False), Tree=merge_4)
move_4 = Move(Geometry=clean_tree_2, Motion=vector_2pt.Vector)  # -> Geometry, Transform
mesh = Mesh(move_4.Geometry)
deconstruct_mesh_2 = DeconstructMesh(Mesh=flatten(mesh))  # -> Vertices, Faces, Colours, Normals

km2 = Panel(number_6)

panel_13 = Panel(item)
c_script_2 = CSharpScript(face=panel_13, bold=Toggle(False), italics=Toggle(False), size=Slider(10, range=1..20), content=concatenate_2)  # -> out, A; inputs face: String, bold: Boolean, italics: Boolean, size: Double, content: String
# ---------- c_script_2: C# ----------
    if(content != null && content != String.Empty
    && face != null && face != String.Empty ){

      if(size == 0)
        size = 5;

      Rhino.DocObjects.Font.FontStyle fontStyle = Rhino.DocObjects.Font.FontStyle.Upright;
      if (italics) fontStyle = Rhino.DocObjects.Font.FontStyle.Italic;
      Rhino.DocObjects.Font.FontWeight fontWeight = Rhino.DocObjects.Font.FontWeight.Normal;
      if (bold) fontWeight = Rhino.DocObjects.Font.FontWeight.Bold;

      bool underlined = false;
      bool strikethrough = false;

      Rhino.DocObjects.Font font = new Rhino.DocObjects.Font(face, fontWeight, fontStyle, underlined, strikethrough);


      TextEntity text_entity = new TextEntity
        {
          Plane = Plane.WorldXY,
          PlainText = content,
          Justification = TextJustification.MiddleCenter,
          Font = font
          };
      Rhino.DocObjects.DimensionStyle dimstyle = new Rhino.DocObjects.DimensionStyle();
      dimstyle.TextHeight = size;
      double smallCapsScale = 1;
      double spacing = 0;
      A = text_entity.CreateSurfaces(dimstyle, smallCapsScale, spacing);



    } else {

      Print("Some content is required.");

    }
# ---------- end c_script_2 ----------
mesh_2 = Mesh(c_script_2.A)
mesh_join = MeshJoin(Meshes=mesh_2)  # -> flatten(Mesh)

construct_mesh = ConstructMesh(Vertices=deconstruct_mesh.Vertices, Faces=deconstruct_mesh.Faces, Colours=ColourSwatch(SwatchColor=RGB(204, 204, 204)))
context_bake = ContextBake(Geometry=construct_mesh)

inspect_building = InspectBuilding(Building=curve_3, DefaultHeight="12")  # -> Geometry, Metadata, Amenity, BuildingMesh
mesh_3 = Mesh(flatten(inspect_building.BuildingMesh))
curve_8 = Curve(flatten(inspect_building.Geometry))
clean_tree_3 = CleanTree(RemoveNulls=True, RemoveInvalid=True, RemoveEmpty=invert(False), Tree=mesh_3)
clean_tree_4 = CleanTree(RemoveNulls=True, RemoveInvalid=True, RemoveEmpty=invert(False), Tree=curve_8)
move_5 = Move(Geometry=clean_tree_4, Motion=vector_2pt.Vector)  # -> Geometry, Transform
move_6 = Move(Geometry=clean_tree_3, Motion=vector_2pt.Vector)  # -> Geometry, Transform

list_length = ListLength(List=mesh)
context_print_2 = ContextPrint(AmenitiesNumber=list_length)

division_5 = Division(A=1, B=number_6)
multiplication_2 = Multiplication(A=division_5, B=list_length)

number_7 = Number(expr("Round(x,2)", multiplication_2))
context_print_3 = ContextPrint(AmenitiesPerArea=number_7)

panel_14 = Panel(number_7)

stream_filter_4 = StreamFilter(
    Gate=integer_2,
    Stream0=ColourSwatch(SwatchColor=RGB(125, 194, 64)),
    Stream1=ColourSwatch(SwatchColor=RGB(212, 87, 174)),
    Stream2=ColourSwatch(SwatchColor=RGB(194, 64, 64)),
    Stream3=ColourSwatch(SwatchColor=RGB(219, 196, 64)),
    Stream4=ColourSwatch(SwatchColor=RGB(47, 222, 219)),
    Stream5=ColourSwatch(SwatchColor=RGB(161, 92, 214)))
construct_mesh_2 = ConstructMesh(Vertices=deconstruct_mesh_2.Vertices, Faces=deconstruct_mesh_2.Faces, Colours=stream_filter_4)  # -> flatten(Mesh)
context_bake_2 = ContextBake(Amenities=construct_mesh_2)

brep_2 = Brep(orient_4.Geometry)
deconstruct_brep_4 = DeconstructBrep(Brep=brep_2)  # -> Faces, Edges, Vertices
area_9 = Area(Geometry=brep_2)  # -> Area, Centroid
unit_z_5 = UnitZ(Factor=1)
list_item_3 = ListItem(List=deconstruct_brep_4.Faces, Index=0, Wrap=True)
project_point = ProjectPoint(Point=area_9.Centroid, Direction=unit_z_5, Geometry=list_item_3)  # -> Point, Index

bounding_box_7 = BoundingBox(Content=mesh_join, Plane=PlaneXY(0, 0, 0))  # -> Box, Box_2
curve_middle = CurveMiddle(Curve=offset_curve)
volume_3 = Volume(Geometry=bounding_box_7.Box)  # -> Volume, Centroid
orient_5 = Orient(Geometry=mesh_join, Source=volume_3.Centroid, Target=curve_middle)  # -> Geometry, Transform
series = Series(Start=0, Step=90, Count=4)
rotate = Rotate(Geometry=orient_5.Geometry, Angle=degrees(series), Plane=curve_middle)  # -> Geometry, Transform
unit_z_6 = UnitZ(Factor=5)
move_7 = Move(Geometry=rotate.Geometry, Motion=unit_z_6)  # -> Geometry, Transform
move_8 = Move(Geometry=move_7.Geometry, Motion=vector_2pt.Vector)  # -> Geometry, Transform
deconstruct_mesh_3 = DeconstructMesh(Mesh=flatten(move_8.Geometry))  # -> Vertices, Faces, Colours, Normals

integer_5 = Integer(Slider(250, range=100..500))
data_radius = GetInteger(integer_5, AtLeast=1, AtMost=1, Maximum=2147483647, Minimum=-2147483648, TreeAccess=False)
integer_6 = Integer(data_radius)

move_9 = Move(Geometry=trim_with_breps_2.Inside, Motion=vector_2pt.Vector)  # -> Geometry, Transform
curve_9 = Curve(flatten(move_9.Geometry))
colour_swatch = ColourSwatch(SwatchColor=RGB(59, 59, 59))
preview = CustomPreview(Geometry=curve_9, Material=colour_swatch)
clean_tree_5 = CleanTree(RemoveNulls=True, RemoveInvalid=True, RemoveEmpty=invert(False), Tree=curve_9)

move_10 = Move(Geometry=trim_with_breps.Inside, Motion=vector_2pt.Vector)  # -> Geometry, Transform
colour_swatch_2 = ColourSwatch(SwatchColor=RGB(115, 115, 115))
curve_10 = Curve(flatten(move_10.Geometry))
uservalue = Text(colour_swatch_2)
userkey = Text("color")
preview_2 = CustomPreview(Geometry=curve_10, Material=colour_swatch_2)
clean_tree_6 = CleanTree(RemoveNulls=True, RemoveInvalid=True, RemoveEmpty=invert(False), Tree=curve_10)

inputpoint = GetPoint(project_point.Point, AtLeast=1, AtMost=1, Realtime=True, TreeAccess=False)

uservalue_2 = Text(colour_swatch)
userkey_2 = Text("color")

move_11 = Move(Geometry=[offset_curve, join_curves, join_curves_2], Motion=vector_2pt.Vector)  # -> Geometry, Transform
curve_11 = Curve(move_11.Geometry)
colour_swatch_3 = ColourSwatch(SwatchColor=RGB(0, 0, 0))
preview_3 = CustomPreview(Geometry=curve_11, Material=colour_swatch_3)

_3d_inside = GetBoolean(Toggle(True), AtLeast=1, AtMost=1, FalseValue="False", TreeAccess=False, TrueValue="True")
boolean = Boolean(_3d_inside)

circle = Circle(Plane=inputpoint, Radius=integer_6)
unit_z_7 = UnitZ(Factor=50)
unit_z_8 = UnitZ(Factor=-50)
extrude_4 = Extrude(Base=circle, Direction=[unit_z_7, unit_z_8])
brep_join_2 = BrepJoin(Breps=extrude_4)  # -> Breps, Closed
cap_holes_3 = CapHoles(Brep=brep_join_2.Breps)

area_10 = Area(Geometry=move_5.Geometry)  # -> Area, Centroid
point_in_brep_4 = PointInBrep(Brep=cap_holes_3, Point=area_10.Centroid, Strict=False)
dispatch_5 = Dispatch(List=move_6.Geometry, DispatchPattern=point_in_brep_4)  # -> ListA, ListB
dispatch_6 = Dispatch(List=move_5.Geometry, DispatchPattern=point_in_brep_4)  # -> ListA, ListB
mesh_4 = Mesh(dispatch_5.ListB)
curve_12 = Curve(dispatch_6.ListA)
mesh_5 = Mesh(dispatch_5.ListA)
curve_13 = Curve(dispatch_6.ListB)

c_script_3 = CSharpScript(geometry=clean_tree_6, userKey=userkey, userValue=uservalue)  # -> out, geoWithUserString; inputs geometry: GeometryBase, userKey: String, userValue: String
# ---------- c_script_3: C# ----------
    geometry.SetUserString(userKey, userValue);
   geoWithUserString = geometry;
# ---------- end c_script_3 ----------
context_bake_3 = ContextBake(Sidewalks=c_script_3.geoWithUserString)

c_script_4 = CSharpScript(geometry=clean_tree_5, userKey=userkey_2, userValue=uservalue_2)  # -> out, geoWithUserString; inputs geometry: GeometryBase, userKey: String, userValue: String
# ---------- c_script_4: C# ----------
    geometry.SetUserString(userKey, userValue);
    geoWithUserString = geometry;
# ---------- end c_script_4 ----------
context_bake_4 = ContextBake(Geometry=c_script_4.geoWithUserString)

pipe = Pipe(Curve=circle, Radius=1.2, Caps=0)
mesh_brep_2 = MeshBrep(
    Brep=pipe,
    Settings={GridMaxCount=0, GridMinCount=16, JaggedSeams=False, MaxEdgeLength=0, MinEdgeLength=0.0001, MinTolerance=0, Refine=True, RefineAngle=0, RelativeTolerance=0.65, SimplePlanes=True, Tolerance=0})
deconstruct_mesh_4 = DeconstructMesh(Mesh=flatten(mesh_brep_2))  # -> Vertices, Faces, Colours, Normals

uservalue_3 = Text(colour_swatch_3)
userkey_3 = Text("color")

c_script_5 = CSharpScript(geometry=curve_11, userKey=userkey_3, userValue=uservalue_3)  # -> out, geoWithUserString; inputs geometry: GeometryBase, userKey: String, userValue: String; same code as c_script_3
context_bake_5 = ContextBake(Geometry=c_script_5.geoWithUserString)

volume_4 = Volume(Geometry=construct_mesh_2)  # -> Volume, Centroid
text_tag = TextTag(Location=volume_4.Centroid, Text=panel_12)

construct_mesh_3 = ConstructMesh(Vertices=deconstruct_mesh_4.Vertices, Faces=deconstruct_mesh_4.Faces, Colours=ColourSwatch(SwatchColor=RGB(0, 0, 0)))  # -> flatten(Mesh)
context_bake_6 = ContextBake(Geometry=construct_mesh_3)

unit_z_9 = UnitZ(Factor=0.1)
surface = Surface(curve_13)
extrude_5 = Extrude(Base=surface, Direction=unit_z_9)
mesh_brep_3 = MeshBrep(
    Brep=extrude_5,
    Settings={GridMaxCount=0, GridMinCount=16, JaggedSeams=False, MaxEdgeLength=0, MinEdgeLength=0.0001, MinTolerance=0, Refine=True, RefineAngle=0, RelativeTolerance=0.65, SimplePlanes=True, Tolerance=0})

unit_z_10 = UnitZ(Factor=0.1)
surface_2 = Surface(curve_12)
extrude_6 = Extrude(Base=surface_2, Direction=unit_z_10)
mesh_brep_4 = MeshBrep(
    Brep=extrude_6,
    Settings={GridMaxCount=0, GridMinCount=16, JaggedSeams=False, MaxEdgeLength=0, MinEdgeLength=0.0001, MinTolerance=0, Refine=True, RefineAngle=0, RelativeTolerance=0.65, SimplePlanes=True, Tolerance=0})

point_in_brep_5 = PointInBrep(Brep=cap_holes_3, Point=volume_4.Centroid, Strict=False)
dispatch_7 = Dispatch(List=panel_12, DispatchPattern=point_in_brep_5)  # -> ListA, ListB
data_3 = Data(dispatch_7.ListA)

dispatch_8 = Dispatch(List=volume_4.Centroid, DispatchPattern=point_in_brep_5)  # -> ListA, ListB
deconstruct_2 = Deconstruct(Point=dispatch_8.ListA)  # -> XComponent, YComponent, ZComponent

construct_mesh_4 = ConstructMesh(Vertices=deconstruct_mesh_3.Vertices, Faces=deconstruct_mesh_3.Faces, Colours=ColourSwatch(SwatchColor=RGB(59, 59, 59)))  # -> flatten(Mesh)
context_bake_7 = ContextBake(Geometry=construct_mesh_4)

mesh_join_2 = MeshJoin(Meshes=[mesh_5, mesh_brep_3])
mesh_join_3 = MeshJoin(Meshes=[mesh_brep_4, mesh_4])

amenitiesmetadata = ContextPrint(AmenitiesMetadata=data_3)
amenitiesmetadata_2 = ContextPrint(AmenitiesLocationX=deconstruct_2.XComponent)
amenitiesmetadata_3 = ContextPrint(AmenitiesLocationY=deconstruct_2.YComponent)
amenitiesmetadata_4 = ContextPrint(AmenitiesLocationZ=deconstruct_2.ZComponent)

stream_filter_5 = StreamFilter(Gate=boolean, Stream0=mesh_join_3, Stream1=mesh_join_2)
deconstruct_mesh_5 = DeconstructMesh(Mesh=flatten(stream_filter_5))  # -> Vertices, Faces, Colours, Normals

construct_mesh_5 = ConstructMesh(
    Vertices=deconstruct_mesh_5.Vertices,
    Faces=deconstruct_mesh_5.Faces,
    Colours=ColourSwatch(SwatchColor=RGB(255, 255, 255)))  # -> flatten(Mesh)
context_bake_8 = ContextBake(BuildingsGeo=construct_mesh_5)

# ==== cluster GetDataFromOSM
T = ClusterInput()
txt = ClusterInput()
txt_2 = ClusterInput()
txt_3 = ClusterInput()
txt_4 = Text(txt_2)
txt_5 = Text(txt_3)
txt_6 = Text(txt)
null = NullItem(Item=txt_4)  # -> NullFlags, InvalidFlags, Description
lng = ListLength(List=txt_6)
list_item = ListItem(List=null.NullFlags, Index=0, Wrap=True)
equals = Equality(FirstNumber=lng, SecondNumber="1")  # -> Equality, Inequality
concat = Concatenate(FragmentD=" modv=\"not\"", FragmentA=" v=\"", FragmentB=txt_5, FragmentC="\"")
concat_2 = Concatenate(FragmentA=" v=\"", FragmentB=txt_4, FragmentC="\"")
null_2 = NullItem(Item=txt_5)  # -> NullFlags, InvalidFlags, Description
split = TextSplit(Text=T, Separators=",")
filter = StreamFilter(Gate=list_item, Stream0=concat_2)
filter_2 = StreamFilter(Gate=null_2.NullFlags, Stream0=concat)
item = ListItem(List=split, Index=0, Wrap=True)  # -> Item, Item1, Item2, Item3
panel = Panel("""node
way
relation""")
merge = Merge(Data1=item.Item1, Data2=item.Item, Data3=item.Item3, Data4=item.Item2)  # -> flatten(Result)
merge_2 = Merge(Data1=filter, Data2=filter_2)  # -> flatten(Result)
concat_3 = Concatenate(
    FragmentA="<query type=\"",
    FragmentB=panel,
    FragmentC="\"><has-kv k=\"",
    FragmentD=txt_6,
    FragmentE="\"",
    FragmentF=graft(merge_2),
    FragmentG="/></query>")
join = TextJoin(Text=merge, Join=",")
lng_2 = ListLength(List=merge)
equals_2 = Equality(FirstNumber="4", SecondNumber=lng_2)  # -> Equality, Inequality
join_2 = TextJoin(Text=concat_3)  # -> flatten(Result)
join_3 = TextJoin(Text=join_2)
panel_2 = Panel("""<union>
<item/>
<recurse type="down"/>
</union>
<print mode="body"/>
</osm-script>""")
concat_4 = Concatenate(FragmentA="<union>", FragmentB=join_3, FragmentC="</union>")
concat_5 = Concatenate(FragmentA="<osm-script output=\"xml\" timeout=\"200\" bbox=\"", FragmentB=join, FragmentC="\">")
concat_6 = Concatenate(FragmentA=concat_5, FragmentD=concat_4, FragmentC=panel_2)
p_n_c = PickNChoose(Pattern=equals.Equality, Stream0="insert one and only key", Stream1=concat_6)
filter_3 = StreamFilter(Gate=equals_2.Equality, Stream1=p_n_c)
concat_7 = Concatenate(FragmentA="http://overpass-api.de/api/interpreter?data=", FragmentB=filter_3)
key = Text(txt)
out = Text(filter_3)
in = Text(concat_7)
feat = Text(key)
in_2 = ClusterOutput(in)
out_2 = ClusterOutput(out)
feat_2 = ClusterOutput(feat)
