# Grasshopper definition EvaluateYourCity7.gh (Grasshopper 1.0.7)
# plug-ins: Urbano

warsaw = Panel("20.99155")
warsaw_2 = Panel("52.23955")

barcelona = Panel("2.15728")
barcelona_2 = Panel("41.39233")

paris = Panel("2.34712")
paris_2 = Panel("48.89072")

london = Panel("-0.09304")
london_2 = Panel("51.48972")

vienna = Panel("16.40139")
vienna_2 = Panel("48.19906")

kopenhagen = Panel("12.54772")
kopenhagen_2 = Panel("55.67762")

box_size = Panel("0.014")

number = Number(warsaw)
location_w_e = GetNumber(number, AtLeast=1, AtMost=1, Maximum=1.797693135e+308, Minimum=-1.797693135e+308, TreeAccess=False)

number_2 = Number(warsaw_2)
location_n_s = GetNumber(number_2, AtLeast=1, AtMost=1, Maximum=1.797693135e+308, Minimum=-1.797693135e+308, TreeAccess=False)

division = Division(A=box_size, B=2)
division_2 = Division(A=division, B=1.5)

addition = Addition(A=location_n_s, B=division_2)
subtraction = Subtraction(A=location_n_s, B=division_2)
addition_2 = Addition(A=location_w_e, B=division)
subtraction_2 = Subtraction(A=location_w_e, B=division)
text_join = TextJoin(Text=[subtraction_2, subtraction, addition_2, addition], Join=",")
data = Data(text_join)
bbox_left_bottom_right_top = Panel(data)
data_2 = Data(bbox_left_bottom_right_top)

panel = Panel("""service
residential""")  # disabled
panel_2 = Panel("""motorway
trunk
primary
secondary
tertiary
unclassified""")  # disabled
panel_3 = Panel("""footway
bridleway
steps
corridor
path
sidewalk
crossing
pedestrian
living street""")  # disabled
panel_4 = Panel("highway")  # disabled
panel_5 = Panel("highway")  # disabled
get_data_from_osm = GetDataFromOSM(T=data_2, txt=panel_4, txt_2=panel)  # -> out_2, in_2, feat_2; disabled
get_data_from_osm_2 = GetDataFromOSM(T=data_2, txt=panel_5, txt_2=[panel_3, panel])  # -> out_2, in_2, feat_2; disabled

panel_6 = Panel("")  # disabled
panel_7 = Panel("building")  # disabled
get_data_from_osm_3 = GetDataFromOSM(T=data_2, txt=panel_7, txt_2=panel_6)  # -> out_2, in_2, feat_2; disabled

panel_8 = Panel("playground")  # disabled
panel_9 = Panel("""kindergarten
school
university
college""")  # disabled
panel_10 = Panel("park")  # disabled
panel_11 = Panel("""supermarket
convenience""")  # disabled
panel_12 = Panel("stop_position")  # disabled
panel_13 = Panel("""bar
pub
cafe
restaurant""")  # disabled
panel_14 = Panel("leisure")  # disabled
panel_15 = Panel("amenity")  # disabled
panel_16 = Panel("leisure")  # disabled
panel_17 = Panel("shop")  # disabled
panel_18 = Panel("public_transport")  # disabled
panel_19 = Panel("amenity")  # disabled
get_data_from_osm_4 = GetDataFromOSM(T=data_2, txt=panel_14, txt_2=panel_8)  # -> out_2, in_2, feat_2; disabled
get_data_from_osm_5 = GetDataFromOSM(T=data_2, txt=panel_15, txt_2=panel_9)  # -> out_2, in_2, feat_2; disabled
get_data_from_osm_6 = GetDataFromOSM(T=data_2, txt=panel_16, txt_2=panel_10)  # -> out_2, in_2, feat_2; disabled
get_data_from_osm_7 = GetDataFromOSM(T=data_2, txt=panel_17, txt_2=panel_11)  # -> out_2, in_2, feat_2; disabled
get_data_from_osm_8 = GetDataFromOSM(T=data_2, txt=panel_18, txt_2=panel_12)  # -> out_2, in_2, feat_2; disabled
get_data_from_osm_9 = GetDataFromOSM(T=data_2, txt=panel_19, txt_2=panel_13)  # -> out_2, in_2, feat_2; disabled

import_osm_features = ImportOSMFeatures(OSMPathOrURL=get_data_from_osm_2.in_2, OSMFeatureType=get_data_from_osm_2.feat_2, Format="xml", ImportAltitude=False)  # -> Points, Metadata, UTMZone, TranslationVector; disabled
point = Point(import_osm_features.Points)  # disabled
polyline = PolyLine(Vertices=point, Closed=False)  # disabled

import_osm_features_2 = ImportOSMFeatures(OSMPathOrURL=get_data_from_osm.in_2, OSMFeatureType=get_data_from_osm.feat_2, Format="xml", ImportAltitude=False)  # -> Points, Metadata, UTMZone, TranslationVector; disabled
point_2 = Point(import_osm_features_2.Points)  # disabled
polyline_2 = PolyLine(Vertices=point_2, Closed=False)  # disabled

import_osm_features_3 = ImportOSMFeatures(OSMPathOrURL=get_data_from_osm_3.in_2, OSMFeatureType=get_data_from_osm_3.feat_2, Format="xml", ImportAltitude=False)  # -> Points, Metadata, UTMZone, TranslationVector; disabled
point_3 = Point(import_osm_features_3.Points)  # disabled
polyline_3 = PolyLine(Vertices=point_3, Closed=False)  # disabled
lookup_metadata = LookupMetadata(MetadataGeometry=import_osm_features_3.Metadata, SearchKey="height")  # disabled
create_building = CreateBuilding(BuildingCurve=polyline_3, Metadata=import_osm_features_3.Metadata)  # disabled
panel_20 = Panel(lookup_metadata)  # disabled

import_osm_features_4 = ImportOSMFeatures(OSMPathOrURL=get_data_from_osm_9.in_2, OSMFeatureType=get_data_from_osm_9.feat_2, Format="xml", ImportAltitude=False)  # -> Points, Metadata, UTMZone, TranslationVector; disabled
import_osm_features_5 = ImportOSMFeatures(OSMPathOrURL=get_data_from_osm_5.in_2, OSMFeatureType=get_data_from_osm_5.feat_2, Format="xml", ImportAltitude=False)  # -> Points, Metadata, UTMZone, TranslationVector; disabled
import_osm_features_6 = ImportOSMFeatures(OSMPathOrURL=get_data_from_osm_8.in_2, OSMFeatureType=get_data_from_osm_8.feat_2, Format="xml", ImportAltitude=False)  # -> Points, Metadata, UTMZone, TranslationVector; disabled
import_osm_features_7 = ImportOSMFeatures(OSMPathOrURL=get_data_from_osm_6.in_2, OSMFeatureType=get_data_from_osm_6.feat_2, Format="xml", ImportAltitude=False)  # -> Points, Metadata, UTMZone, TranslationVector; disabled
import_osm_features_8 = ImportOSMFeatures(OSMPathOrURL=get_data_from_osm_7.in_2, OSMFeatureType=get_data_from_osm_7.feat_2, Format="xml", ImportAltitude=False)  # -> Points, Metadata, UTMZone, TranslationVector; disabled
import_osm_features_9 = ImportOSMFeatures(OSMPathOrURL=get_data_from_osm_4.in_2, OSMFeatureType=get_data_from_osm_4.feat_2, Format="xml", ImportAltitude=False)  # -> Points, Metadata, UTMZone, TranslationVector; disabled
deconstruct_metadata = DeconstructMetadata(Metadata=import_osm_features_4.Metadata)  # -> Keys, Values; disabled
deconstruct_metadata_2 = DeconstructMetadata(Metadata=import_osm_features_5.Metadata)  # -> Keys, Values; disabled
deconstruct_metadata_3 = DeconstructMetadata(Metadata=import_osm_features_7.Metadata)  # -> Keys, Values; disabled
deconstruct_metadata_4 = DeconstructMetadata(Metadata=import_osm_features_8.Metadata)  # -> Keys, Values; disabled
deconstruct_metadata_5 = DeconstructMetadata(Metadata=import_osm_features_9.Metadata)  # -> Keys, Values; disabled
deconstruct_metadata_6 = DeconstructMetadata(Metadata=import_osm_features_6.Metadata)  # -> Keys, Values; disabled

map_size = ValueList({"Small": 0, "Medium": 1, "Large": 2}, selected="Small")
integer = Integer(map_size)
map_size_2 = GetInteger(integer, AtLeast=1, AtMost=1, Maximum=2147483647, Minimum=-2147483648, TreeAccess=False)
integer_2 = Integer(map_size_2)

amenity = ValueList({"Parks": 0, "Playgrounds": 1, "Groceries": 2, "Restaurants": 3, "Public transport": 4, "Education": 5}, selected="Parks")
integer_3 = Integer(amenity)
amenity_2 = GetInteger(integer_3, AtLeast=1, AtMost=1, Maximum=2147483647, Minimum=-2147483648, TreeAccess=False)
integer_4 = Integer(amenity_2)

point_4 = Point(Tree({0}: [Point(462.88, 583.89, 0)], {1}: [Point(359.91, 525.62, 0)], {2}: [Point(434.86, 518.06, 0)], {3}: [Point(91.89, 74.76, 0)], {4}: [Point(483.68, 584.3, 0)], {5}: [Point(434.01, 487.79, 0)], {6}: [Point(473.46, 471.58, 0)], {7}: [Point(32.57, 582.39, 0)], {8}: [Point(41.51, 349.05, 0)], {9}: [Point(48.67, 372.84, 0)], {10}: [Point(1.48, 259.17, 0)]))
point_5 = Point(Tree({0}: [Point(531.18, 657.96, 0)], {1}: [Point(428.21, 599.69, 0)], {2}: [Point(454.03, 678.25, 0)], {3}: [Point(503.16, 592.13, 0)], {4}: [Point(647.81, 271.86, 0)], {5}: [Point(650.76, 246.58, 0)]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))
point_6 = Point(Tree({0}: [Point(129.02, 516.26, 0)], {1}: [Point(667.79, 806.31, 0)], {2}: [Point(564.82, 748.04, 0)], {3}: [Point(590.64, 826.6, 0)], {4}: [Point(639.77, 740.48, 0)], {5}: [Point(784.42, 420.21, 0)]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))
text = Text(Tree({0;0}: ["name", "network", "operator", "public_transport", "railway", "ref", "shelter", "tactile_paving", "tactile_paving:slab_size", "tram", "id"], {1;0}: ["name", "network", "operator", "public_transport", "railway", "ref", "shelter", "tactile_paving", "tactile_paving:slab_size", "tram", "id"], {2;0}: ["name", "network", "operator", "public_transport", "railway", "ref", "shelter", "tactile_paving", "tactile_paving:slab_size", "tram", "id"], {3;0}: ["bus", "name", "network", "public_transport", "ref", "id"], {4;0}: ["bus", "name", "network", "public_transport", "ref", "id"], {5;0}: ["bus", "name", "network", "public_transport", "ref", "id"], {6;0}: ["bus", "name", "network", "public_transport", "ref", "id"], {7;0}: ["bus", "name", "network", "public_transport", "ref", "stop_position:direction", "id"], {8;0}: ["bus", "name", "network", "public_transport", "ref", "id"], {9;0}: ["bus", "name", "network", "public_transport", "ref", "id"], {10;0}: ["bus", "name", "network", "public_transport", "ref", "stop_position:direction", "id"]))
text_2 = Text(Tree({0;0}: ["leisure", "id"], {1;0}: ["leisure", "name", "id"], {2;0}: ["leisure", "name", "id"], {3;0}: ["leisure", "name", "wikidata", "id"]))
text_3 = Text(Tree({0;0}: ["leisure", "id"], {1;0}: ["leisure", "name", "id"], {2;0}: ["leisure", "name", "id"], {3;0}: ["leisure", "name", "wikidata", "id"], {4;0}: ["leisure", "name", "id"]))
text_4 = Text(Tree({0;0}: ["leisure", "id"], {1;0}: ["leisure", "name", "old_name", "id"], {2;0}: ["addr:city", "addr:street", "gez:inscription_date", "heritage", "heritage:operator", "historic", "leisure", "name", "ref:gez", "website", "wikidata", "wikipedia", "id"], {3;0}: ["leisure", "name", "id"], {4;0}: ["leisure", "name", "id"], {5;0}: ["leisure", "name", "wikidata", "id"], {6;0}: ["leisure", "name", "id"], {7;0}: ["leisure", "id"]))
text_5 = Text(Tree({0;0}: ["name", "network", "operator", "public_transport", "railway", "ref", "shelter", "tactile_paving", "tactile_paving:slab_size", "tram", "id"], {1;0}: ["name", "network", "operator", "public_transport", "railway", "ref", "shelter", "tactile_paving", "tactile_paving:slab_size", "tram", "id"], {2;0}: ["name", "network", "operator", "public_transport", "railway", "ref", "shelter", "tactile_paving", "tactile_paving:slab_size", "tram", "id"], {3;0}: ["name", "network", "operator", "public_transport", "railway", "ref", "shelter", "tactile_paving", "tactile_paving:slab_size", "tram", "id"], {4;0}: ["name", "network", "operator", "public_transport", "ref", "shelter", "tactile_paving", "tram", "wheelchair", "id"], {5;0}: ["name", "network", "operator", "public_transport", "ref", "shelter", "tactile_paving", "tactile_paving:slab_size", "tram", "wheelchair", "id"]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))
text_6 = Text(Tree({0;0}: ["name", "network", "old_name", "operator", "public_transport", "railway", "ref", "shelter", "tactile_paving", "tactile_paving:slab_size", "tram", "id"], {1;0}: ["name", "network", "operator", "public_transport", "railway", "ref", "shelter", "tactile_paving", "tactile_paving:slab_size", "tram", "id"], {2;0}: ["name", "network", "operator", "public_transport", "railway", "ref", "shelter", "tactile_paving", "tactile_paving:slab_size", "tram", "id"], {3;0}: ["name", "network", "operator", "public_transport", "railway", "ref", "shelter", "tactile_paving", "tactile_paving:slab_size", "tram", "id"], {4;0}: ["name", "network", "operator", "public_transport", "railway", "ref", "shelter", "tactile_paving", "tactile_paving:slab_size", "tram", "id"], {5;0}: ["name", "network", "operator", "public_transport", "ref", "shelter", "tactile_paving", "tram", "wheelchair", "id"]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))
text_7 = Text(Tree({0;0}: ["Warszawa", "3", "00-891", "Chłodna", "restaurant", "polish", "no", "Florian", "Mo-Fr 11:00-22:00; PH,Sa,Su 12:00-22:00", "+48226209398", "https://florian.pl/", "280797029"], {1;0}: ["restaurant", "yes", "only", "manager@vega-warszawa.pl", "Vega", "Mo-Su 11:00-20:00", "+48 223535400", "https://www.vega-warszawa.pl/", "no", "314608494"], {2;0}: ["29", "Aleja Jana Pawła II", "restaurant", "2023-05-10", "american", "Chilli Vibes", "Mo-Th 12:00-23:00; Fr-Sa 12:00-24:00; Su 12:00-22:00", "yes", "yes", "427637680"], {3;0}: ["Warszawa", "15", "Chłodna", "restaurant", "asian", "chlodna.kontakt@azia.pl", "+48 730 737 677", "Azia Restaurants", "https://www.azia.pl/?v=9b7d173b068d", "530642383"], {4;0}: ["Warszawa", "36", "Aleja Jana Pawła II", "restaurant", "2023-07-22", "italian", "sanlorenzo@sanlorenzo.pl", "San Lorenzo", "yes", "+48 22 652 16 16; +48 697 079 749", "https://www.sanlorenzo.pl/", "yes", "1280172953"], {5;0}: ["Warszawa", "23", "Aleja Jana Pawła II", "restaurant", "2023-07-22", "polish", "kontakt@ogrod-smaku.pl", "Ogrodsmakupolskaismacznakuchnia", "wlan", "Ogród Smaku", "Mo-We 11:00-20:00; Th-Su 11:00-21:00", "yes", "+48791752791;+48221272331", "https://ogrod-smaku.pl/", "no", "1280172973"]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))
point_7 = Point(Tree({0}: [Point(537.53, 477.51, 0)], {1}: [Point(469.68, 555.39, 0)]))
point_8 = Point(Tree({0}: [Point(605.83, 551.58, 0)], {1}: [Point(537.98, 629.46, 0)]))
point_9 = Point(Tree({0}: [Point(90.09, 208.89, 0)], {1}: [Point(125.89, 215.68, 0)], {2}: [Point(742.44, 699.93, 0)], {3}: [Point(650.46, 144.64, 0)], {4}: [Point(28.68, 689.61, 0)], {5}: [Point(103.92, 640.32, 0)], {6}: [Point(858, 850.76, 0)], {7}: [Point(915.48, 711.57, 0)], {8}: [Point(881.86, 694.47, 0)], {9}: [Point(897.55, 701.56, 0)], {10}: [Point(674.59, 777.81, 0)]))
text_8 = Text(Tree({0;0}: ["park", "25748458"], {1;0}: ["park", "Skwer Psa Fafika", "298748480"], {2;0}: ["park", "Skwer Sybiraków", "493884615"], {3;0}: ["park", "Skwer Isaaca Bashevisa Singera", "Q116619600", "719489379"]))
text_9 = Text(Tree({0;0}: ["Kino Femina 06", "ZTM Warszawa", "Tramwaje Warszawskie", "stop_position", "tram_stop", "708506", "yes", "yes", "40x40", "yes", "198013363"], {1;0}: ["Kino Femina 05", "ZTM Warszawa", "Tramwaje Warszawskie", "stop_position", "tram_stop", "708505", "yes", "yes", "40x40", "yes", "334196906"], {2;0}: ["Kino Femina 10", "ZTM Warszawa", "Tramwaje Warszawskie", "stop_position", "tram_stop", "708510", "yes", "yes", "40x40", "yes", "334196920"], {3;0}: ["yes", "Chłodna 02", "ZTM Warszawa", "stop_position", "508902", "3035065857"], {4;0}: ["yes", "Kino Femina 01", "ZTM Warszawa", "stop_position", "708501", "3035065895"], {5;0}: ["yes", "Kino Femina 07", "ZTM Warszawa", "stop_position", "708507", "3035065896"], {6;0}: ["yes", "Kino Femina 08", "ZTM Warszawa", "stop_position", "708508", "3035065897"], {7;0}: ["yes", "Nowolipie 01", "ZTM Warszawa", "stop_position", "515401", "backward", "3035065925"], {8;0}: ["yes", "Wola-Ratusz 01", "ZTM Warszawa", "stop_position", "500201", "3035066884"], {9;0}: ["yes", "Wola-Ratusz 02", "ZTM Warszawa", "stop_position", "500202", "3035066885"], {10;0}: ["yes", "Wola-Ratusz 05", "ZTM Warszawa", "stop_position", "500205", "backward", "3035066886"]))
text_10 = Text(Tree({0;0}: ["amenity", "contact:email", "contact:phone", "contact:website", "email", "isced:level", "level", "name", "official_name", "operator", "operator:type", "phone", "ref:regon", "ref:rspo", "website", "wikidata", "wikipedia", "id"], {1;0}: ["addr:city", "addr:city:simc", "addr:door", "addr:housenumber", "addr:postcode", "addr:street", "amenity", "email", "isced:level", "name", "official_name", "operator", "operator:type", "phone", "ref:regon", "ref:rspo", "id"]))
point_10 = Point(Tree({0}: [Point(394.85, 188.17, 0), Point(364.45, 170.52, 0), Point(362.19, 164.79, 0), Point(370.25, 151.2, 0), Point(372.74, 152.75, 0), Point(377.39, 150.56, 0), Point(401.78, 159.55, 0), Point(400.38, 164.94, 0), Point(403.55, 165.78, 0), Point(397.81, 187.73, 0), Point(394.85, 188.17, 0)], {1}: [Point(-56.28, 100.94, 0), Point(-39.12, 66.38, 0), Point(-27.11, 70.26, 0), Point(-15.43, 40.7, 0), Point(5.59, 49.22, 0), Point(11.43, 51.75, 0), Point(-0.48, 79.58, 0), Point(1.33, 80.33, 0), Point(32.35, 92.91, 0), Point(13.3, 132.85, 0), Point(12.33, 134.89, 0), Point(-33.67, 111.86, 0), Point(-34.69, 111.37, 0), Point(-44.92, 106.43, 0), Point(-56.28, 100.94, 0)], {2}: [Point(347.1, 116.95, 0), Point(349.63, 111.88, 0), Point(351.58, 106.77, 0), Point(350.97, 106.62, 0), Point(357.34, 86.16, 0), Point(360.46, 76.85, 0), Point(364.39, 65.09, 0), Point(370.5, 46.93, 0), Point(370.9, 45.68, 0), Point(373.84, 36.59, 0), Point(382.59, 39.57, 0), Point(418.89, 51.21, 0), Point(419.54, 49.23, 0), Point(463.29, 60.58, 0), Point(460.05, 73.49, 0), Point(446.02, 129.28, 0), Point(444.46, 133.68, 0), Point(430.28, 130.17, 0), Point(430.9, 127.09, 0), Point(416.67, 123.53, 0), Point(411.7, 143.24, 0), Point(347.1, 116.95, 0)], {3}: [Point(501.68, 25.82, 0), Point(527.89, 34.34, 0), Point(537.61, -4.21, 0), Point(535.66, -4.69, 0), Point(513.38, -10.84, 0), Point(511.28, -11.41, 0), Point(511.04, -10.41, 0), Point(501.68, 25.82, 0)]))
point_11 = Point(Tree({0}: [Point(463.15, 262.24, 0), Point(432.75, 244.59, 0), Point(430.49, 238.86, 0), Point(438.55, 225.27, 0), Point(441.04, 226.82, 0), Point(445.69, 224.63, 0), Point(470.08, 233.62, 0), Point(468.68, 239.01, 0), Point(471.85, 239.85, 0), Point(466.11, 261.8, 0), Point(463.15, 262.24, 0)], {1}: [Point(12.02, 175.01, 0), Point(29.18, 140.45, 0), Point(41.19, 144.33, 0), Point(52.87, 114.77, 0), Point(73.89, 123.29, 0), Point(79.73, 125.82, 0), Point(67.82, 153.65, 0), Point(69.63, 154.4, 0), Point(100.65, 166.98, 0), Point(81.6, 206.92, 0), Point(80.63, 208.96, 0), Point(34.63, 185.93, 0), Point(33.61, 185.44, 0), Point(23.38, 180.5, 0), Point(12.02, 175.01, 0)], {2}: [Point(415.4, 191.02, 0), Point(417.93, 185.95, 0), Point(419.88, 180.84, 0), Point(419.27, 180.69, 0), Point(425.64, 160.23, 0), Point(428.76, 150.92, 0), Point(432.69, 139.16, 0), Point(438.8, 121, 0), Point(439.2, 119.75, 0), Point(442.14, 110.66, 0), Point(450.89, 113.64, 0), Point(487.19, 125.28, 0), Point(487.84, 123.3, 0), Point(531.59, 134.65, 0), Point(528.35, 147.56, 0), Point(514.32, 203.35, 0), Point(512.76, 207.75, 0), Point(498.58, 204.24, 0), Point(499.2, 201.16, 0), Point(484.97, 197.6, 0), Point(480, 217.31, 0), Point(415.4, 191.02, 0)], {3}: [Point(569.98, 99.89, 0), Point(596.19, 108.41, 0), Point(605.91, 69.86, 0), Point(603.96, 69.38, 0), Point(581.68, 63.23, 0), Point(579.58, 62.66, 0), Point(579.34, 63.66, 0), Point(569.98, 99.89, 0)], {4}: [Point(18.2, 771.09, 0), Point(24.24, 759.67, 0), Point(25.37, 757.54, 0), Point(35.7, 738.03, 0), Point(36.52, 736.49, 0), Point(45.54, 719.45, 0), Point(57.38, 725.35, 0), Point(52.1, 744.22, 0), Point(51.95, 744.74, 0), Point(51.69, 746.42, 0), Point(46.69, 775.84, 0), Point(45.36, 779.97, 0), Point(43.11, 781.51, 0), Point(40.87, 781.94, 0), Point(38.4, 781.7, 0), Point(18.2, 771.09, 0)]))
point_12 = Point(Tree({0}: [Point(599.76, 410.59, 0), Point(569.36, 392.94, 0), Point(567.1, 387.21, 0), Point(575.16, 373.62, 0), Point(577.65, 375.17, 0), Point(582.3, 372.98, 0), Point(606.69, 381.97, 0), Point(605.29, 387.36, 0), Point(608.46, 388.2, 0), Point(602.72, 410.15, 0), Point(599.76, 410.59, 0)], {1}: [Point(-37.8, 1069.76, 0), Point(-20.62, 1077.88, 0), Point(-16.62, 1079.77, 0), Point(-7.67, 1083.99, 0), Point(-1.09, 1087.1, 0), Point(17.47, 1095.87, 0)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], {2}: [Point(980.71, 426.36, 0), Point(980.02, 426.18, 0), Point(975.13, 424.95, 0), Point(976.56, 419.28, 0), Point(978.41, 411.91, 0), Point(976.86, 411.57, 0)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], {3}: [Point(148.63, 323.36, 0), Point(165.79, 288.8, 0), Point(177.8, 292.68, 0), Point(189.48, 263.12, 0), Point(210.5, 271.64, 0), Point(216.34, 274.17, 0), Point(204.43, 302, 0), Point(206.24, 302.75, 0), Point(237.26, 315.33, 0), Point(218.21, 355.27, 0), Point(217.24, 357.31, 0), Point(171.24, 334.28, 0), Point(170.22, 333.79, 0), Point(159.99, 328.85, 0), Point(148.63, 323.36, 0)], {4}: [Point(552.01, 339.37, 0), Point(554.54, 334.3, 0), Point(556.49, 329.19, 0), Point(555.88, 329.04, 0), Point(562.25, 308.58, 0), Point(565.37, 299.27, 0), Point(569.3, 287.51, 0), Point(575.41, 269.35, 0), Point(575.81, 268.1, 0), Point(578.75, 259.01, 0), Point(587.5, 261.99, 0), Point(623.8, 273.63, 0), Point(624.45, 271.65, 0), Point(668.2, 283, 0), Point(664.96, 295.91, 0), Point(650.93, 351.7, 0), Point(649.37, 356.1, 0), Point(635.19, 352.59, 0), Point(635.81, 349.51, 0), Point(621.58, 345.95, 0), Point(616.61, 365.66, 0), Point(552.01, 339.37, 0)], {5}: [Point(706.59, 248.24, 0), Point(732.8, 256.76, 0), Point(742.52, 218.21, 0), Point(740.57, 217.73, 0), Point(718.29, 211.58, 0), Point(716.19, 211.01, 0), Point(715.95, 212.01, 0), Point(706.59, 248.24, 0)], {6}: [Point(154.81, 919.44, 0), Point(160.85, 908.02, 0), Point(161.98, 905.89, 0), Point(172.31, 886.38, 0), Point(173.13, 884.84, 0), Point(182.15, 867.8, 0), Point(193.99, 873.7, 0), Point(188.71, 892.57, 0), Point(188.56, 893.09, 0), Point(188.3, 894.77, 0), Point(183.3, 924.19, 0), Point(181.97, 928.32, 0), Point(179.72, 929.86, 0), Point(177.48, 930.29, 0), Point(175.01, 930.05, 0), Point(154.81, 919.44, 0)], {7}: [Point(-1.76, 923.36, 0), Point(-1.09, 922.16, 0), Point(-0.28, 920.69, 0), Point(14.31, 893.7, 0), Point(30.27, 874.85, 0), Point(32.31, 875.92, 0), Point(47.33, 883.86, 0), Point(49.13, 884.81, 0), Point(63.35, 892.32, 0), Point(64.81, 893.09, 0), Point(54.41, 899.81, 0), Point(48.06, 911.69, 0), Point(42.74, 908.67, 0), Point(28.34, 935.99, 0), Point(27.6, 937.38, 0), Point(26.89, 938.7, 0), Point(-1.76, 923.36, 0)]))
text_11 = Text(Tree({0;0}: ["Kino Femina 06", "ZTM Warszawa", "Tramwaje Warszawskie", "stop_position", "tram_stop", "708506", "yes", "yes", "40x40", "yes", "198013363"], {1;0}: ["Kino Femina 05", "ZTM Warszawa", "Tramwaje Warszawskie", "stop_position", "tram_stop", "708505", "yes", "yes", "40x40", "yes", "334196906"], {2;0}: ["Kino Femina 09", "ZTM Warszawa", "Tramwaje Warszawskie", "stop_position", "tram_stop", "708509", "yes", "yes", "40x40", "yes", "334196908"], {3;0}: ["Kino Femina 10", "ZTM Warszawa", "Tramwaje Warszawskie", "stop_position", "tram_stop", "708510", "yes", "yes", "40x40", "yes", "334196920"], {4;0}: ["Hala Mirowska 04", "ZTM Warszawa", "Tramwaje Warszawskie", "stop_position", "708604", "yes", "no", "yes", "limited", "338509120"], {5;0}: ["Hala Mirowska 03", "ZTM Warszawa", "Tramwaje Warszawskie", "stop_position", "708603", "yes", "yes", "40x40", "yes", "limited", "338509121"]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))
text_12 = Text(Tree({0;0}: ["amenity", "contact:email", "contact:phone", "contact:website", "email", "isced:level", "level", "name", "official_name", "operator", "operator:type", "phone", "ref:regon", "ref:rspo", "website", "wikidata", "wikipedia", "id"], {1;0}: ["addr:city", "addr:city:simc", "addr:door", "addr:housenumber", "addr:postcode", "addr:street", "amenity", "email", "isced:level", "name", "official_name", "operator", "operator:type", "phone", "ref:regon", "ref:rspo", "id"]))
text_13 = Text(Tree({0;0}: ["amenity", "email", "isced:level", "name", "operator", "phone", "ref:regon", "ref:rspo", "website", "id"], {1;0}: ["amenity", "email", "isced:level", "name", "operator", "phone", "ref:regon", "ref:rspo", "website", "id"], {2;0}: ["amenity", "contact:email", "contact:phone", "contact:website", "email", "isced:level", "level", "name", "official_name", "operator", "operator:type", "phone", "ref:regon", "ref:rspo", "website", "wikidata", "wikipedia", "id"], {3;0}: ["amenity", "email", "name", "nursery", "official_name", "operator", "operator:type", "phone", "preschool", "ref:regon", "ref:rspo", "id"], {4;0}: ["addr:city", "addr:housenumber", "addr:postcode", "addr:street", "amenity", "grades", "name", "operator", "operator:type", "website", "id"], {5;0}: ["addr:city", "addr:city:simc", "addr:housenumber", "addr:postcode", "addr:street", "amenity", "email", "name", "official_name", "operator", "operator:type", "phone", "ref:regon", "ref:rspo", "website", "id"], {6;0}: ["amenity", "email", "isced:level", "name", "official_name", "operator", "operator:type", "phone", "ref:regon", "ref:rspo", "website", "id"], {7;0}: ["amenity", "email", "name", "note", "official_name", "operator", "operator:type", "phone", "ref:regon", "ref:rspo", "website", "id"], {8;0}: ["amenity", "email", "isced:level", "name", "note", "official_name", "operator", "operator:type", "phone", "ref:regon", "ref:rspo", "website", "id"], {9;0}: ["amenity", "email", "isced:level", "name", "official_name", "operator", "operator:type", "phone", "ref:regon", "ref:rspo", "website", "id"], {10;0}: ["addr:city", "addr:city:simc", "addr:door", "addr:housenumber", "addr:postcode", "addr:street", "amenity", "email", "isced:level", "name", "official_name", "operator", "operator:type", "phone", "ref:regon", "ref:rspo", "id"]))
text_14 = Text(Tree({0;0}: ["Warszawa", "3", "00-891", "Chłodna", "restaurant", "polish", "no", "Florian", "Mo-Fr 11:00-22:00; PH,Sa,Su 12:00-22:00", "+48226209398", "https://florian.pl/", "280797029"], {1;0}: ["restaurant", "yes", "only", "manager@vega-warszawa.pl", "Vega", "Mo-Su 11:00-20:00", "+48 223535400", "https://www.vega-warszawa.pl/", "no", "314608494"], {2;0}: ["29", "Aleja Jana Pawła II", "restaurant", "2023-05-10", "american", "Chilli Vibes", "Mo-Th 12:00-23:00; Fr-Sa 12:00-24:00; Su 12:00-22:00", "yes", "yes", "427637680"], {3;0}: ["Warszawa", "15", "Chłodna", "restaurant", "asian", "chlodna.kontakt@azia.pl", "+48 730 737 677", "Azia Restaurants", "https://www.azia.pl/?v=9b7d173b068d", "530642383"], {4;0}: ["Warszawa", "36", "Aleja Jana Pawła II", "restaurant", "2023-07-22", "italian", "sanlorenzo@sanlorenzo.pl", "San Lorenzo", "yes", "+48 22 652 16 16; +48 697 079 749", "https://www.sanlorenzo.pl/", "yes", "1280172953"], {5;0}: ["Warszawa", "117", "00-140", "Aleja \"Solidarności\"", "cafe", "Caffè Nero", "Q675808", "en:Caffè Nero", "2023-07-22", "yes", "Green Caffè Nero", "Mo-Fr 07:00-21:00; Sa-Su 08:00-21:00", "yes", "yes", "limited", "1359084858"]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))
text_15 = Text(Tree({0;0}: ["Wola-Ratusz 03", "ZTM Warszawa", "Żelazna 04", "Tramwaje Warszawskie", "stop_position", "tram_stop", "500203", "yes", "yes", "40x40", "yes", "198013354"], {1;0}: ["Kino Femina 06", "ZTM Warszawa", "Tramwaje Warszawskie", "stop_position", "tram_stop", "708506", "yes", "yes", "40x40", "yes", "198013363"], {2;0}: ["Kino Femina 05", "ZTM Warszawa", "Tramwaje Warszawskie", "stop_position", "tram_stop", "708505", "yes", "yes", "40x40", "yes", "334196906"], {3;0}: ["Kino Femina 09", "ZTM Warszawa", "Tramwaje Warszawskie", "stop_position", "tram_stop", "708509", "yes", "yes", "40x40", "yes", "334196908"], {4;0}: ["Kino Femina 10", "ZTM Warszawa", "Tramwaje Warszawskie", "stop_position", "tram_stop", "708510", "yes", "yes", "40x40", "yes", "334196920"], {5;0}: ["Hala Mirowska 04", "ZTM Warszawa", "Tramwaje Warszawskie", "stop_position", "708604", "yes", "no", "yes", "limited", "338509120"]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))
text_16 = Text(Tree({0;0}: ["park", "25748458"], {1;0}: ["park", "Skwer Racheli Auerbach", "Skwer Mieczysława Dawida Apfelbauma", "26260939"], {2;0}: ["Warszawa", "Aleja Piotra Drzewieckiego", "2017-09-22", "7", "GEZ", "park", "park", "Park Mirowski", "SRO34537", "https://eko.um.warszawa.pl/-/park-mirowski", "Q86672111", "pl:Park Mirowski w Warszawie", "34627264"], {3;0}: ["park", "Skwer Psa Fafika", "298748480"], {4;0}: ["park", "Skwer Sybiraków", "493884615"], {5;0}: ["park", "Skwer Isaaca Bashevisa Singera", "Q116619600", "719489379"], {6;0}: ["park", "Skwer Józefa Rotblata", "719497592"], {7;0}: ["park", "1171110797"]))
text_17 = Text(Tree({0;0}: ["park", "25748458"], {1;0}: ["park", "Skwer Psa Fafika", "298748480"], {2;0}: ["park", "Skwer Sybiraków", "493884615"], {3;0}: ["park", "Skwer Isaaca Bashevisa Singera", "Q116619600", "719489379"], {4;0}: ["park", "Skwer Józefa Rotblata", "719497592"]))
text_18 = Text(Tree({0;0}: ["addr:city", "addr:housenumber", "addr:postcode", "addr:street", "amenity", "cuisine", "diet:vegetarian", "name", "opening_hours", "phone", "website", "id"], {1;0}: ["amenity", "diet:vegan", "diet:vegetarian", "email", "name", "opening_hours", "phone", "website", "wheelchair", "id"], {2;0}: ["addr:housenumber", "addr:street", "amenity", "check_date", "cuisine", "name", "opening_hours", "outdoor_seating", "wheelchair", "id"], {3;0}: ["addr:city", "addr:housenumber", "addr:street", "amenity", "cuisine", "email", "mobile", "name", "website", "id"], {4;0}: ["addr:city", "addr:housenumber", "addr:street", "amenity", "check_date", "cuisine", "email", "name", "outdoor_seating", "phone", "website", "wheelchair", "id"], {5;0}: ["addr:city", "addr:housenumber", "addr:street", "amenity", "check_date", "cuisine", "email", "facebook", "internet_access", "name", "opening_hours", "outdoor_seating", "phone", "website", "wheelchair", "id"]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))
text_19 = Text(Tree({0;0}: ["Warszawa", "3", "00-891", "Chłodna", "restaurant", "polish", "no", "Florian", "Mo-Fr 11:00-22:00; PH,Sa,Su 12:00-22:00", "+48226209398", "https://florian.pl/", "280797029"], {1;0}: ["restaurant", "yes", "only", "manager@vega-warszawa.pl", "Vega", "Mo-Su 11:00-20:00", "+48 223535400", "https://www.vega-warszawa.pl/", "no", "314608494"], {2;0}: ["29", "Aleja Jana Pawła II", "restaurant", "2023-05-10", "american", "Chilli Vibes", "Mo-Th 12:00-23:00; Fr-Sa 12:00-24:00; Su 12:00-22:00", "yes", "yes", "427637680"], {3;0}: ["Warszawa", "15", "Chłodna", "restaurant", "asian", "chlodna.kontakt@azia.pl", "+48 730 737 677", "Azia Restaurants", "https://www.azia.pl/?v=9b7d173b068d", "530642383"], {4;0}: ["Warszawa", "36", "Aleja Jana Pawła II", "restaurant", "2023-07-22", "italian", "sanlorenzo@sanlorenzo.pl", "San Lorenzo", "yes", "+48 22 652 16 16; +48 697 079 749", "https://www.sanlorenzo.pl/", "yes", "1280172953"], {5;0}: ["Warszawa", "117", "00-140", "Aleja \"Solidarności\"", "cafe", "Caffè Nero", "Q675808", "en:Caffè Nero", "2023-07-22", "yes", "Green Caffè Nero", "Mo-Fr 07:00-21:00; Sa-Su 08:00-21:00", "yes", "yes", "limited", "1359084858"]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))
point_13 = Point(Tree({0}: [Point(-8.79, 305.29, 0), Point(-6.36, 306.49, 0), Point(-4.21, 307.56, 0), Point(0.98, 297.04, 0), Point(13.96, 301.91, 0), Point(16.86, 295.22, 0), Point(18.74, 296.04, 0), Point(29.01, 274.45, 0), Point(10.43, 265.31, 0), Point(-8.79, 305.29, 0)], {1}: [Point(259.72, 229.49, 0), Point(277.63, 238.64, 0), Point(284.82, 224.66, 0), Point(266.91, 215.5, 0), Point(259.72, 229.49, 0)], {2}: [Point(497.68, 16.87, 0), Point(508.6, -26.15, 0), Point(506.15, -26.94, 0), Point(485.25, -33.86, 0), Point(484.71, -31.66, 0), Point(478.11, -4.62, 0), Point(486.14, 4.2, 0), Point(497.68, 16.87, 0)], {3}: [Point(164.37, 605.19, 0), Point(178.62, 612.9, 0), Point(184, 603.05, 0), Point(169.74, 595.33, 0), Point(164.37, 605.19, 0)], {4}: [Point(98.74, 531.98, 0), Point(98.61, 529.18, 0), Point(99.83, 526.39, 0), Point(102.43, 525.06, 0), Point(106.16, 525.35, 0), Point(107.78, 526.04, 0)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], {5}: [Point(63.6, 541.06, 0), Point(81.33, 550.92, 0), Point(77.07, 559.06, 0), Point(62.95, 552.26, 0), Point(60.97, 548.5, 0), Point(63.6, 541.06, 0)], {6}: [Point(414.19, 41.68, 0), Point(402.32, 37.83, 0), Point(411.43, 2.08, 0), Point(423.16, 5.19, 0), Point(421.76, 10.78, 0), Point(420.28, 16.62, 0), Point(417.49, 18.84, 0), Point(414.56, 17.56, 0), Point(413.82, 23.99, 0), Point(419.23, 24.23, 0), Point(419.31, 28.51, 0), Point(418.41, 37.74, 0), Point(417.07, 39.94, 0), Point(414.19, 41.68, 0)], {7}: [Point(447.44, 493.3, 0), Point(453.14, 482.53, 0), Point(471.69, 492.29, 0), Point(466, 503.05, 0), Point(447.44, 493.3, 0)], {8}: [Point(440.71, 24.05, 0), Point(439.94, 20.24, 0), Point(440.71, 17.17, 0), Point(442.78, 12.02, 0), Point(444.89, 9.8, 0), Point(448.95, 9.92, 0), Point(452.93, 12.02, 0), Point(455.2, 13.69, 0), Point(456.22, 15.55, 0), Point(455.16, 16.73, 0), Point(449.93, 20.28, 0), Point(444.04, 23.32, 0), Point(442.3, 24.13, 0), Point(440.71, 24.05, 0)], {9}: [Point(45.72, 143.77, 0), Point(46.73, 144.21, 0), Point(59.46, 149.82, 0), Point(68.22, 130.02, 0), Point(54.47, 123.97, 0), Point(45.72, 143.77, 0)], {10}: [Point(417.94, 293.12, 0), Point(408.89, 310.85, 0), Point(414.47, 313.67, 0), Point(416.3, 314.61, 0), Point(423.82, 299.86, 0), Point(422.36, 295.63, 0), Point(422.24, 295.3, 0), Point(417.94, 293.12, 0)], {11}: [Point(448.37, 514.74, 0), Point(457.65, 518.82, 0), Point(463.6, 507.84, 0), Point(455.08, 503.23, 0), Point(453.49, 505.96, 0), Point(451.98, 508.54, 0), Point(450.47, 511.13, 0), Point(448.94, 513.77, 0), Point(448.37, 514.74, 0)]))
text_20 = Text(Tree({0;0}: ["school", "21slo@21slo.edu.pl", "+48 226543535", "http://www.21slo.edu.pl", "21slo@21slo.edu.pl", "3", "1", "21 Społeczne Liceum Ogólnokształcące im. Jerzego Grotowskiego", "21 Społeczne Liceum Ogólnokształcące im. Jerzego Grotowskiego", "Stowarzyszenie Sztuka-Edukacja-Promocja", "ngo", "+48 226543535", "146342049", "27999", "http://www.21slo.edu.pl", "Q11683326", "pl:21. Społeczne Liceum Ogólnokształcące im. Jerzego Grotowskiego w Warszawie", "5484936625"], {1;0}: ["Warszawa", "919810", "705", "117", "00-140", "Aleja \"Solidarności\"", "college", "warszawasce@gmail.com", "4", "Szwajcarskie Centrum Edukacji", "Szwajcarskie Centrum Edukacji", "Wyższa Szkoła Stosunków Międzynarodowych I Amerykanistyki W Warszawie", "private", "+48 695777102", "361963380", "127910", "10587718120"]))
text_21 = Text(Tree({0;0}: ["school", "21slo@21slo.edu.pl", "+48 226543535", "http://www.21slo.edu.pl", "21slo@21slo.edu.pl", "3", "1", "21 Społeczne Liceum Ogólnokształcące im. Jerzego Grotowskiego", "21 Społeczne Liceum Ogólnokształcące im. Jerzego Grotowskiego", "Stowarzyszenie Sztuka-Edukacja-Promocja", "ngo", "+48 226543535", "146342049", "27999", "http://www.21slo.edu.pl", "Q11683326", "pl:21. Społeczne Liceum Ogólnokształcące im. Jerzego Grotowskiego w Warszawie", "5484936625"], {1;0}: ["Warszawa", "919810", "705", "117", "00-140", "Aleja \"Solidarności\"", "college", "warszawasce@gmail.com", "4", "Szwajcarskie Centrum Edukacji", "Szwajcarskie Centrum Edukacji", "Wyższa Szkoła Stosunków Międzynarodowych I Amerykanistyki W Warszawie", "private", "+48 695777102", "361963380", "127910", "10587718120"]))
text_22 = Text(Tree({0;0}: ["school", "zs7@zs7.eu", "3", "CXXV Liceum Ogólnokształcące im. Waldemara Milewicza", "m. st. Warszawa", "+48 22 6541601", "015217446", "20580", "https://www.zs7.eu/", "1443527382"], {1;0}: ["school", "zs7@zs7.eu", "3", "Technikum nr 3 im. Ludwika Krzywickiego", "m. st. Warszawa", "+48 22 6541602", "015217417", "20581", "https://www.zs7.eu/", "2361998397"], {2;0}: ["school", "21slo@21slo.edu.pl", "+48 226543535", "http://www.21slo.edu.pl", "21slo@21slo.edu.pl", "3", "1", "21 Społeczne Liceum Ogólnokształcące im. Jerzego Grotowskiego", "21 Społeczne Liceum Ogólnokształcące im. Jerzego Grotowskiego", "Stowarzyszenie Sztuka-Edukacja-Promocja", "ngo", "+48 226543535", "146342049", "27999", "http://www.21slo.edu.pl", "Q11683326", "pl:21. Społeczne Liceum Ogólnokształcące im. Jerzego Grotowskiego w Warszawie", "5484936625"], {3;0}: ["kindergarten", "centrum@academyinternational.pl", "Academy International", "yes", "Academy International Centrum", "Academy International Spółka Z Ograniczoną Odpowiedzialnością", "private", "+48 226540088", "yes", "146437732", "84924", "8857505100"], {4;0}: ["Warszawa", "2A", "01-018", "Wolność", "school", "1-8", "Szkoła Podstawowa", "Szkoła Waldorfska w Warszawie", "private", "https://waldorfska.edu.pl/szkola-podstawowa/", "9643277215"], {5;0}: ["Warszawa", "919884", "97", "01-017", "Żelazna", "kindergarten", "srm@przedszkole217.pl", "Przedszkole nr 217 Sióstr Rodziny Maryi", "Przedszkole nr 217 Sióstr Rodziny Maryi", "Zgromadzenie Sióstr Franciszkanek Rodziny Maryi", "religious", "+48 228383731", "146399492", "40589", "http://www.przedszkole217.pl", "10568157387"], {6;0}: ["school", "szkolaokonska@gmail.com", "3", "Społeczne Liceum Ogólnokształcące nr 25 im. Marzenny Okońskiej", "Społeczne Liceum Ogólnokształcące nr 25 im. Marzenny Okońskiej", "Stowarzyszenie Przyjaciół Xxv Liceum Społecznego", "ngo", "+48 226544550", "146436804", "84867", "https://okonska.edu.pl/", "10587696710"], {7;0}: ["school", "zs85@edu.um.warszawa.pl", "Szkoła Specjalna Przysposabiająca do Pracy nr 5", "Parent RSPO: 12427", "Szkoła Specjalna Przysposabiająca do Pracy nr 5", "Miasto Stołeczne Warszawa", "government", "+48 226205772", "015835865", "105401", "http://www.zssnr85.waw.pl", "10587709838"], {8;0}: ["school", "zs85@edu.um.warszawa.pl", "1;2", "Szkoła Podstawowa Specjalna nr 243", "Parent RSPO: 12427", "Szkoła Podstawowa Specjalna nr 243", "Miasto Stołeczne Warszawa", "government", "+48 226205772", "015835888", "105400", "http://www.zssnr85.waw.pl", "10587709839"], {9;0}: ["school", "sekretariat@sp213.pl", "1;2", "Szkoła Podstawowa Specjalna nr 213", "Szkoła Podstawowa Specjalna nr 213 im. Ireny Sendlerowej", "Miasto Stołeczne Warszawa", "government", "+48 226203931", "000746248", "105394", "https://sp213.pl/", "10587709840"], {10;0}: ["Warszawa", "919810", "705", "117", "00-140", "Aleja \"Solidarności\"", "college", "warszawasce@gmail.com", "4", "Szwajcarskie Centrum Edukacji", "Szwajcarskie Centrum Edukacji", "Wyższa Szkoła Stosunków Międzynarodowych I Amerykanistyki W Warszawie", "private", "+48 695777102", "361963380", "127910", "10587718120"]))
text_23 = Text(Tree({0;0}: ["brand", "brand:wikidata", "brand:wikipedia", "cash_withdrawal", "check_date:opening_hours", "name", "name:pl", "name:uk", "opening_hours", "payment:american_express", "payment:apple_pay", "payment:blik", "payment:cash", "payment:contactless", "payment:diners_club", "payment:google_pay", "payment:maestro", "payment:mastercard", "shop", "website", "wheelchair", "id"], {1;0}: ["check_date", "name", "opening_hours", "operator", "payment:credit_cards", "payment:debit_cards", "shop", "wheelchair", "id"], {2;0}: ["addr:housenumber", "addr:street", "brand", "brand:wikidata", "brand:wikipedia", "check_date", "name", "name:uk", "opening_hours", "shop", "website", "wheelchair", "id"], {3;0}: ["addr:city", "addr:housenumber", "addr:street", "brand", "brand:wikidata", "brand:wikipedia", "check_date", "email", "name", "name:ru", "opening_hours", "operator", "shop", "website", "wheelchair", "id"], {4;0}: ["addr:housenumber", "addr:street", "check_date", "cuisine", "name", "opening_hours", "shop", "wheelchair", "id"], {5;0}: ["addr:city", "addr:housenumber", "addr:street", "brand", "brand:wikidata", "brand:wikipedia", "name", "name:uk", "opening_hours", "shop", "id"]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))
text_24 = Text(Tree({0;0}: ["brand", "brand:wikidata", "brand:wikipedia", "cash_withdrawal", "check_date:opening_hours", "name", "name:pl", "name:uk", "opening_hours", "payment:american_express", "payment:apple_pay", "payment:blik", "payment:cash", "payment:contactless", "payment:diners_club", "payment:google_pay", "payment:maestro", "payment:mastercard", "shop", "website", "wheelchair", "id"], {1;0}: ["check_date", "name", "opening_hours", "operator", "payment:credit_cards", "payment:debit_cards", "shop", "wheelchair", "id"], {2;0}: ["addr:housenumber", "addr:street", "brand", "brand:wikidata", "brand:wikipedia", "check_date", "name", "name:uk", "opening_hours", "shop", "wheelchair", "id"], {3;0}: ["addr:housenumber", "addr:street", "brand", "brand:wikidata", "brand:wikipedia", "check_date", "name", "name:uk", "opening_hours", "shop", "website", "wheelchair", "id"], {4;0}: ["addr:city", "addr:housenumber", "addr:street", "brand", "brand:wikidata", "brand:wikipedia", "check_date", "email", "name", "name:ru", "opening_hours", "operator", "shop", "website", "wheelchair", "id"], {5;0}: ["addr:housenumber", "addr:street", "check_date", "cuisine", "name", "opening_hours", "shop", "wheelchair", "id"]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))
text_25 = Text(Tree({0;0}: ["brand", "brand:wikidata", "brand:wikipedia", "cash_withdrawal", "check_date:opening_hours", "name", "name:pl", "name:uk", "opening_hours", "payment:american_express", "payment:apple_pay", "payment:blik", "payment:cash", "payment:contactless", "payment:diners_club", "payment:google_pay", "payment:maestro", "payment:mastercard", "shop", "website", "wheelchair", "id"], {1;0}: ["check_date", "name", "opening_hours", "operator", "payment:credit_cards", "payment:debit_cards", "shop", "wheelchair", "id"], {2;0}: ["brand", "brand:wikidata", "brand:wikipedia", "check_date", "name", "name:pl", "name:uk", "opening_hours", "shop", "id"], {3;0}: ["brand", "brand:wikidata", "brand:wikipedia", "name", "shop", "wheelchair", "id"], {4;0}: ["addr:housenumber", "addr:postcode", "addr:street", "brand", "brand:wikidata", "brand:wikipedia", "check_date", "email", "name", "name:ru", "opening_hours", "operator", "shop", "website", "wheelchair", "id"], {5;0}: ["addr:housenumber", "addr:street", "brand", "brand:wikidata", "brand:wikipedia", "check_date", "name", "name:uk", "opening_hours", "shop", "wheelchair", "id"]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))
text_26 = Text(Tree({0;0}: ["addr:city", "addr:housenumber", "addr:postcode", "addr:street", "amenity", "cuisine", "diet:vegetarian", "name", "opening_hours", "phone", "website", "id"], {1;0}: ["amenity", "diet:vegan", "diet:vegetarian", "email", "name", "opening_hours", "phone", "website", "wheelchair", "id"], {2;0}: ["addr:housenumber", "addr:street", "amenity", "check_date", "cuisine", "name", "opening_hours", "outdoor_seating", "wheelchair", "id"], {3;0}: ["addr:city", "addr:housenumber", "addr:street", "amenity", "cuisine", "email", "mobile", "name", "website", "id"], {4;0}: ["addr:city", "addr:housenumber", "addr:street", "amenity", "check_date", "cuisine", "email", "name", "outdoor_seating", "phone", "website", "wheelchair", "id"], {5;0}: ["addr:city", "addr:housenumber", "addr:postcode", "addr:street", "amenity", "brand", "brand:wikidata", "brand:wikipedia", "check_date", "diet:vegetarian", "name", "opening_hours", "outdoor_seating", "takeaway", "wheelchair", "id"]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))
point_14 = Point(Tree({0}: [Point(191.42, 155.42, 0), Point(209.33, 164.57, 0), Point(216.52, 150.59, 0), Point(198.61, 141.43, 0), Point(191.42, 155.42, 0)], {1}: [Point(96.07, 531.12, 0), Point(110.32, 538.83, 0), Point(115.7, 528.98, 0), Point(101.44, 521.26, 0), Point(96.07, 531.12, 0)], {2}: [Point(30.44, 457.91, 0), Point(30.31, 455.11, 0), Point(31.53, 452.32, 0), Point(34.13, 450.99, 0), Point(37.86, 451.28, 0), Point(39.48, 451.97, 0)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], {3}: [Point(-4.7, 466.99, 0), Point(13.03, 476.85, 0), Point(8.77, 484.99, 0), Point(-5.35, 478.19, 0), Point(-7.33, 474.43, 0), Point(-4.7, 466.99, 0)], {4}: [Point(379.14, 419.23, 0), Point(384.84, 408.46, 0), Point(403.39, 418.22, 0), Point(397.7, 428.98, 0), Point(379.14, 419.23, 0)], {5}: [Point(349.64, 219.05, 0), Point(340.59, 236.78, 0), Point(346.17, 239.6, 0), Point(348, 240.54, 0), Point(355.52, 225.79, 0), Point(354.06, 221.56, 0), Point(353.94, 221.23, 0), Point(349.64, 219.05, 0)], {6}: [Point(380.07, 440.67, 0), Point(389.35, 444.75, 0), Point(395.3, 433.77, 0), Point(386.78, 429.16, 0), Point(385.19, 431.89, 0), Point(383.68, 434.47, 0), Point(382.17, 437.06, 0), Point(380.64, 439.7, 0), Point(380.07, 440.67, 0)]))
point_15 = Point(Tree({0}: [Point(127.82, 453.64, 0), Point(130.25, 454.84, 0), Point(132.4, 455.91, 0), Point(137.59, 445.39, 0), Point(150.57, 450.26, 0), Point(153.47, 443.57, 0), Point(155.35, 444.39, 0), Point(165.62, 422.8, 0), Point(147.04, 413.66, 0), Point(127.82, 453.64, 0)], {1}: [Point(852.71, 724.48, 0), Point(854.89, 725.09, 0), Point(856.9, 727.26, 0), Point(858.9, 727.53, 0), Point(861.19, 726.42, 0), Point(862.08, 723.86, 0), Point(862.14, 722.42, 0), Point(863.64, 721.42, 0), Point(865.7, 720.47, 0), Point(867.26, 717.63, 0), Point(866.31, 714.75, 0), Point(860.35, 712.92, 0), Point(855.83, 712.42, 0), Point(853.05, 713.64, 0), Point(852.43, 715.53, 0), Point(852.38, 717.47, 0), Point(851.09, 719.03, 0), Point(850.32, 720.64, 0), Point(851.04, 723.03, 0), Point(852.71, 724.48, 0)], {2}: [Point(952, 330.44, 0), Point(963.77, 333.41, 0), Point(968.09, 316.36, 0), Point(961.69, 314.73, 0), Point(961.21, 316.67, 0), Point(953.75, 314.79, 0), Point(951.61, 323.23, 0), Point(953.69, 323.75, 0), Point(952, 330.44, 0)], {3}: [Point(750.24, 4.23, 0), Point(732.59, -0.4800000004, 0), Point(733.07, -2.26, 0), Point(727, -3.87, 0), Point(727.36, -5.21, 0), Point(724.92, -5.86, 0), Point(726.35, -11.21, 0), Point(752.51, -4.24, 0), Point(750.24, 4.23, 0)], {4}: [Point(396.33, 377.84, 0), Point(414.24, 386.99, 0), Point(421.43, 373.01, 0), Point(403.52, 363.85, 0), Point(396.33, 377.84, 0)], {5}: [Point(300.88, 29.02, 0), Point(297.97, 36.34, 0), Point(292.51, 50.11, 0), Point(288.33, 48.47, 0), Point(277.49, 44.19, 0), Point(285.86, 23.1, 0), Point(300.88, 29.02, 0)]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))
text_27 = Text(Tree({0;0}: ["addr:city", "addr:housenumber", "addr:postcode", "addr:street", "amenity", "cuisine", "diet:vegetarian", "name", "opening_hours", "phone", "website", "id"], {1;0}: ["amenity", "diet:vegan", "diet:vegetarian", "email", "name", "opening_hours", "phone", "website", "wheelchair", "id"], {2;0}: ["addr:housenumber", "addr:street", "amenity", "check_date", "cuisine", "name", "opening_hours", "outdoor_seating", "wheelchair", "id"], {3;0}: ["addr:city", "addr:housenumber", "addr:street", "amenity", "cuisine", "email", "mobile", "name", "website", "id"], {4;0}: ["addr:city", "addr:housenumber", "addr:street", "amenity", "check_date", "cuisine", "email", "name", "outdoor_seating", "phone", "website", "wheelchair", "id"], {5;0}: ["addr:city", "addr:housenumber", "addr:postcode", "addr:street", "amenity", "brand", "brand:wikidata", "brand:wikipedia", "check_date", "diet:vegetarian", "name", "opening_hours", "outdoor_seating", "takeaway", "wheelchair", "id"]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))
text_28 = Text(Tree({0;0}: ["playground", "335046441"], {1;0}: ["playground", "709790395"], {2;0}: ["private", "fence", "playground", "Academy International", "957204430"], {3;0}: ["playground", "968156992"], {4;0}: ["playground", "968156997"], {5;0}: ["playground", "968156998"], {6;0}: ["yes", "playground", "971354945"], {7;0}: ["yes", "playground", "1039573231"], {8;0}: ["yes", "playground", "1049243386"], {9;0}: ["yes", "playground", "1059592054"], {10;0}: ["playground", "1120860604"], {11;0}: ["yes", "playground", "1128083300"]))
point_16 = Point(Tree({0}: [Point(295.93, 88.62, 0)], {1}: [Point(356.39, 560.78, 0)], {2}: [Point(505.34, 51.86, 0)], {3}: [Point(476.19, 563.55, 0)], {4}: [Point(476, 352.78, 0)], {5}: [Point(102.25, 367.08, 0)]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))
point_17 = Point(Tree({0}: [Point(364.23, 162.69, 0)], {1}: [Point(424.69, 634.85, 0)], {2}: [Point(652.51, 82.94, 0)], {3}: [Point(573.64, 125.93, 0)], {4}: [Point(544.49, 637.62, 0)], {5}: [Point(544.3, 426.85, 0)]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))
point_18 = Point(Tree({0}: [Point(500.84, 311.04, 0)], {1}: [Point(561.3, 783.2, 0)], {2}: [Point(94.62, 469.08, 0)], {3}: [Point(850.11, 441.87, 0)], {4}: [Point(718.59, 109.86, 0)], {5}: [Point(365.39, 91.37, 0)]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))
text_29 = Text(Tree({0;0}: ["playground", "709790395"], {1;0}: ["playground", "968156992"], {2;0}: ["playground", "968156997"], {3;0}: ["playground", "968156998"], {4;0}: ["yes", "playground", "1039573231"], {5;0}: ["playground", "1120860604"], {6;0}: ["yes", "playground", "1128083300"]))
text_30 = Text(Tree({0;0}: ["playground", "335046441"], {1;0}: ["playground", "379019979"], {2;0}: ["private", "playground", "460635763"], {3;0}: ["private", "Plac zabaw należący do Szkoły Podstawowej nr 25", "playground", "492563688"], {4;0}: ["playground", "709790395"], {5;0}: ["private", "playground", "853012994"]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))
text_31 = Text(Tree({0;0}: ["leisure", "id"], {1;0}: ["leisure", "id"], {2;0}: ["access", "barrier", "leisure", "operator", "id"], {3;0}: ["leisure", "id"], {4;0}: ["leisure", "id"], {5;0}: ["leisure", "id"], {6;0}: ["access", "leisure", "id"], {7;0}: ["access", "leisure", "id"], {8;0}: ["access", "leisure", "id"], {9;0}: ["access", "leisure", "id"], {10;0}: ["leisure", "id"], {11;0}: ["access", "leisure", "id"]))
text_32 = Text(Tree({0;0}: ["Żabka", "Q2589061", "pl:Żabka (sieć sklepów)", "yes", "2022-12-23", "Żabka", "Żabka", "Жабка", "Mo-Sa 06:00-23:00", "yes", "yes", "yes", "yes", "yes", "yes", "yes", "yes", "yes", "convenience", "https://www.zabka.pl/", "yes", "402531052"], {1;0}: ["2022-07-24", "Społem Wola", "24/7", "Społem", "yes", "yes", "supermarket", "limited", "613500895"], {2;0}: ["Żabka", "Q2589061", "pl:Żabka (sieć sklepów)", "2022-10-22", "Żabka", "Żabka", "Жабка", "Mo-Su 06:00-23:00", "convenience", "1774843106"], {3;0}: ["Społem", "Q11826043", "pl:Powszechna Spółdzielnia Spożywców „Społem”", "Społem", "convenience", "limited", "1775043219"], {4;0}: ["32", "00-863", "Grzybowska", "Biedronka", "Q857182", "pl:Biedronka (sieć handlowa)", "2023-09-22", "bok@biedronka.eu", "Biedronka", "Бедронка", "Mo-Sa 06:00-23:30; Su 08:00-23:00 \"tylko niedziele handlowe\"", "Jeronimo Martins Polska S.A.", "supermarket", "https://www.biedronka.pl", "yes", "2548265062"], {5;0}: ["67", "Żelazna", "Żabka", "Q2589061", "pl:Żabka (sieć sklepów)", "2023-09-22", "Żabka", "Жабка", "Mo-Sa 06:00-23:00; Su 11:00-20:00", "convenience", "yes", "3026859494"]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))
point_19 = Point(Tree({0}: [Point(628.22, 395.4, 0)], {1}: [Point(733.68, 706.29, 0)], {2}: [Point(711.48, 430.7, 0)], {3}: [Point(388.39, 265.27, 0)], {4}: [Point(727.48, 658.89, 0)], {5}: [Point(821.88, 535.23, 0)]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))
text_33 = Text(Tree({0;0}: ["leisure", "id"], {1;0}: ["leisure", "id"], {2;0}: ["leisure", "id"], {3;0}: ["leisure", "id"], {4;0}: ["access", "leisure", "id"], {5;0}: ["leisure", "id"], {6;0}: ["access", "leisure", "id"]))
text_34 = Text(Tree({0;0}: ["leisure", "id"], {1;0}: ["leisure", "id"], {2;0}: ["access", "leisure", "id"], {3;0}: ["access", "description", "leisure", "id"], {4;0}: ["leisure", "id"], {5;0}: ["access", "leisure", "id"]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))
text_35 = Text(Tree({0;0}: ["Żabka", "Q2589061", "pl:Żabka (sieć sklepów)", "yes", "2022-12-23", "Żabka", "Żabka", "Жабка", "Mo-Sa 06:00-23:00", "yes", "yes", "yes", "yes", "yes", "yes", "yes", "yes", "yes", "convenience", "https://www.zabka.pl/", "yes", "402531052"], {1;0}: ["2022-07-24", "Społem Wola", "24/7", "Społem", "yes", "yes", "supermarket", "limited", "613500895"], {2;0}: ["2", "Krochmalna", "Żabka", "Q2589061", "pl:Żabka (sieć sklepów)", "2023-09-22", "Żabka", "Жабка", "Mo-Sa 06:00-23:00; Su 09:00-21:00", "convenience", "https://www.zabka.pl/", "yes", "4095861022"], {3;0}: ["Warszawa", "115", "Aleja \"Solidarności\"", "Biedronka", "Q857182", "pl:Biedronka (sieć handlowa)", "2022-08-06", "bok@biedronka.eu", "Biedronka", "Бедронка", "Mo-Sa 06:00-23:00", "Jeronimo Martins Polska S.A.", "supermarket", "https://www.biedronka.pl", "yes", "4574038921"], {4;0}: ["1A", "Ogrodowa", "2023-05-10", "indian", "Delikatesy Indyjskie", "Mo-Sa 11:00-21:00; Su 10:00-21:00; PH off", "convenience", "yes", "4602946363"], {5;0}: ["Warszawa", "129/131", "Aleja \"Solidarności\"", "Żabka", "Q2589061", "pl:Żabka (sieć sklepów)", "Żabka", "Жабка", "Mo-Su 09:00-23:00", "convenience", "4828193521"]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))
text_36 = Text(Tree({0;0}: ["Żabka", "Q2589061", "pl:Żabka (sieć sklepów)", "yes", "2022-12-23", "Żabka", "Żabka", "Жабка", "Mo-Sa 06:00-23:00", "yes", "yes", "yes", "yes", "yes", "yes", "yes", "yes", "yes", "convenience", "https://www.zabka.pl/", "yes", "402531052"], {1;0}: ["2022-07-24", "Społem Wola", "24/7", "Społem", "yes", "yes", "supermarket", "limited", "613500895"], {2;0}: ["25", "Aleja Jana Pawła II", "Żabka", "Q2589061", "pl:Żabka (sieć sklepów)", "2023-05-10", "Żabka", "Жабка", "Mo-Sa 06:00-23:00; Su 11:00-21:00", "convenience", "yes", "3880363720"], {3;0}: ["2", "Krochmalna", "Żabka", "Q2589061", "pl:Żabka (sieć sklepów)", "2023-09-22", "Żabka", "Жабка", "Mo-Sa 06:00-23:00; Su 09:00-21:00", "convenience", "https://www.zabka.pl/", "yes", "4095861022"], {4;0}: ["Warszawa", "115", "Aleja \"Solidarności\"", "Biedronka", "Q857182", "pl:Biedronka (sieć handlowa)", "2022-08-06", "bok@biedronka.eu", "Biedronka", "Бедронка", "Mo-Sa 06:00-23:00", "Jeronimo Martins Polska S.A.", "supermarket", "https://www.biedronka.pl", "yes", "4574038921"], {5;0}: ["1A", "Ogrodowa", "2023-05-10", "indian", "Delikatesy Indyjskie", "Mo-Sa 11:00-21:00; Su 10:00-21:00; PH off", "convenience", "yes", "4602946363"]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))
point_20 = Point(Tree({0}: [Point(423.31, 172.98, 0)], {1}: [Point(528.77, 483.87, 0)], {2}: [Point(506.57, 208.28, 0)], {3}: [Point(183.48, 42.85, 0)], {4}: [Point(522.57, 436.47, 0)], {5}: [Point(464.45, 544.22, 0)]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))
point_21 = Point(Tree({0}: [Point(491.61, 247.05, 0)], {1}: [Point(597.07, 557.94, 0)], {2}: [Point(574.87, 282.35, 0)], {3}: [Point(251.78, 116.92, 0)], {4}: [Point(590.87, 510.54, 0)], {5}: [Point(532.75, 618.29, 0)]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))
curve = Curve(Tree({0}: [], {1}: [], {2}: [], {3}: [], {4}: [], {5}: []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))
curve_2 = Curve(Tree({0}: [], {1}: [], {2}: [], {3}: [], {4}: [], {5}: []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))
curve_3 = Curve(Tree({0}: [], {1}: [], {2}: [], {3}: [], {4}: [], {5}: []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))
curve_4 = Curve(Tree({0}: [], {1}: [], {2}: [], {3}: [], {4}: [], {5}: []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))
curve_5 = Curve(Tree({0}: [], {1}: [], {2}: [], {3}: [], {4}: [], {5}: []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))
curve_6 = Curve(Tree({0}: [], {1}: [], {2}: [], {3}: [], {4}: [], {5}: []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))
stream_filter = StreamFilter(Gate=integer_2, Stream0=point_10, Stream1=point_11, Stream2=point_12)
stream_filter_2 = StreamFilter(Gate=integer_2, Stream0=text_2, Stream1=text_3, Stream2=text_4)
stream_filter_3 = StreamFilter(Gate=integer_2, Stream0=text_8, Stream1=text_17, Stream2=text_16)
stream_filter_4 = StreamFilter(Gate=integer_2, Stream0=point_4, Stream1=point_5, Stream2=point_6)
stream_filter_5 = StreamFilter(Gate=integer_2, Stream0=point_14, Stream1=point_13, Stream2=point_15)
stream_filter_6 = StreamFilter(Gate=integer_2, Stream0=text, Stream1=text_5, Stream2=text_6)
stream_filter_7 = StreamFilter(Gate=integer_2, Stream0=text_9, Stream1=text_11, Stream2=text_15)
stream_filter_8 = StreamFilter(Gate=integer_2, Stream0=text_33, Stream1=text_31, Stream2=text_34)
stream_filter_9 = StreamFilter(Gate=integer_2, Stream0=text_29, Stream1=text_28, Stream2=text_30)
stream_filter_10 = StreamFilter(Gate=integer_2, Stream0=point_7, Stream1=point_8, Stream2=point_9)
stream_filter_11 = StreamFilter(Gate=integer_2, Stream0=text_12, Stream1=text_10, Stream2=text_13)
stream_filter_12 = StreamFilter(Gate=integer_2, Stream0=text_20, Stream1=text_21, Stream2=text_22)
stream_filter_13 = StreamFilter(Gate=integer_2, Stream0=point_16, Stream1=point_17, Stream2=point_18)
stream_filter_14 = StreamFilter(Gate=integer_2, Stream0=text_23, Stream1=text_24, Stream2=text_25)
stream_filter_15 = StreamFilter(Gate=integer_2, Stream0=text_35, Stream1=text_36, Stream2=text_32)
stream_filter_16 = StreamFilter(Gate=integer_2, Stream0=point_20, Stream1=point_21, Stream2=point_19)
stream_filter_17 = StreamFilter(Gate=integer_2, Stream0=text_26, Stream1=text_27, Stream2=text_18)
stream_filter_18 = StreamFilter(Gate=integer_2, Stream0=text_14, Stream1=text_19, Stream2=text_7)
curve_7 = Curve(Tree({0}: [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], {1}: [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], {2}: [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], {3}: [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], {4}: [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], {5}: [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]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))
curve_8 = Curve(Tree({0}: [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], {1}: [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], {2}: [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], {3}: [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], {4}: [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], {5}: [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]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))
curve_9 = Curve(Tree({0}: [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], {1}: [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], {2}: [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], {3}: [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], {4}: [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], {5}: [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]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))
stream_filter_19 = StreamFilter(Gate=integer_2, Stream0=curve_3, Stream1=curve, Stream2=curve_2)
stream_filter_20 = StreamFilter(Gate=integer_2, Stream0=curve_4, Stream1=curve_5, Stream2=curve_6)
stream_filter_21 = StreamFilter(Gate=integer_2, Stream0=curve_7, Stream1=curve_9, Stream2=curve_8)
stream_filter_22 = StreamFilter(
    Gate=integer_4,
    Stream0=stream_filter,
    Stream1=stream_filter_5,
    Stream2=stream_filter_13,
    Stream3=stream_filter_16,
    Stream4=stream_filter_4,
    Stream5=stream_filter_10)
stream_filter_23 = StreamFilter(
    Gate=integer_4,
    Stream0=stream_filter_2,
    Stream1=stream_filter_8,
    Stream2=stream_filter_14,
    Stream3=stream_filter_17,
    Stream4=stream_filter_6,
    Stream5=stream_filter_11)
stream_filter_24 = StreamFilter(
    Gate=integer_4,
    Stream0=stream_filter_3,
    Stream1=stream_filter_9,
    Stream2=stream_filter_15,
    Stream3=stream_filter_18,
    Stream4=stream_filter_7,
    Stream5=stream_filter_12)
larger_than = LargerThan(FirstNumber=integer_4, SecondNumber=2)  # -> LargerThan, OrEqualTo
dispatch = Dispatch(List=stream_filter_22, DispatchPattern=larger_than.LargerThan)  # -> ListA, ListB

polyline_4 = PolyLine(Vertices=dispatch.ListB, Closed=False)
unit_z = UnitZ(Factor=0.1)
curve_10 = Curve(flatten(polyline_4))
extrude = Extrude(Base=curve_10, Direction=unit_z)
clean_tree = CleanTree(RemoveNulls=True, RemoveInvalid=True, RemoveEmpty=invert(False), Tree=extrude)

panel_21 = Panel(stream_filter_23)
panel_22 = Panel(stream_filter_24)
cull_index = CullIndex(List=panel_21, Indices=0, Wrap=True)
cull_index_2 = CullIndex(List=panel_22, Indices=0, Wrap=True)
concatenate = Concatenate(Fragment_A=cull_index, A=" : ", Fragment_B=cull_index_2)
panel_23 = Panel(concatenate)
text_join_2 = TextJoin(Text=panel_23)  # -> flatten(Result)
panel_24 = Panel(text_join_2)

# ----
# It's ok, if it fails to collect data
merge = Merge(Data1=dispatch.ListA)
cap_holes = CapHoles(Brep=clean_tree)
mesh_brep = MeshBrep(
    Brep=cap_holes,
    Settings={GridMaxCount=0, GridMinCount=16, JaggedSeams=False, MaxEdgeLength=0, MinEdgeLength=0.0001, MinTolerance=0, Refine=True, RefineAngle=0, RelativeTolerance=0.65, SimplePlanes=True, Tolerance=0})
mesh_sphere = MeshSphere(Base=flatten(merge), Radius="8", UCount=10, VCount=20)
merge_2 = Merge(Data1=flatten(mesh_brep), Data2=flatten(mesh_sphere))

c_script = CSharpScript()  # -> fonts
# ---------- c_script: C# ----------
    fonts = Rhino.DocObjects.Font.AvailableFontFaceNames();
# ---------- end c_script ----------
item = ListItem(List=c_script, Index=Slider(45, range=0..423), Wrap=True)

integer_5 = Integer(Slider(250, range=100..500))
data_radius = GetInteger(integer_5, AtLeast=1, AtMost=1, Maximum=2147483647, Minimum=-2147483648, TreeAccess=False)
integer_6 = Integer(data_radius)

_3d_inside = GetBoolean(Toggle(True), AtLeast=1, AtMost=1, FalseValue="False", TreeAccess=False, TrueValue="True")
boolean = Boolean(_3d_inside)

merge_3 = Merge(Data1=polyline_4, Data2=dispatch.ListA)
bounding_box = BoundingBox(Content=flatten(merge_3), Plane=PlaneXY(0, 0, 0), UnionBox=True)  # -> Box, Box_2
bounding_box_2 = BoundingBox(Content=flatten(stream_filter_21), Plane=PlaneXY(0, 0, 0), UnionBox=True)  # -> Box, Box_2
bounding_box_3 = BoundingBox(Content=flatten([bounding_box_2.Box, bounding_box.Box]), Plane=PlaneXY(0, 0, 0), UnionBox=True)  # -> Box, Box_2
deconstruct_brep = DeconstructBrep(Brep=bounding_box_3.Box)  # -> Faces, Edges, Vertices
surface = Surface(deconstruct_brep.Faces)
area = Area(Geometry=surface)  # -> Area, Centroid
unit_z_2 = UnitZ(Factor="50")
scale = Scale(Geometry=surface, Center=area.Centroid, Factor="1.1")  # -> Geometry, Transform
negative = Negative(Value=unit_z_2)
extrude_2 = Extrude(Base=scale.Geometry, Direction=negative)
brep = Brep(extrude_2)
curve_11 = Curve(flatten(stream_filter_19))
curve_12 = Curve(flatten(stream_filter_20))
trim_with_breps = TrimWithBreps(Curve=curve_12, Brep=brep)  # -> Inside, Outside
trim_with_breps_2 = TrimWithBreps(Curve=curve_11, Brep=brep)  # -> Inside, Outside

area_2 = Area(Geometry=scale.Geometry)  # -> Area, Centroid
m2 = Panel(area_2.Area)
number_3 = Number(expr("Round(x,2)", m2))
multiplication = Multiplication(A=number_3, B="0.000001")

deconstruct_brep_2 = DeconstructBrep(Brep=scale.Geometry)  # -> Faces, Edges, Vertices
division_3 = Division(A=negative, B=2)
curve_13 = Curve(deconstruct_brep_2.Edges)
move = Move(Geometry=curve_13, Motion=division_3)  # -> Geometry, Transform
offset_curve = OffsetCurve(Curve=move.Geometry, Distance=Slider(50, range=0..100), Corners=1)  # -> flatten(Curve)
end_points = EndPoints(Curve=move.Geometry)  # -> Start, End
end_points_2 = EndPoints(Curve=offset_curve)  # -> Start, End
line = Line(StartPoint=end_points.Start, EndPoint=end_points_2.Start)
line_2 = Line(StartPoint=end_points.End, EndPoint=end_points_2.End)
end_points_3 = EndPoints(Curve=line)  # -> Start, End
end_points_4 = EndPoints(Curve=line_2)  # -> Start, End
scale_2 = Scale(Geometry=line, Center=end_points_3.End, Factor="0.3")  # -> Geometry, Transform
scale_3 = Scale(Geometry=line_2, Center=end_points_4.End, Factor="0.3")  # -> Geometry, Transform
vector = Vector(scale_2.Geometry)
vector_2 = Vector(scale_3.Geometry)
move_2 = Move(Geometry=scale_2.Geometry, Motion=vector)  # -> Geometry, Transform
move_3 = Move(Geometry=scale_3.Geometry, Motion=vector_2)  # -> Geometry, Transform
join_curves = JoinCurves(Curves=[scale_2.Geometry, move_2.Geometry], Preserve=False)
join_curves_2 = JoinCurves(Curves=[scale_3.Geometry, move_3.Geometry], Preserve=False)

volume = Volume(Geometry=brep)  # -> Volume, Centroid
orient = Orient(Geometry=brep, Source=volume.Centroid, Target="0,0,0")  # -> Geometry, Transform
volume_2 = Volume(Geometry=orient.Geometry)  # -> Volume, Centroid
vector_2pt = Vector2Pt(PointA=volume.Centroid, PointB=volume_2.Centroid, Unitize=False)  # -> Vector, Length

simple_mesh = SimpleMesh(Brep=orient.Geometry)
deconstruct_mesh = DeconstructMesh(Mesh=flatten(simple_mesh))  # -> Vertices, Faces, Colours, Normals

length = Length(Curve=move.Geometry)
concatenate_2 = Concatenate(FragmentA=length, FragmentB=" m")

number_4 = Number(expr("Round(x,2)", multiplication))
context_print = ContextPrint(Text=number_4)

clean_tree_2 = CleanTree(RemoveNulls=True, RemoveInvalid=True, RemoveEmpty=invert(False), Tree=merge_2)
move_4 = Move(Geometry=clean_tree_2, Motion=vector_2pt.Vector)  # -> Geometry, Transform
mesh = Mesh(move_4.Geometry)
deconstruct_mesh_2 = DeconstructMesh(Mesh=flatten(mesh))  # -> Vertices, Faces, Colours, Normals

panel_25 = Panel(item)
c_script_2 = CSharpScript(face=panel_25, bold=Toggle(False), italics=Toggle(False), size=Slider(10, range=1..20), content=concatenate_2)  # -> out, A; inputs face: String, bold: Boolean, italics: Boolean, size: Double, content: String
# ---------- c_script_2: C# ----------
    if(content != null && content != String.Empty
    && face != null && face != String.Empty ){

      if(size == 0)
        size = 5;

      Rhino.DocObjects.Font.FontStyle fontStyle = Rhino.DocObjects.Font.FontStyle.Upright;
      if (italics) fontStyle = Rhino.DocObjects.Font.FontStyle.Italic;
      Rhino.DocObjects.Font.FontWeight fontWeight = Rhino.DocObjects.Font.FontWeight.Normal;
      if (bold) fontWeight = Rhino.DocObjects.Font.FontWeight.Bold;

      bool underlined = false;
      bool strikethrough = false;

      Rhino.DocObjects.Font font = new Rhino.DocObjects.Font(face, fontWeight, fontStyle, underlined, strikethrough);


      TextEntity text_entity = new TextEntity
        {
          Plane = Plane.WorldXY,
          PlainText = content,
          Justification = TextJustification.MiddleCenter,
          Font = font
          };
      Rhino.DocObjects.DimensionStyle dimstyle = new Rhino.DocObjects.DimensionStyle();
      dimstyle.TextHeight = size;
      double smallCapsScale = 1;
      double spacing = 0;
      A = text_entity.CreateSurfaces(dimstyle, smallCapsScale, spacing);



    } else {

      Print("Some content is required.");

    }
# ---------- end c_script_2 ----------
mesh_2 = Mesh(c_script_2.A)
mesh_join = MeshJoin(Meshes=mesh_2)  # -> flatten(Mesh)

km2 = Panel(number_4)

brep_2 = Brep(orient.Geometry)
deconstruct_brep_3 = DeconstructBrep(Brep=brep_2)  # -> Faces, Edges, Vertices
area_3 = Area(Geometry=brep_2)  # -> Area, Centroid
unit_z_3 = UnitZ(Factor=1)
list_item = ListItem(List=deconstruct_brep_3.Faces, Index=0, Wrap=True)
project_point = ProjectPoint(Point=area_3.Centroid, Direction=unit_z_3, Geometry=list_item)  # -> Point, Index

construct_mesh = ConstructMesh(Vertices=deconstruct_mesh.Vertices, Faces=deconstruct_mesh.Faces, Colours=ColourSwatch(SwatchColor=RGB(204, 204, 204)))
context_bake = ContextBake(Geometry=construct_mesh)

list_length = ListLength(List=mesh)
context_print_2 = ContextPrint(AmenitiesNumber=list_length)

division_4 = Division(A=1, B=number_4)
multiplication_2 = Multiplication(A=division_4, B=list_length)

number_5 = Number(expr("Round(x,2)", multiplication_2))
context_print_3 = ContextPrint(AmenitiesPerArea=number_5)

panel_26 = Panel(number_5)

stream_filter_25 = StreamFilter(
    Gate=integer_4,
    Stream0=ColourSwatch(SwatchColor=RGB(125, 194, 64)),
    Stream1=ColourSwatch(SwatchColor=RGB(212, 87, 174)),
    Stream2=ColourSwatch(SwatchColor=RGB(194, 64, 64)),
    Stream3=ColourSwatch(SwatchColor=RGB(219, 196, 64)),
    Stream4=ColourSwatch(SwatchColor=RGB(47, 222, 219)),
    Stream5=ColourSwatch(SwatchColor=RGB(161, 92, 214)))
construct_mesh_2 = ConstructMesh(Vertices=deconstruct_mesh_2.Vertices, Faces=deconstruct_mesh_2.Faces, Colours=stream_filter_25)  # -> flatten(Mesh)
context_bake_2 = ContextBake(Amenities=construct_mesh_2)

bounding_box_4 = BoundingBox(Content=mesh_join, Plane=PlaneXY(0, 0, 0))  # -> Box, Box_2
curve_middle = CurveMiddle(Curve=offset_curve)
volume_3 = Volume(Geometry=bounding_box_4.Box)  # -> Volume, Centroid
orient_2 = Orient(Geometry=mesh_join, Source=volume_3.Centroid, Target=curve_middle)  # -> Geometry, Transform
series = Series(Start=0, Step=90, Count=4)
rotate = Rotate(Geometry=orient_2.Geometry, Angle=degrees(series), Plane=curve_middle)  # -> Geometry, Transform
unit_z_4 = UnitZ(Factor=5)
move_5 = Move(Geometry=rotate.Geometry, Motion=unit_z_4)  # -> Geometry, Transform
move_6 = Move(Geometry=move_5.Geometry, Motion=vector_2pt.Vector)  # -> Geometry, Transform
deconstruct_mesh_3 = DeconstructMesh(Mesh=flatten(move_6.Geometry))  # -> Vertices, Faces, Colours, Normals

inspect_building = InspectBuilding(Building=stream_filter_21, DefaultHeight="12")  # -> Geometry, Metadata, Amenity, BuildingMesh
mesh_3 = Mesh(flatten(inspect_building.BuildingMesh))
curve_14 = Curve(flatten(inspect_building.Geometry))
clean_tree_3 = CleanTree(RemoveNulls=True, RemoveInvalid=True, RemoveEmpty=invert(False), Tree=mesh_3)
clean_tree_4 = CleanTree(RemoveNulls=True, RemoveInvalid=True, RemoveEmpty=invert(False), Tree=curve_14)
move_7 = Move(Geometry=clean_tree_4, Motion=vector_2pt.Vector)  # -> Geometry, Transform
move_8 = Move(Geometry=clean_tree_3, Motion=vector_2pt.Vector)  # -> Geometry, Transform

move_9 = Move(Geometry=trim_with_breps_2.Inside, Motion=vector_2pt.Vector)  # -> Geometry, Transform
curve_15 = Curve(flatten(move_9.Geometry))
colour_swatch = ColourSwatch(SwatchColor=RGB(59, 59, 59))
preview = CustomPreview(Geometry=curve_15, Material=colour_swatch)
clean_tree_5 = CleanTree(RemoveNulls=True, RemoveInvalid=True, RemoveEmpty=invert(False), Tree=curve_15)

move_10 = Move(Geometry=trim_with_breps.Inside, Motion=vector_2pt.Vector)  # -> Geometry, Transform
colour_swatch_2 = ColourSwatch(SwatchColor=RGB(115, 115, 115))
curve_16 = Curve(flatten(move_10.Geometry))
uservalue = Text(colour_swatch_2)
userkey = Text("color")
preview_2 = CustomPreview(Geometry=curve_16, Material=colour_swatch_2)
clean_tree_6 = CleanTree(RemoveNulls=True, RemoveInvalid=True, RemoveEmpty=invert(False), Tree=curve_16)

inputpoint = GetPoint(project_point.Point, AtLeast=1, AtMost=1, Realtime=True, TreeAccess=False)

uservalue_2 = Text(colour_swatch)
userkey_2 = Text("color")

move_11 = Move(Geometry=[offset_curve, join_curves, join_curves_2], Motion=vector_2pt.Vector)  # -> Geometry, Transform
curve_17 = Curve(move_11.Geometry)
colour_swatch_3 = ColourSwatch(SwatchColor=RGB(0, 0, 0))
preview_3 = CustomPreview(Geometry=curve_17, Material=colour_swatch_3)

circle = Circle(Plane=inputpoint, Radius=integer_6)
unit_z_5 = UnitZ(Factor=50)
unit_z_6 = UnitZ(Factor=-50)
extrude_3 = Extrude(Base=circle, Direction=[unit_z_5, unit_z_6])
brep_join = BrepJoin(Breps=extrude_3)  # -> Breps, Closed
cap_holes_2 = CapHoles(Brep=brep_join.Breps)

c_script_3 = CSharpScript(geometry=clean_tree_6, userKey=userkey, userValue=uservalue)  # -> out, geoWithUserString; inputs geometry: GeometryBase, userKey: String, userValue: String
# ---------- c_script_3: C# ----------
    geometry.SetUserString(userKey, userValue);
   geoWithUserString = geometry;
# ---------- end c_script_3 ----------
context_bake_3 = ContextBake(Sidewalks=c_script_3.geoWithUserString)

c_script_4 = CSharpScript(geometry=clean_tree_5, userKey=userkey_2, userValue=uservalue_2)  # -> out, geoWithUserString; inputs geometry: GeometryBase, userKey: String, userValue: String
# ---------- c_script_4: C# ----------
    geometry.SetUserString(userKey, userValue);
    geoWithUserString = geometry;
# ---------- end c_script_4 ----------
context_bake_4 = ContextBake(Geometry=c_script_4.geoWithUserString)

pipe = Pipe(Curve=circle, Radius=1.2, Caps=0)
mesh_brep_2 = MeshBrep(
    Brep=pipe,
    Settings={GridMaxCount=0, GridMinCount=16, JaggedSeams=False, MaxEdgeLength=0, MinEdgeLength=0.0001, MinTolerance=0, Refine=True, RefineAngle=0, RelativeTolerance=0.65, SimplePlanes=True, Tolerance=0})
deconstruct_mesh_4 = DeconstructMesh(Mesh=flatten(mesh_brep_2))  # -> Vertices, Faces, Colours, Normals

area_4 = Area(Geometry=move_7.Geometry)  # -> Area, Centroid
point_in_brep = PointInBrep(Brep=cap_holes_2, Point=area_4.Centroid, Strict=False)
dispatch_2 = Dispatch(List=move_8.Geometry, DispatchPattern=point_in_brep)  # -> ListA, ListB
dispatch_3 = Dispatch(List=move_7.Geometry, DispatchPattern=point_in_brep)  # -> ListA, ListB
mesh_4 = Mesh(dispatch_2.ListB)
curve_18 = Curve(dispatch_3.ListA)
mesh_5 = Mesh(dispatch_2.ListA)
curve_19 = Curve(dispatch_3.ListB)

uservalue_3 = Text(colour_swatch_3)
userkey_3 = Text("color")

c_script_5 = CSharpScript(geometry=curve_17, userKey=userkey_3, userValue=uservalue_3)  # -> out, geoWithUserString; inputs geometry: GeometryBase, userKey: String, userValue: String; same code as c_script_3
context_bake_5 = ContextBake(Geometry=c_script_5.geoWithUserString)

volume_4 = Volume(Geometry=construct_mesh_2)  # -> Volume, Centroid
text_tag = TextTag(Location=volume_4.Centroid, Text=panel_24)

construct_mesh_3 = ConstructMesh(Vertices=deconstruct_mesh_4.Vertices, Faces=deconstruct_mesh_4.Faces, Colours=ColourSwatch(SwatchColor=RGB(0, 0, 0)))  # -> flatten(Mesh)
context_bake_6 = ContextBake(Geometry=construct_mesh_3)

point_in_brep_2 = PointInBrep(Brep=cap_holes_2, Point=volume_4.Centroid, Strict=False)
dispatch_4 = Dispatch(List=panel_24, DispatchPattern=point_in_brep_2)  # -> ListA, ListB
data_3 = Data(dispatch_4.ListA)

construct_mesh_4 = ConstructMesh(Vertices=deconstruct_mesh_3.Vertices, Faces=deconstruct_mesh_3.Faces, Colours=ColourSwatch(SwatchColor=RGB(59, 59, 59)))  # -> flatten(Mesh)
context_bake_7 = ContextBake(Geometry=construct_mesh_4)

unit_z_7 = UnitZ(Factor=0.1)
surface_2 = Surface(curve_19)
extrude_4 = Extrude(Base=surface_2, Direction=unit_z_7)
mesh_brep_3 = MeshBrep(
    Brep=extrude_4,
    Settings={GridMaxCount=0, GridMinCount=16, JaggedSeams=False, MaxEdgeLength=0, MinEdgeLength=0.0001, MinTolerance=0, Refine=True, RefineAngle=0, RelativeTolerance=0.65, SimplePlanes=True, Tolerance=0})

unit_z_8 = UnitZ(Factor=0.1)
surface_3 = Surface(curve_18)
extrude_5 = Extrude(Base=surface_3, Direction=unit_z_8)
mesh_brep_4 = MeshBrep(
    Brep=extrude_5,
    Settings={GridMaxCount=0, GridMinCount=16, JaggedSeams=False, MaxEdgeLength=0, MinEdgeLength=0.0001, MinTolerance=0, Refine=True, RefineAngle=0, RelativeTolerance=0.65, SimplePlanes=True, Tolerance=0})

dispatch_5 = Dispatch(List=volume_4.Centroid, DispatchPattern=point_in_brep_2)  # -> ListA, ListB
deconstruct = Deconstruct(Point=dispatch_5.ListA)  # -> XComponent, YComponent, ZComponent

amenitiesmetadata = ContextPrint(AmenitiesMetadata=data_3)
amenitiesmetadata_2 = ContextPrint(AmenitiesLocationX=deconstruct.XComponent)
amenitiesmetadata_3 = ContextPrint(AmenitiesLocationY=deconstruct.YComponent)
amenitiesmetadata_4 = ContextPrint(AmenitiesLocationZ=deconstruct.ZComponent)

mesh_join_2 = MeshJoin(Meshes=[mesh_5, mesh_brep_3])
mesh_join_3 = MeshJoin(Meshes=[mesh_brep_4, mesh_4])

stream_filter_26 = StreamFilter(Gate=boolean, Stream0=mesh_join_3, Stream1=mesh_join_2)
deconstruct_mesh_5 = DeconstructMesh(Mesh=flatten(stream_filter_26))  # -> Vertices, Faces, Colours, Normals

construct_mesh_5 = ConstructMesh(
    Vertices=deconstruct_mesh_5.Vertices,
    Faces=deconstruct_mesh_5.Faces,
    Colours=ColourSwatch(SwatchColor=RGB(255, 255, 255)))  # -> flatten(Mesh)
context_bake_8 = ContextBake(BuildingsGeo=construct_mesh_5)

# ==== cluster GetDataFromOSM
T = ClusterInput()
txt = ClusterInput()
txt_2 = ClusterInput()
txt_3 = ClusterInput()
txt_4 = Text(txt_2)
txt_5 = Text(txt_3)
txt_6 = Text(txt)
null = NullItem(Item=txt_4)  # -> NullFlags, InvalidFlags, Description
lng = ListLength(List=txt_6)
list_item = ListItem(List=null.NullFlags, Index=0, Wrap=True)
equals = Equality(FirstNumber=lng, SecondNumber="1")  # -> Equality, Inequality
concat = Concatenate(FragmentD=" modv=\"not\"", FragmentA=" v=\"", FragmentB=txt_5, FragmentC="\"")
concat_2 = Concatenate(FragmentA=" v=\"", FragmentB=txt_4, FragmentC="\"")
null_2 = NullItem(Item=txt_5)  # -> NullFlags, InvalidFlags, Description
split = TextSplit(Text=T, Separators=",")
filter = StreamFilter(Gate=list_item, Stream0=concat_2)
filter_2 = StreamFilter(Gate=null_2.NullFlags, Stream0=concat)
item = ListItem(List=split, Index=0, Wrap=True)  # -> Item, Item1, Item2, Item3
panel = Panel("""node
way
relation""")
merge = Merge(Data1=item.Item1, Data2=item.Item, Data3=item.Item3, Data4=item.Item2)  # -> flatten(Result)
merge_2 = Merge(Data1=filter, Data2=filter_2)  # -> flatten(Result)
concat_3 = Concatenate(
    FragmentA="<query type=\"",
    FragmentB=panel,
    FragmentC="\"><has-kv k=\"",
    FragmentD=txt_6,
    FragmentE="\"",
    FragmentF=graft(merge_2),
    FragmentG="/></query>")
join = TextJoin(Text=merge, Join=",")
lng_2 = ListLength(List=merge)
equals_2 = Equality(FirstNumber="4", SecondNumber=lng_2)  # -> Equality, Inequality
join_2 = TextJoin(Text=concat_3)  # -> flatten(Result)
join_3 = TextJoin(Text=join_2)
panel_2 = Panel("""<union>
<item/>
<recurse type="down"/>
</union>
<print mode="body"/>
</osm-script>""")
concat_4 = Concatenate(FragmentA="<union>", FragmentB=join_3, FragmentC="</union>")
concat_5 = Concatenate(FragmentA="<osm-script output=\"xml\" timeout=\"200\" bbox=\"", FragmentB=join, FragmentC="\">")
concat_6 = Concatenate(FragmentA=concat_5, FragmentD=concat_4, FragmentC=panel_2)
p_n_c = PickNChoose(Pattern=equals.Equality, Stream0="insert one and only key", Stream1=concat_6)
filter_3 = StreamFilter(Gate=equals_2.Equality, Stream1=p_n_c)
concat_7 = Concatenate(FragmentA="http://overpass-api.de/api/interpreter?data=", FragmentB=filter_3)
key = Text(txt)
out = Text(filter_3)
in = Text(concat_7)
feat = Text(key)
in_2 = ClusterOutput(in)
out_2 = ClusterOutput(out)
feat_2 = ClusterOutput(feat)
