# Grasshopper definition rhino_input.gh (Grasshopper 1.0.7)

path = FilePath("C:\Users\david\Desktop\test.3dm")
encodedfile = GetString(AtLeast=1, AtMost=1, TreeAccess=False)
count = GetNumber(AtLeast=1, AtMost=1, Maximum=1.797693135e+308, Minimum=-1.797693135e+308, TreeAccess=False)
radius = GetNumber(AtLeast=1, AtMost=1, Maximum=1.797693135e+308, Minimum=-1.797693135e+308, TreeAccess=False)
python = GhPythonScript(data=encodedfile, FP=path)  # -> out, geom, layerIndex, layers, instances, instLayInd
# ---------- python: Python ----------
import System
import Rhino

try:
    b64 = System.Convert.FromBase64String(data)
    _dmfile = Rhino.FileIO.File3dm.FromByteArray(b64)
except:
    _dmfile = Rhino.FileIO.File3dm.Read(FP)
    print _dmfile

objtable = _dmfile.Objects

geom = []
geomLayerIndexList = []
for obj in objtable:
    
    if not isinstance(obj.Geometry,Rhino.Geometry.InstanceReferenceGeometry):

        geom.append(obj.Geometry)
        geomLayerIndexList.append(obj.Attributes.LayerIndex)
        

geom_= geom
layerIndex_ = geomLayerIndexList

layers = []
for l in _dmfile.Layers:
    layers.append(l)
    
    




layers_ = layers



instances = []
instancesLayerIndexes = []

# 
for obj in objtable:
    
    if isinstance(obj.Geometry,Rhino.Geometry.InstanceReferenceGeometry):
        geom = obj.Geometry
        parentId = geom.ParentIdefId
        instanceDef = _dmfile.InstanceDefinitions.FindId(parentId)
        instanceDefIds = instanceDef.GetObjectIds()
        
        xf =  geom.Xform
        instancesLayerIndexes.append(obj.Attributes.LayerIndex)
        
        for idefId in instanceDefIds:
            instanceObj= _dmfile.Objects.FindId(idefId)
            newObjGeom = instanceObj.Geometry.Duplicate()
            newObjGeom.Transform(xf)
            instances.append(newObjGeom)
            
            
instances_ = instances
instLayInd_ = instancesLayerIndexes
# ---------- end python ----------
dispatch = Dispatch(List=python.geom, DispatchPattern=[True, False])  # -> ListA, ListB
mesh = Mesh(python.geom)
volume = Volume(Geometry=dispatch.ListA)  # -> Volume, Centroid
volume_2 = Volume(Geometry=dispatch.ListB)  # -> Volume, Centroid
scale = Scale(Geometry=dispatch.ListA, Center=volume.Centroid, Factor=count)  # -> Geometry, Transform
scale_2 = Scale(Geometry=dispatch.ListB, Center=volume_2.Centroid, Factor=radius)  # -> Geometry, Transform
mesh_2 = Mesh(flatten([scale.Geometry, scale_2.Geometry]))
context_bake = ContextBake(Geometry=mesh_2)
