# Grasshopper definition geometry_copies.gh (Grasshopper 1.0.7)

encodedfile = GetString(AtLeast=1, AtMost=1, TreeAccess=False)
file_path = FilePath("C:\Users\jszychowska\source\iaac\2024\bimsc24-datamgmt-session06\src\submissions\studentB\assets\Programs massing.3dm")
ghpython_script = GhPythonScript(data=encodedfile, FP=file_path)  # -> out, geom, layerIndex, layers, instances, instLayInd
# ---------- ghpython_script: Python ----------
import System
import Rhino

try:
    b64 = System.Convert.FromBase64String(data)
    _dmfile = Rhino.FileIO.File3dm.FromByteArray(b64)
except:
    _dmfile = Rhino.FileIO.File3dm.Read(FP)
    print _dmfile

objtable = _dmfile.Objects

geom = []
geomLayerIndexList = []
for obj in objtable:
    
    if not isinstance(obj.Geometry,Rhino.Geometry.InstanceReferenceGeometry):

        geom.append(obj.Geometry)
        geomLayerIndexList.append(obj.Attributes.LayerIndex)
        

geom_= geom
layerIndex_ = geomLayerIndexList

layers = []
for l in _dmfile.Layers:
    layers.append(l)
    
    




layers_ = layers



instances = []
instancesLayerIndexes = []

# 
for obj in objtable:
    
    if isinstance(obj.Geometry,Rhino.Geometry.InstanceReferenceGeometry):
        geom = obj.Geometry
        parentId = geom.ParentIdefId
        instanceDef = _dmfile.InstanceDefinitions.FindId(parentId)
        instanceDefIds = instanceDef.GetObjectIds()
        
        xf =  geom.Xform
        instancesLayerIndexes.append(obj.Attributes.LayerIndex)
        
        for idefId in instanceDefIds:
            instanceObj= _dmfile.Objects.FindId(idefId)
            newObjGeom = instanceObj.Geometry.Duplicate()
            newObjGeom.Transform(xf)
            instances.append(newObjGeom)
            
            
instances_ = instances
instLayInd_ = instancesLayerIndexes
# ---------- end ghpython_script ----------
count = GetNumber(Slider(8, range=1..20), AtLeast=1, AtMost=1, Maximum=1.797693135e+308, Minimum=-1.797693135e+308, TreeAccess=False)
placerandomly = GetBoolean(Toggle(False), AtLeast=1, AtMost=1, FalseValue="False", TreeAccess=False, TrueValue="True")
color = GetInteger(Slider(1, range=0..2), AtLeast=1, AtMost=1, Maximum=2147483647, Minimum=-2147483648, TreeAccess=False)
stream_filter = StreamFilter(
    Gate=color,
    Stream0=ColourSwatch(SwatchColor=RGB(27, 134, 247)),
    Stream1=ColourSwatch(SwatchColor=RGB(176, 42, 163)),
    Stream2=ColourSwatch(SwatchColor=RGB(242, 111, 51)))
bounding_box = BoundingBox(Content=ghpython_script.geom, Plane=PlaneXY(0, 0, 0), UnionBox=True)  # -> Box, Box_2
construct_plane = ConstructPlane(Origin=Point(0, 0, 0), XAxis=Vector(1, 0, 0), YAxis=Vector(0, 1, 0))
deconstruct_brep = DeconstructBrep(Brep=bounding_box.Box)  # -> Faces, Edges, Vertices
rectangle = Rectangle(Plane=construct_plane, XSize="500", YSize="500", Radius=0)  # -> Rectangle, Length
length = Length(Curve=deconstruct_brep.Edges)  # -> flatten(Length)
construct_point = ConstructPoint(XCoordinate=0, YCoordinate=0, ZCoordinate=0)
populate_2d = Populate2D(Region=rectangle.Rectangle, Count=count, Seed=1)
average = Average(Input=length)
series = Series(Start=0, Step=average, Count=count)
vector_2pt = Vector2Pt(PointA=construct_point, PointB=populate_2d, Unitize=False)  # -> Vector, Length
vector_xyz = VectorXYZ(XComponent=series, YComponent=count, ZComponent=0)  # -> Vector, Length
move = Move(Geometry=ghpython_script.geom, Motion=graft(vector_xyz.Vector))  # -> Geometry, Transform
move_2 = Move(Geometry=ghpython_script.geom, Motion=graft(vector_2pt.Vector))  # -> Geometry, Transform
stream_filter_2 = StreamFilter(Gate=placerandomly, Stream0=move.Geometry, Stream1=move_2.Geometry)
mesh = Mesh(stream_filter_2)
mesh_colours = MeshColours(Mesh=flatten(mesh), Colours=stream_filter)
context_bake = ContextBake(Geometry=mesh_colours)
